# Dynamo graph 08.SheetData.dyn (Dynamo 1.3.2.2480)

# group: Collect Sheets
categories = Categories("Sheets")
all_elements_of_category = ElementsOfCategory(categories)
sheetNumber = Sheet.SheetNumber(all_elements_of_category)
code_block = CodeBlock { "A-0"; }
startsWith = String.StartsWith(str=sheetNumber, searchFor=code_block)
filterByBoolMask = List.FilterByBoolMask(list=all_elements_of_category, mask=startsWith)

code_block_2 = CodeBlock { "Sheet Number"; "Sheet Name"; }

# group: IMPORT EXCEL DATA
file_path = Filename(".\New Microsoft Excel Worksheet (2).xlsx")
fromPath = FileObject(file_path)  # "File.FromPath"
code_block_3 = CodeBlock { "Sheet1"; }
readFromFile = Excel.ReadFromFile(file=fromPath, sheetName=code_block_3)
transpose = List.Transpose(readFromFile)
code_block_4 = CodeBlock { 0; 1; }
getItemAtIndex = List.GetItemAtIndex(list=transpose, index=code_block_4.out1)
getItemAtIndex_2 = List.GetItemAtIndex(list=transpose, index=code_block_4.out0)

setParameterByName = Element.SetParameterByName(element=filterByBoolMask.in, parameterName=code_block_2.out1, value=getItemAtIndex)
setParameterByName_2 = Element.SetParameterByName(element=filterByBoolMask.in, parameterName=code_block_2.out0, value=getItemAtIndex_2)

# group: EXPORT TO EXCEL
file_path_2 = Filename(".\New Microsoft Excel Worksheet (2).xlsx")
code_block_5 = CodeBlock { "Sheet1"; 0; }
getParameterValueByName = Element.GetParameterValueByName(element=filterByBoolMask.in, parameterName=code_block_2.out0)
getParameterValueByName_2 = Element.GetParameterValueByName(element=filterByBoolMask.in, parameterName=code_block_2.out1)
create = List.Create(getParameterValueByName, getParameterValueByName_2)
transpose_2 = List.Transpose(create)
boolean = BoolSelector(true)
writeToFile = Excel.WriteToFile(filePath=file_path_2, sheetName=code_block_5.out0, startRow=code_block_5.out1, startCol=code_block_5.out1, data=transpose_2, overWrite=boolean)  # frozen
