# Dynamo graph 1.3.4_AddLink.dyn (Dynamo 1.3.4.6666)

directory_path = Directory("C:\Users\min.naung\Desktop\dsfa\ForSheet_LinkFileExport")
python_script = Python(IN[0]=directory_path)
# ---------- python_script.python (39 lines) ----------
# dynamo version - 1.3.4
# author - min.naung https://twentytwo.space


import clr,sys
clr.AddReference("RevitAPI")
clr.AddReference("RevitServices")
pyt_path = r'C:\Program Files (x86)\IronPython 2.7\Lib'
sys.path.append(pyt_path);

import os
from Autodesk.Revit.DB import *
from RevitServices.Persistence import DocumentManager
from RevitServices.Transactions import TransactionManager
doc = DocumentManager.Instance.CurrentDBDocument

folder = IN[0]

all_file_path = os.listdir(folder)

all_full_path = []

TransactionManager.Instance.EnsureInTransaction(doc)

for i in all_file_path:
	# full path
	full_file_path = os.path.join(folder, i)
	# convert to model path
	model_path = ModelPathUtils.ConvertUserVisiblePathToModelPath(full_file_path)
	# create link type
	link_type = RevitLinkType.Create(doc, model_path, RevitLinkOptions(True))
	# create link instance
	link_instance = RevitLinkInstance.Create(doc, link_type.ElementId)
	
	all_full_path.append(full_file_path)
	
TransactionManager.Instance.TransactionTaskDone()

OUT = all_full_path
# ----------------------------------------
