# Dynamo graph 1.3.4_ElementInfo.dyn (Dynamo 1.3.4.6666)

file_path = Filename(".\data.xlsx")
string = StringInput("Sheet1")
code_block = CodeBlock { 0; }
select_model_elements = DSModelElementsSelection()  # 12 picked in the model
# note: ElementInfo Script
python_script = Python(IN[0]=select_model_elements)
# ---------- python_script.python (42 lines) ----------
# dynamo version - 1.3.4

import clr
clr.AddReference('RevitAPI')
clr.AddReference("RevitServices")

from Autodesk.Revit.DB import *
from RevitServices.Persistence import DocumentManager

# the current document
doc = DocumentManager.Instance.CurrentDBDocument

# create properties values list
status,elementids,categories,ftypes, creators, owners, lastchangers =["Status"], ["ElementId"],["Category"],["FamilyType"],["Creator"],["Owner"],["LastChangedBy"] 

# input elements
elems = UnwrapElement(IN[0])

for e in elems:
	# element's doc
	c_doc = e.Document
	# get worksharing info
	wsu = WorksharingUtils.GetWorksharingTooltipInfo(c_doc,e.Id)
		
	# append properties values
	# get element status in model
	status.append(WorksharingUtils.GetModelUpdatesStatus(c_doc,e.Id))
	# get element Id
	elementids.append(e.Id)
	# get category name
	categories.append(e.Category.Name)
	# get family type
	ftypes.append(c_doc.GetElement(e.GetTypeId()))
	# get element's creator
	creators.append(wsu.Creator)
	# get current owner 
	owners.append(wsu.Owner)
	# get last changer
	lastchangers.append(wsu.LastChangedBy)

# output lists
OUT = status, elementids,categories,ftypes, creators, owners, lastchangers
# ----------------------------------------
transpose = List.Transpose(python_script)
boolean = BoolSelector(true)
writeToFile = Excel.WriteToFile(filePath=file_path, sheetName=string, startRow=code_block, startCol=code_block, data=transpose, overWrite=boolean)
