# Dynamo graph 1.3.4_RangeNode.dyn (Dynamo 1.3.4.6666)

code_block = CodeBlock { 50; 60; 5; }
python_script = Python(IN[0]=code_block.out0, IN[1]=code_block.out1, IN[2]=code_block.out2)
# ---------- python_script.python (26 lines) ----------
import clr
start = IN[0]
end = IN[1]
step = IN[2]

def irange(start,end,step):
	
	res = [start]
	if step == 1:
		return res
	if step == 2:
		res.append(end)
		return res
	if step > 2:
		a = (end-start)/(step-1)
		t = step - 2
		ans = start
		for i in range(t):
			ans+=a
			res.append(ans)
		res.append(end)
		return res

a=irange(start,end,step)

OUT = a			
# ----------------------------------------
