# Dynamo graph 1.3.4_Sheet.dyn (Dynamo 1.3.4.6666)

family_types = FamilyTypes("A2 metric:A2 metric")
views = Views("Level 1")
views_2 = Views("CLevel 1")
views_3 = Views("Level 2")
views_4 = Views("CLevel 2")
views_5 = Views("East")
views_6 = Views("South")
create = List.Create(views, views_2, views_3, views_4, views_5, views_6)
python_script = Python(IN[0]=family_types, IN[1]=create)  # frozen
# ---------- python_script.python (49 lines) ----------
import clr
clr.AddReference('RevitAPI')
clr.AddReference("RevitServices")
clr.AddReference("RevitNodes")
import RevitServices
import Revit
import Autodesk
from Autodesk.Revit.DB import *

from RevitServices.Persistence import DocumentManager
from RevitServices.Transactions import TransactionManager

doc = DocumentManager.Instance.CurrentDBDocument
t = UnwrapElement(IN[0])
views = UnwrapElement(IN[1])

TransactionManager.Instance.EnsureInTransaction(doc)

sheet = ViewSheet.Create(doc, t.Id)

o = sheet.Outline

# role divider
b1 = 1.4
b2 = 3.5

# column divider
a2 = [2,4] # two column
a3 = [1.4,2.5,7] # three column

# first role
x = o.Max.U - o.Min.U
y = o.Max.V - o.Min.V

uv1 = XYZ( x/7, y/1.4, 0)
uv2 = XYZ( x/2.5, y/1.4, 0)
uv3 = XYZ( x/1.4, y/1.4, 0)

# second role
uv4 = XYZ( x/7, y/3.5,0)
uv5 = XYZ( x/2.5, y/3.5,0)
uv6 = XYZ( x/1.4, y/3.5,0)

for v,loc in zip(views,[uv1,uv2,uv3,uv4,uv5,uv6]):
	Viewport.Create(doc, sheet.Id , v.Id,loc)

TransactionManager.Instance.TransactionTaskDone()	

OUT = sheet
# ----------------------------------------
code_block = CodeBlock { 1.4; 6; 5; }
python_script_2 = Python(IN[0]=code_block.out0, IN[1]=code_block.out1, IN[2]=code_block.out2)
# ---------- python_script_2.python (26 lines) ----------
import clr
start = IN[0]
end = IN[1]
step = IN[2]

def irange(start,end,step):
	
	res = [start]
	if step == 1:
		return res
	if step == 2:
		res.append(end)
		return res
	if step > 2:
		a = (end-start)/(step-1)
		t = step - 2
		ans = start
		for i in range(t):
			ans+=a
			res.append(ans)
		res.append(end)
		return res

a=irange(start,end,step)

OUT = a			
# ----------------------------------------
python_script_3 = Python(IN[0]=family_types, IN[1]=create)
# ---------- python_script_3.python (39 lines) ----------
# dynamo version - 1.3.4

import clr
clr.AddReference('RevitAPI')
clr.AddReference("RevitServices")

from Autodesk.Revit.DB import *
from RevitServices.Persistence import DocumentManager
from RevitServices.Transactions import TransactionManager

doc = DocumentManager.Instance.CurrentDBDocument

t = UnwrapElement(IN[0])
views = UnwrapElement(IN[1])

TransactionManager.Instance.EnsureInTransaction(doc)

sheet = ViewSheet.Create(doc, t.Id)

o = sheet.Outline

# net values
x = o.Max.U - o.Min.U
y = o.Max.V - o.Min.V

uv1 = XYZ( x/5, y/1.4, 0)
uv2 = XYZ( x/1.7, y/1.4, 0)

# second role
uv3 = XYZ( x/5, y/3.5,0)
uv4 = XYZ( x/1.7, y/3.5,0)


for v,loc in zip(views,[uv1,uv2,uv3,uv4]):
	Viewport.Create(doc, sheet.Id , v.Id,loc)

TransactionManager.Instance.TransactionTaskDone()	

OUT = sheet
# ----------------------------------------
