# Dynamo graph 1.3.4_SidesOfRoom.dyn (Dynamo 1.3.4.6666)

categories = Categories("Rooms")
all_elements_of_category = ElementsOfCategory(categories)
getRoomSideSurface = Custom[GetRoomSideSurface](Rooms=all_elements_of_category)  # Collect revit room sides as dynamo surfaces.
