# Dynamo graph 1.3.4_WorksetInfo.dyn (Dynamo 1.3.4.6666)

file_path = Filename("\\SpecialistSvr\02_Shared\MinNaung\Element_Info.rvt")
python_script = Python(IN[0]=file_path)
# ---------- python_script.python (31 lines) ----------
# dynamo version - 1.3.4

import clr
clr.AddReference('RevitAPI')
clr.AddReference("RevitServices")

from Autodesk.Revit.DB import *
from RevitServices.Persistence import DocumentManager

# the current document
doc = DocumentManager.Instance.CurrentDBDocument

# output lists
names, owners = [], []

# input filepath
file_path = IN[0]
# convert filepath to modelpath
model_path = ModelPathUtils.ConvertUserVisiblePathToModelPath(file_path)
# collect workset info
worksets = WorksharingUtils.GetUserWorksetInfo(model_path);
# each workset
for workset in worksets:
	# workset name
	names.append(workset.Name)
	# workset owner
	owners.append(workset.Owner)

# output results
OUT = names, owners
	
# ----------------------------------------
