# Dynamo custom node DiamondPanel.dyf (Dynamo 1.3.2.2480)
# category: Quasar.DynamoNodes
# Surface divide into diamond and triangle shapes by given U, V division value.

Surface = Input()  # "Surface_"; surface geometry
UDivision = Input()  # Udivision double
VDivision = Input()  # Vdivision double
# note: IN[0] = Surface
# IN[1] = Udivision
# IN[2] = Vdivision
python_script = Python(IN[0]=Surface, IN[1]=UDivision, IN[2]=VDivision)
# ---------- python_script.python (133 lines) ----------
# dynamo version 1.3.0
# author - min.naung@mgjean https://twentytwo.space/contact/
import clr
clr.AddReference('ProtoGeometry')
from Autodesk.DesignScript.Geometry import *

surface = IN[0];
upanel = IN[1];
vpanel = IN[2];

DiamondPanel = [];
TrianglePanel = []; 
ustep = 1.0/upanel;
vstep = 1.0/vpanel;
for i in range(0,upanel+1,1):
	for j in range(0,vpanel+1,1):
		if (i+j) % 2 == 0:
			pointA = surface.PointAtParameter(0,0);
			pointB = surface.PointAtParameter(0,0);
			pointC = surface.PointAtParameter(0,0);
			pointD = surface.PointAtParameter(0,0);

			if i > 0:
				pointA = surface.PointAtParameter((i-1)*ustep, j*vstep);

			else:
				pointB = surface.PointAtParameter(i * ustep, j*vstep)

			if j > 0:
				pointB = surface.PointAtParameter(i * ustep, (j-1) * vstep);
			else:
				pointB = surface.PointAtParameter(i *ustep, j * vstep);

			if i < upanel:
				pointC = surface.PointAtParameter((i+1) * ustep, j * vstep);

			else:
				pointC = surface.PointAtParameter(i * ustep, j* vstep);

			if j <= (vpanel - 1):
				pointD = surface.PointAtParameter(i*ustep, (j+1)*vstep);
			else:
				pointD = surface.PointAtParameter(i * ustep, j * vstep);

			if i > 0 and j > 0 and i < upanel and j <= (vpanel - 1):

				points = [];
				points.append(pointA);
				points.append(pointB);
				points.append(pointC);
				points.append(pointD);
		
				panel = Surface.ByPerimeterPoints(points);
		
				DiamondPanel.append(panel);
		
				
			if i > 0 and j > 0 and i < upanel and j < vpanel:
				points = [];
			else:
				if i == 0 and j == 0:
					points = []
					points.append(pointB);
					points.append(pointC);
					points.append(pointD);

					panel = Surface.ByPerimeterPoints(points);
					TrianglePanel.append(panel);
				
				if i == 0 and j == vpanel:
					points = []
					points.append(pointB);
					points.append(pointC);
					points.append(pointD);

					panel = Surface.ByPerimeterPoints(points);
					TrianglePanel.append(panel);
				
				if i == upanel and j == 0:
					points = []
					points.append(pointC);
					points.append(pointD);
					points.append(pointA);

					panel = Surface.ByPerimeterPoints(points);
					TrianglePanel.append(panel);

				if i == upanel and j == vpanel:
					points = []
					points.append(pointA);
					points.append(pointB);
					points.append(pointC);

					panel = Surface.ByPerimeterPoints(points);
					TrianglePanel.append(panel);
				
				if i == 0 and j > 0 and j < vpanel:
					points = []
					points.append(pointB);
					points.append(pointC);
					points.append(pointD);

					panel = Surface.ByPerimeterPoints(points);
					TrianglePanel.append(panel);

				if i == upanel and j > 0 and j < vpanel:
					points = []
					points.append(pointA);
					points.append(pointB);
					points.append(pointD);

					panel = Surface.ByPerimeterPoints(points);
					TrianglePanel.append(panel);

				if j==0 and i > 0 and j < vpanel:
					points = []
					points.append(pointA);
					points.append(pointC);
					points.append(pointD);

					panel = Surface.ByPerimeterPoints(points);
					TrianglePanel.append(panel);

				if j == vpanel and i > 0 and i < upanel:
					points = []
					points.append(pointA);
					points.append(pointB);
					points.append(pointC);

					panel = Surface.ByPerimeterPoints(points);
					TrianglePanel.append(panel);

OUT = DiamondPanel,TrianglePanel
# ----------------------------------------
code_block = CodeBlock(i=python_script) { i[0]; i[1]; }
DiamondPanel = Output(code_block.out0)  # diamond panels
TiranglePanel = Output(code_block.out1)  # triangle panels
