# Dynamo graph Export_Image.dyn (Dynamo 1.3.3.4651)

python_script = Python()  # unwired: IN[0]
# ---------- python_script.python (45 lines) ----------
import clr,sys
clr.AddReference("RevitAPI")
clr.AddReference("RevitServices")

from Autodesk.Revit.DB import *
from RevitServices.Persistence import DocumentManager
from RevitServices.Transactions import TransactionManager

# add ipy library path
sys.path.append("C:\Program Files (x86)\IronPython 2.7\Lib")
# os module import
import os
# user desktop path
desktopPath = os.path.join(os.path.join(os.environ['USERPROFILE']), 'Desktop')
# current document
doc = DocumentManager.Instance.CurrentDBDocument
# transaction start
TransactionManager.Instance.EnsureInTransaction(doc)

# image export options constructor
ieo = ImageExportOptions()
# export range (exporting amount of view(s))  
ieo.ExportRange = ExportRange.CurrentView
# file path
filePath = os.path.join(desktopPath, currentView.Name)
ieo.FilePath = filePath
# File type for exported HLR and wireframe views
ieo.HLRandWFViewsFileType = ImageFileType.PNG
# image resolution
ieo.ImageResolution = ImageResolution.DPI_300
# fit direction
ieo.FitDirection = FitDirectionType.Horizontal
# pixelsize
ieo.PixelSize = 1200
# file type for exported shadow views
ieo.ShadowViewsFileType = ImageFileType.PNG
# zoom type
ieo.ZoomType = ZoomFitType.FitToPage

# export image
doc.ExportImage(ieo)

TransactionManager.Instance.TransactionTaskDone()

OUT = ieo.FilePath
# ----------------------------------------
