# Dynamo graph Families.dyn (Dynamo 1.3.3.4651)

# note: *** NOTE
# Collect user loaded families.
# Return value = FamilyCategoryName and FamilyName pairs
# { "FamilyCategoryName" : [ "FamilyName1", "FamilyName2" ] }
python_script = Python()  # unwired: IN[0]
# ---------- python_script.python (25 lines) ----------
import clr
clr.AddReference("RevitAPI")
clr.AddReference("RevitServices")

from Autodesk.Revit.DB import *
from RevitServices.Persistence import DocumentManager
from RevitServices.Transactions import TransactionManager

doc = DocumentManager.Instance.CurrentDBDocument

#TransactionManager.Instance.EnsureInTransaction()
result = []

families = FilteredElementCollector(doc).OfClass(Family).WhereElementIsNotElementType().ToElements()

categories = {f.FamilyCategory.Name:[] for f in families if f.IsUserCreated}


for f in families:
	for key in categories.keys():
		if f.FamilyCategory.Name == key:
			categories[key].append(f.Name)
			break

OUT = sorted(categories.items(), key= lambda keyvalue:keyvalue)
# ----------------------------------------
firstItem = List.FirstItem()  # unwired: arg0
map = List.Map(list=python_script, f_x=firstItem)
lastItem = List.LastItem()  # unwired: arg0
map_2 = List.Map(list=python_script, f_x=lastItem)
customDropdownSelection = Custom[CustomDropdownSelection](Title=map, Items=map_2)  # Create a dropdown with checkboxes. First input is a list and Second input is a nested list. Eg. {"a","b","c"} and {{1,2,3},{4,5,6},{7,8,9}}. It match their index. So, {1,2,3} is under dropdown "a".
