# Dynamo graph Material_Duplicate.dyn (Dynamo 1.3.2.2480)

code_block = CodeBlock { {"Wood", "Ceramic Tile"}; }
code_block_2 = CodeBlock { {"Woody" , "Cigaretts"}; }
# note: IN[0] = Material Names (To Duplicate)
# IN[0] = Names For New Materials
materialsDuplicate = Python(IN[0]=code_block, IN[1]=code_block_2)
# ---------- materialsDuplicate.python (39 lines) ----------
# dynamo version - 1.3.2
#(should be fine with 1.3.x or 2.x.x versions too)

import clr

clr.AddReference('RevitAPI')
clr.AddReference("RevitServices")

from Autodesk.Revit.DB import *
from Autodesk.Revit.DB.Structure import *

from RevitServices.Persistence import DocumentManager
from RevitServices.Transactions import TransactionManager

doc = DocumentManager.Instance.CurrentDBDocument

mat_names = IN[0] if isinstance(IN[0], list) else [IN[0]]
new_names = IN[1] if isinstance(IN[1], list) else [IN[1]]

names, ids = [], []

res = []
# collect parameters
materials = FilteredElementCollector(doc).OfCategory(BuiltInCategory.OST_Materials).ToElements()

			
# start transaction
TransactionManager.Instance.EnsureInTransaction(doc)

for name,newname in zip(mat_names,new_names):
	for mat in materials:
		if name == mat.Name:		
			dup = mat.Duplicate(newname)
			res.append(dup)

# end transaction				
TransactionManager.Instance.TransactionTaskDone()

OUT = res
# ----------------------------------------
