# Dynamo graph RoomToMass.dyn (Dynamo 1.3.4.6666)

categories = Categories("Rooms")
all_elements_of_category = ElementsOfCategory(categories)
# note: MassingByRoomScript
python_script = Python(IN[0]=all_elements_of_category)
# ---------- python_script.python (64 lines) ----------
import clr, System

clr.AddReference('RevitAPI')
clr.AddReference('RevitServices')

from Autodesk.Revit.DB import *
from RevitServices.Persistence import DocumentManager
from RevitServices.Transactions import TransactionManager

# current document
doc = DocumentManager.Instance.CurrentDBDocument

# input
elems = IN[0];

# get mass category object
MassBICObj = System.Enum.ToObject(BuiltInCategory,BuiltInCategory.OST_Mass)

# mass object id
objId = ElementId(MassBICObj)

# make list
if not isinstance(elems,list):
	elems = UnwrapElement([elem])
else:
	elems = UnwrapElement(elems)

# output result
res = []

# transaction start
TransactionManager.Instance.EnsureInTransaction(doc)

# each room
for e in elems:
	# get room name
	name = e.LookupParameter("Name").AsString()
	# get room number
	number = e.LookupParameter("Number").AsString()
	elem_name = number+"_"+name
	# collect geometry element
	geoobj = e.Geometry[Options()]
	# make enum to get geometry object
	enum = geoobj.GetEnumerator();
	shape = [i for i in enum][0]
	
	# create direct shape type
	shapeType = DirectShapeType.Create(doc,elem_name,objId)
	# set shape to geometry list shape
	shapeType.SetShape([shape])
	# get dslibrary
	lib = DirectShapeLibrary.GetDirectShapeLibrary(doc)
	# add type to dslibrary
	lib.AddDefinitionType(elem_name,shapeType.Id)
	# create element by shapetype
	element = DirectShape.CreateElementInstance(doc,shapeType.Id,objId,elem_name,Transform.Identity)
	# set typeId
	element.SetTypeId(shapeType.Id)
	# append to output
	res.append(element)
# transaction end		
TransactionManager.Instance.TransactionTaskDone()

OUT = res
# ----------------------------------------
