# Dynamo graph WP_FR-LineStyles.dyn (Dynamo 1.3.2.2480)

select_filled_region_type = FilledRegionTypes("TYPE-5 (W1)")
line_styles = LineStyleUi("WP_TYPE-5 (W1)")
code_block = CodeBlock { true; }
# note: ** Change Fill Region Line Style (Active View Only)
# IN[0] = Fill Region Type
# IN[1] = Line Style
# IN[2] = Active view (boolean)
fillRegions = Python(IN[0]=select_filled_region_type, IN[1]=line_styles, IN[2]=code_block)
# ---------- fillRegions.python (35 lines) ----------
import clr


clr.AddReference("RevitAPI")
from Autodesk.Revit.DB import *
clr.AddReference("RevitServices")
import RevitServices
from RevitServices.Persistence import DocumentManager
from RevitServices.Transactions import TransactionManager

doc = DocumentManager.Instance.CurrentDBDocument

frtId = UnwrapElement(IN[0]).Id
lineId = UnwrapElement(IN[1]).Id
active_view = IN[2]

if active_view:
	elems = FilteredElementCollector(doc, doc.ActiveView.Id).OfClass(FilledRegion)
else:
	elems = FilteredElementCollector(doc).OfClass(FilledRegion)


res = []

TransactionManager.Instance.EnsureInTransaction(doc)

for i in elems:
		if frtId == i.GetTypeId():
			i.SetLineStyleId(lineId)
			res.append(i)
	
TransactionManager.Instance.TransactionTaskDone()


OUT = res
# ----------------------------------------
