# Dynamo graph WP_FillRegions.dyn (Dynamo 1.3.2.2480)

# group: COLLECT ROOM
categories = Categories("Rooms")
getLinkDocument = Custom[GetLinkDocument]()  # Get all link document. Each list contains , [0] Name of Link Document (String) [1] Link Document (Document)
code_block = CodeBlock(i=getLinkDocument) { i[-1][1]; }
getElementFromLinkDocument = Quasar.LinkDocumentUtility.GetElementFromLinkDocument(categories, code_block)

# group: FLOOR TYPE FILL REGION
views = Views("12TH STOREY")
code_block_2 = CodeBlock { "WP TYPE FLOOR"; "TYPE 4"; }
getParameterValueByName = Element.GetParameterValueByName(element=getElementFromLinkDocument, parameterName=code_block_2.out0)
eq = getParameterValueByName == code_block_2.out1
filterByBoolMask = List.FilterByBoolMask(list=getElementFromLinkDocument, mask=eq)
code_block_3 = CodeBlock { "Number"; }
getParameterValueByName_2 = Element.GetParameterValueByName(parameterName=code_block_3)  # unwired: element
sortByFunction = SortByFunction(filterByBoolMask.in, getParameterValueByName_2)
coreBoundary = Room.CoreBoundary(sortByFunction)
select_filled_region_type = FilledRegionTypes("TYPE-4")
byCurves = FilledRegion.ByCurves(views, coreBoundary, select_filled_region_type)

# group: WALL TYPE FILL REGION
views_2 = Views("12TH STOREY")
code_block_4 = CodeBlock { "WP TYPE WALL"; "TYPE 5"; }
getParameterValueByName_3 = Element.GetParameterValueByName(element=getElementFromLinkDocument, parameterName=code_block_4.out0)
eq_2 = getParameterValueByName_3 == code_block_4.out1
filterByBoolMask_2 = List.FilterByBoolMask(list=getElementFromLinkDocument, mask=eq_2)
code_block_5 = CodeBlock { "Number"; }
getParameterValueByName_4 = Element.GetParameterValueByName(parameterName=code_block_5)  # unwired: element
sortByFunction_2 = SortByFunction(filterByBoolMask_2.in, getParameterValueByName_4)
coreBoundary_2 = Room.CoreBoundary(sortByFunction_2)
select_filled_region_type_2 = FilledRegionTypes("TYPE-5 (W1)")
byCurves_2 = FilledRegion.ByCurves(views_2, coreBoundary_2, select_filled_region_type_2)
