# Dynamo graph google_translate_sample.dyn (Dynamo 2.0.2.6826)

# group: Full ISO Language paring codes
code_block = CodeBlock()
# ---------- code_block.designscript (33 lines) ----------
// Language Codes: Auto
auto = "auto";
// Language Codes: A-H
Afrikaans = "af";
Albanian = "sq";
Arabic = "ar";
Azerbaijani	= "az";
Basque = "eu";
Bengali	= "bn";
Belarusian = "be";
Bulgarian = "bg";
Catalan = "ca";
ChineseSimplified = "zh-CN";
ChineseTraditional = "zh-TW";
Croatian = "hr";
Czech = "cs";
Danish = "da";
Dutch = "nl";
English = "en";
Esperanto = "eo";
Estonian = "et";
Filipino = "tl";
Finnish = "fi";
French = "fr";
Galician = "gl";
Georgian = "ka";
German = "de";
Greek = "el";
Gujarati = "gu";
HaitianCreole = "ht";
Hebrew = "iw";
Hindi = "hi";
Hungarian = "hu";
# ----------------------------------------
code_block_2 = CodeBlock()
# ---------- code_block_2.designscript (35 lines) ----------
// Language Codes: I-Z
Icelandic = "is";
Indonesian = "id";
Irish = "ga";
Italian = "it";
Japanese = "ja";
Kannada = "kn";
Korean = "ko";
Latin = "la";
Latvian = "lv";
Lithuanian = "lt";
Macedonian = "mk";
Malay = "ms";
Maltese	= "mt";
Norwegian = "no";
Persian = "fa";
Polish = "pl";
Portuguese = "pt";
Romanian = "ro";
Russian = "ru";
Serbian = "sr";
Slovak = "sk";
Slovenian = "sl";
Spanish = "es";
Swahili = "sw";
Swedish = "sv";
Tamil = "ta";
Telugu = "te";
Thai = "th";
Turkish = "tr";
Ukrainian = "uk";
Urdu = "ur";
Vietnamese = "vi";
Welsh = "cy";
Yiddish	= "yi";
# ----------------------------------------

# group: What you want to translate
code_block_3 = CodeBlock()
# ---------- code_block_3.designscript (6 lines) ----------
singleItem = "A string I want to translate";
listOfItems = [
"My favourite spread is jam.",
"Blue is the best colour",
"Architecture is life."
];
# ----------------------------------------

# group: Google API
code_block_4 = CodeBlock(sourceLang=code_block.English, targetLang=code_block_2.Malay, sourceText=code_block_3.listOfItems)
# ---------- code_block_4.designscript (3 lines) ----------
// Using Google Translate Web APIs to translate stuff
"https://translate.googleapis.com/translate_a/single?client=gtx&sl=" + sourceLang +
"&tl=" + targetLang + "&dt=t&q=" + sourceText;
# ----------------------------------------

# group: DynaWeb Package
byUrl = DynaWeb.WebRequest.ByUrl(url=code_block_4)
execute = DynaWeb.WebRequest.Execute(request=byUrl)
content = DynaWeb.WebResponse.Content(webResponse=execute)

# group: parsing the Data
code_block_5 = CodeBlock { "["; "]"; }
split = String.Split(str=content, separater0=code_block_5.out0, separater1=code_block_5.out1)

code_block_6 = CodeBlock { 0; }
getItemAtIndex = List.GetItemAtIndex(index=code_block_6)  # unwired: list
map = List.Map(list=split, f_x=getItemAtIndex)
code_block_7 = CodeBlock { ","; }
split_2 = String.Split(str=map, separater0=code_block_7)
code_block_8 = CodeBlock { 0; }
getItemAtIndex_2 = List.GetItemAtIndex(index=code_block_8)  # unwired: list

# group: Translated
map_2 = List.Map(list=split_2, f_x=getItemAtIndex_2)

code_block_9 = CodeBlock { 1; }
getItemAtIndex_3 = List.GetItemAtIndex(index=code_block_9)  # unwired: list

# group: Source
map_3 = List.Map(list=split_2, f_x=getItemAtIndex_3)
