# Dynamo graph print_mgr_setting.dyn (Dynamo 1.3.3.4651)

views = Views("What's New in Templates and Content")
# note: IN[0] = Sheet
# IN[1] = PDF Name
# IN[2] = Print Setup Name
file_path = Filename(".\efg.pdf")
string = StringInput("aaa")
print_parameters = Python(IN[0]=views, IN[1]=file_path, IN[2]=string)
# ---------- print_parameters.python (80 lines) ----------
# dynamo version - 1.3.3

import clr
clr.AddReference("RevitAPI")
clr.AddReference("RevitServices")

from Autodesk.Revit.DB import *
from RevitServices.Persistence import DocumentManager
from RevitServices.Transactions import TransactionManager

doc = DocumentManager.Instance.CurrentDBDocument

sheet = UnwrapElement(IN[0])
pdfName = IN[1]
SetupName = IN[2]

# current document's print manager object
pmgr = doc.PrintManager
# set in session
pmgr.PrintSetup.CurrentPrintSetting = pmgr.PrintSetup.InSession
# determine print range
pmgr.PrintRange = PrintRange.Select
# set printer
pmgr.SelectNewPrintDriver("PDF reDirect v2")
# print to file
pmgr.PrintToFile = True
pmgr.PrintToFileName = pdfName
# current printing setting
currentPrintSetting = pmgr.PrintSetup.CurrentPrintSetting
# current printing setting
settingParams = currentPrintSetting.PrintParameters
# color depth type enum
settingParams.ColorDepth = ColorDepthType.Color
# hidden line views type
settingParams.HiddenLineViews = HiddenLineViewsType.RasterProcessing
# hide crop boundaries
settingParams.HideCropBoundaries = False
# hide ref/work planes
settingParams.HideReforWorkPlanes = True
# hide scope boxes
settingParams.HideScopeBoxes = True
# hide unreferenced view tags
settingParams.HideUnreferencedViewTags = False
# paper placement
settingParams.PaperPlacement = PaperPlacementType.Margins
# margin type
settingParams.MarginType = MarginType.PrinterLimit
# mask coincident lines
settingParams.MaskCoincidentLines = False
# page orientation
settingParams.PageOrientation = PageOrientationType.Landscape
# get A1 paper size
A1 = [i for i in pmgr.PaperSizes if i.Name =="A1"][0]
# set A1 paper size
settingParams.PaperSize = A1
# raseter quality type
settingParams.RasterQuality = RasterQualityType.Presentation
# replace halftone 
settingParams.ReplaceHalftoneWithThinLines = False
# zoom
settingParams.ZoomType = ZoomType.Zoom
# zoom value
settingParams.Zoom = 100

#TransactionManager.Instance.EnsureInTransaction(doc)

pmgr.PrintSetup.CurrentPrintSetting = currentPrintSetting

try:
	pmgr.PrintSetup.SaveAs(SetupName)
except:
	pass

#TransactionManager.Instance.TransactionTaskDone()
pmgr.Apply()

# sheet
pmgr.SubmitPrint(sheet)

OUT = pmgr
# ----------------------------------------
python_script = Python(IN[0]=print_parameters)  # frozen
# ---------- python_script.python (27 lines) ----------
import clr
clr.AddReference("RevitAPI")
clr.AddReference("RevitServices")

from Autodesk.Revit.DB import *
from RevitServices.Persistence import DocumentManager
from RevitServices.Transactions import TransactionManager

doc = DocumentManager.Instance.CurrentDBDocument

#TransactionManager.Instance.EnsureInTransaction()

pmgr = UnwrapElement(IN[0])
res = []

currentPrintSetting = pmgr.PrintSetup.CurrentPrintSetting
settingParams = currentPrintSetting.PrintParameters


for i in settingParams:
	if not i.startswith("__"):
		try:
			res.append([i, getattr(settingParams,i)])
		except:
			res.append(i + " can't get value.")

OUT = res
# ----------------------------------------
python_script_2 = Python()  # unwired: IN[0]
# ---------- python_script_2.python (17 lines) ----------
import clr
clr.AddReference("RevitAPI")
clr.AddReference("RevitServices")

from Autodesk.Revit.DB import *
from RevitServices.Persistence import DocumentManager
from RevitServices.Transactions import TransactionManager

doc = DocumentManager.Instance.CurrentDBDocument

#TransactionManager.Instance.EnsureInTransaction()

pmgr = doc.PrintManager

psetup = pmgr.PrintSetup

OUT = psetup.CurrentPrintSetting,psetup.InSession
# ----------------------------------------
watch = Watch(python_script_2)
