# Dynamo graph schedule sample.dyn (Dynamo 2.0.2.6826)

# group: Create Schedule
categories = Categories(index=574)
code_block = CodeBlock { "DYN - Wall Schedule1"; }
schedule_type = ScheduleTypes(index=2)
createSchedule = ScheduleView.CreateSchedule(category=categories, name=code_block, scheduleType=schedule_type)

# group: Add Fields (Parameters)
schedulableFields = ScheduleView.SchedulableFields(scheduleView=createSchedule)
code_block_2 = CodeBlock(i=schedulableFields) { [i[3], i[0],i[12],i[17]]; }
addFields = ScheduleView.AddFields(scheduleView=createSchedule, fields=code_block_2)

# group: Create Schedule Filter
fields = ScheduleView.Fields(scheduleView=createSchedule)
code_block_3 = CodeBlock(i=fields) { i[3]; }
schedule_filter_type = ScheduleFilterType(index=1)
code_block_4 = CodeBlock { "test"; }
byFieldTypeAndValue = Revit.Schedules.ScheduleFilter.ByFieldTypeAndValue(field=code_block_3, filterType=schedule_filter_type, value=code_block_4)
addFilters = ScheduleView.AddFilters(scheduleView=addFields, scheduleFilters=byFieldTypeAndValue)
