# Dynamo graph sides of room.dyn (Dynamo 2.0.2.6826)

categories = Categories(index=403)
all_elements_of_category = ElementsOfCategory(Category=categories)
roomCollector = Custom[RoomCollector](Rooms=all_elements_of_category)  # Collect rooms by their status.
sides_of_room = Python(IN[0]=roomCollector.Placed)  # frozen
# ---------- sides_of_room.python (28 lines) ----------
import clr
clr.AddReference("RevitAPI");
clr.AddReference("RevitNodes")

import Autodesk, Revit;
clr.ImportExtensions(Revit.Elements);
clr.ImportExtensions(Revit.GeometryConversion);
from Autodesk.Revit.DB import *

rooms = UnwrapElement(IN[0]);
result =[];


for room in rooms:
	geo = room.get_Geometry(Options())
	enum = geo.GetEnumerator()
	next = enum.MoveNext()
	solid = enum.Current
	faces = solid.Faces
	count = 0;
	sub = []
	for face in faces:
		count +=1;
		if count>2:
			sub.append(face.ToProtoType()[0])
			sub.append(face.GetEdgesAsCurveLoops()[0])
	result.append(sub)
OUT = result
# ----------------------------------------
sides_of_room_2 = Python(IN[0]=roomCollector.Placed)
# ---------- sides_of_room_2.python (35 lines) ----------
import clr
clr.AddReference("RevitAPI");
clr.AddReference("RevitNodes")

import Autodesk, Revit;
clr.ImportExtensions(Revit.Elements);
clr.ImportExtensions(Revit.GeometryConversion);
from Autodesk.Revit.DB import *

rooms = UnwrapElement(IN[0]);
result =[];

"""
for room in rooms:
	geo = room.get_Geometry(Options())
	enum = geo.GetEnumerator()
	next = enum.MoveNext()
	solid = enum.Current
	faces = solid.Faces
	count = 0;
	sub = []
	for face in faces:
		count +=1;
		if count>2:
			sub.append(face.ToProtoType()[0])
			sub.append(face.GetEdgesAsCurveLoops()[0])
	result.append(sub)
OUT = result
"""

for room in rooms:
	bbox = room.get_BoundingBox(None);
	result.append(bbox.ToProtoType())
	
OUT = result
# ----------------------------------------
toCuboid = BoundingBox.ToCuboid(boundingBox=sides_of_room_2)
