# Dynamo graph subcategory.dyn (Dynamo 1.3.2.2480)

# group: Keywords
code_block = CodeBlock { {"ciap", "arup"}; }

# group: Remove LineStyles
python_script = Python(IN[0]=code_block)
# ---------- python_script.python (31 lines) ----------
import clr
clr.AddReference("RevitAPI")
clr.AddReference("RevitServices")

from Autodesk.Revit.DB import *
from RevitServices.Persistence import DocumentManager
from RevitServices.Transactions import TransactionManager


doc = DocumentManager.Instance.CurrentDBDocument

cate = Category.GetCategory(doc, BuiltInCategory.OST_Lines)

res = {}
keywords = IN[0]
removed = []
# line category store
for i in cate.SubCategories:
	for k in keywords:
		if k in i.Name:
			res[i.Name] = i.Id
			
TransactionManager.Instance.EnsureInTransaction(doc)

for name, id in res.items():
	removed.append(name)
	doc.Delete(id)

TransactionManager.Instance.TransactionTaskDone()

OUT = removed
# ----------------------------------------
