# Dynamo custom node 3DViewsSectionBoxesByRooms.dyf (Dynamo 1.3.0.875)
# category: Quasar.Revit.AxonometricView
# Create 3DViews with section boxes by room elements and offset.

Rooms = Input()
Names = Input(Names:string)
Offset = Input(Offset:double)
Run = Input(Run:bool=false)
# note: IN[0] = Room elements;
# IN[1] = Names for views
# IN[2] = Offset from element bounding box ( Unit : millimeters)
# IN[4] = Run
sectionBoxes3DViewsByElements = Python(IN[0]=Rooms, IN[1]=Names, IN[2]=Offset, IN[3]=Run)
# ---------- sectionBoxes3DViewsByElements.python (77 lines) ----------
# dynamo version - 1.3.0
# author - mgjean
import clr
clr.AddReference("RevitNodes")
import Revit
clr.ImportExtensions(Revit.Elements)
clr.AddReference("RevitServices")
import RevitServices
from RevitServices.Persistence import DocumentManager
from RevitServices.Transactions import TransactionManager
clr.AddReference("RevitAPI")
import Autodesk
from Autodesk.Revit.DB import *

doc = DocumentManager.Instance.CurrentDBDocument

listElements = IN[0];
listViewNames = IN[1];
offset = IN[2]/304.8;
run = IN[3];
results = [];

if not isinstance(listElements,list):
	listElements = [listElements];

if not isinstance(listViewNames,list):
	listViewNames = [listViewNames];


def crop_box(bbox, offset):
	minX = bbox.Min.X - offset;
	minY = bbox.Min.Y - offset;
	minZ = bbox.Min.Z - offset;
	maxX = bbox.Max.X + offset;
	maxY = bbox.Max.Y + offset;
	maxZ = bbox.Max.Z + offset;
	
	newbox = BoundingBoxXYZ();
	newbox.Min = XYZ(minX,minY, minZ);
	newbox.Max = XYZ(maxX, maxY, maxZ);
	return newbox;

def createNewSectionBox(elem,viewName,offset):

	collector = FilteredElementCollector(doc).OfClass(ViewFamilyType);
	for i in collector:
		if i.ViewFamily == ViewFamily.ThreeDimensional:
			viewType = i;	
	
	bbox = crop_box(UnwrapElement(elem).BoundingBox[doc.ActiveView],offset);
	
	# create 3D View
	view = View3D.CreateIsometric(doc, viewType.Id);
	view.Name = viewName;
	view.SetSectionBox(bbox);
	view.CropBoxActive = True;
	view.CropBoxVisible = True;
	view.Scale = 50;
	view.DetailLevel = ViewDetailLevel.Fine;
	view.DisplayStyle = DisplayStyle.Realistic;
	# return view
	return view;

if run:

	# Start Transaction
	TransactionManager.Instance.EnsureInTransaction(doc);

	for element,name in zip(listElements,listViewNames):
		results.append(createNewSectionBox(element,name,offset));
	
	# End Transaction
	TransactionManager.Instance.TransactionTaskDone()

	OUT = results;
else:
	OUT = "Run Forest Run";
# ----------------------------------------
n3DViews = Output(sectionBoxes3DViewsByElements)  # "3DViews"
