# Dynamo custom node CeilingViewsForRooms.dyf (Dynamo 1.3.0.875)
# category: Quasar.Revit.Ceiling
# Create ceiling plans for each of the rooms.
# This node take only one ceiling plan which will be duplicated for given amount of rooms and crop by room bounding box and offset.

View = Input(View:CeilingPlanView)
Rooms = Input()
Offset = Input(Offset:double)
Detailing = Input(Detailing:bool=false)
Run = Input(Run:bool=false)
# note: IN[0] = View [Main Plan View to Duplicate];
# IN[1] = Rooms
# IN[2] = Offset
# IN[3] = Detailing [boolean]
# IN[4] = Run
python_script = Python(IN[0]=View, IN[1]=Rooms, IN[2]=Offset, IN[3]=Detailing, IN[4]=Run)
# ---------- python_script.python (66 lines) ----------
# dynamo version - 1.3.0
# author - mgjean

import clr
clr.AddReference("RevitAPI")
from Autodesk.Revit.DB import *
clr.AddReference("RevitServices")
import RevitServices
from RevitServices.Persistence import DocumentManager
from RevitServices.Transactions import TransactionManager
doc = DocumentManager.Instance.CurrentDBDocument

view = IN[0];
Rooms = IN[1];
Offset = IN[2]/304.8;
detailing = IN[3];
run = IN[4];

result = [];

if isinstance(view,list):
	view = UnwrapElement(view[0]);
else:
	view = UnwrapElement(view);


if not isinstance(Rooms,list):
	Rooms = UnwrapElement([Rooms]);
else:
	Rooms = UnwrapElement(Rooms);
	

def crop_box(bbox, offset):
	minX = bbox.Min.X - offset;
	minY = bbox.Min.Y - offset;
	minZ = bbox.Min.Z - offset;
	maxX = bbox.Max.X + offset;
	maxY = bbox.Max.Y + offset;
	maxZ = bbox.Max.Z + offset;
	
	newbox = BoundingBoxXYZ();
	newbox.Min = XYZ(minX,minY, minZ);
	newbox.Max = XYZ(maxX, maxY, maxZ);
	return newbox;

if run:
	TransactionManager.Instance.EnsureInTransaction(doc);
	for r in Rooms:
		name = r.LookupParameter("Name").AsString()+"_"+r.LookupParameter("Number").AsString();
		if detailing:
			v = view.Duplicate(ViewDuplicateOption.WithDetailing);
		else:
			v = view.Duplicate(ViewDuplicateOption.Duplicate);
		bbox = r.BoundingBox[doc.ActiveView];
		cbox = crop_box(bbox,Offset);
		dupview = doc.GetElement(v);
		dupview.Name = name;
		dupview.CropBox = cbox;
		dupview.CropBoxActive = True;
		dupview.CropBoxVisible = False;
		dupview.Scale = 50;
		result.append(dupview);
	TransactionManager.Instance.TransactionTaskDone();
	OUT = result;
else:
	OUT = "Run Forest Run";
# ----------------------------------------
CeilingViews = Output(python_script)
