# Dynamo custom node ElementFilterByLevel.dyf (Dynamo 1.3.2.2480)
# category: Quasar.Revit.Elements
# Elements filter by given level.

Elements = Input()
Level = Input()
python_script = Python(IN[0]=Elements, IN[1]=Level)
# ---------- python_script.python (33 lines) ----------
# dynamo version - 1.3.0 
# author - mgjean

import clr
clr.AddReference('RevitAPI')
clr.AddReference("RevitServices")
clr.AddReference("RevitNodes")
import RevitServices, Revit, Autodesk
from Autodesk.Revit.DB import *

from RevitServices.Persistence import DocumentManager
from RevitServices.Transactions import TransactionManager

doc = DocumentManager.Instance.CurrentDBDocument

RawElems = IN[0];
if not isinstance(RawElems,list):
	RawElems = UnwrapElement([RawElems]);
else:
	RawElems = UnwrapElement(RawElems);
try:
	# check for unplaced room 
	Elems = [r for r in RawElems if r.Area > 0.0000];
except AttributeError:
	Elems = RawElems;
Out = [];
In = [];
lvlId = UnwrapElement(IN[1]).Id;

[In.append(e) if e.LevelId == lvlId else Out.append(e) for e in Elems];
	
OUT = In,Out;
		
# ----------------------------------------
code_block = CodeBlock(Out=python_script) { Out[0]; Out[1]; }
In = Output(code_block.out0)
Out = Output(code_block.out1)
