# Dynamo custom node FamilyAndRoomByLevel.dyf (Dynamo 1.3.0.875)
# category: Quasar.Revit.Room
# This node return families instances inside each rooms by their associate level.

Run = Input(Run:bool=false)
python_script = Python(IN[0]=Run)
# ---------- python_script.python (36 lines) ----------
# dynamo version 1.3.0 
# author - mgjean 

import clr
clr.AddReference("RevitAPI")
from Autodesk.Revit.DB import *
clr.AddReference("RevitServices")
import RevitServices
from RevitServices.Persistence import DocumentManager
doc = DocumentManager.Instance.CurrentDBDocument

run = IN[0];
if run:
	rooms = FilteredElementCollector(doc).OfCategory(BuiltInCategory.OST_Rooms);
	levels = FilteredElementCollector(doc).OfClass(Level).ToElements();
	familyInstances = FilteredElementCollector(doc).OfClass(FamilyInstance).ToElements();
	result = [];
	final = [];

	for r in rooms:
		sub = [r];
		for fm in familyInstances:
			if r.IsPointInRoom(fm.Location.Point):
				sub.append(fm);
		result.append(sub);

	for lvl in levels:
		newsub = [lvl];
		for res in result:
			if lvl.Id == res[0].LevelId:
				newsub.append(res);
		final.append(newsub);
	
	OUT = final;
else:
	OUT = "Run Forest Run";
# ----------------------------------------
ListElements = Output(python_script)
