# Dynamo custom node NorthSouthBBox.dyf (Dynamo 1.3.2.2480)
# category: Quasar.Temporary.Elevations
# Get North and South Sides of BBox

boundingBox = Input(boundingBox : BoundingBox)
minPoint = BoundingBox.MinPoint(boundingBox)
XAxis = Vector.XAxis()
X = Point.X(minPoint)
maxPoint = BoundingBox.MaxPoint(boundingBox)
X_2 = Point.X(maxPoint)
sub = X - X_2
abs = Math.Abs(sub)
translate = Geometry.Translate(geometry=minPoint, direction=XAxis, distance=abs)
create = List.Create(minPoint, translate)
translate_2 = Geometry.Translate(geometry=maxPoint, direction=XAxis, distance=sub)
create_2 = List.Create(maxPoint, translate_2)
YAxis = Vector.YAxis()
Y = Point.Y(minPoint)
Y_2 = Point.Y(maxPoint)
sub_2 = Y - Y_2
translate_3 = Geometry.Translate(geometry=create_2, direction=YAxis, distance=sub_2)
create_3 = List.Create(create, translate_3)
code_block = CodeBlock { 1; }
flatten = List.Flatten(list=create_3, amt=code_block)
# note: South
transpose = List.Transpose(flatten)
SouthSide = Output(transpose)
abs_2 = Math.Abs(sub_2)
translate_4 = Geometry.Translate(geometry=create, direction=YAxis, distance=abs_2)
create_4 = List.Create(create_2, translate_4)
flatten_2 = List.Flatten(list=create_4, amt=code_block)
# note: North Side
transpose_2 = List.Transpose(flatten_2)
NorthSide = Output(transpose_2)
