# Dynamo custom node LinkLevelGrid.dyf (Dynamo 1.3.2.2480)
# category: Quasar.Revit.RevitLinkDocument
# Hide all levels and grids from link files.

current = Document.Current()
activeView = Document.ActiveView(current)
code_block = CodeBlock { "Quasar_LevelGrid"; }
categories = Categories("Grids")
categories_2 = Categories("Levels")
code_block_2 = CodeBlock(a=categories, b=categories_2) { {a,b}; }
select_rule_type = RuleTypes("NotEndsWith")
code_block_3 = CodeBlock { "quasar"; }
all_elements_of_category = ElementsOfCategory(categories)
all_elements_of_category_2 = ElementsOfCategory(categories_2)
create = List.Create(all_elements_of_category, all_elements_of_category_2)
flatten = Flatten(create)
code_block_4 = CodeBlock { "Family and Type"; }
getParameterValueByName = Element.GetParameterValueByName(element=flatten, parameterName=code_block_4)
name = Element.Name(getParameterValueByName)
contains = String.Contains(str=name, searchFor=code_block_3)
filterByBoolMask = List.FilterByBoolMask(list=getParameterValueByName, mask=contains)
name_2 = Element.Name(filterByBoolMask.out)
code_block_5 = CodeBlock(origin_name=name_2) { origin_name + "_quasar"; }
python_script = Python(IN[0]=filterByBoolMask.out, IN[1]=code_block_5, IN[2]=filterByBoolMask.in)
# ---------- python_script.python (20 lines) ----------
import clr
clr.AddReference('RevitAPI')
clr.AddReference("RevitServices")

from Autodesk.Revit.DB import *
from RevitServices.Persistence import DocumentManager
from RevitServices.Transactions import TransactionManager

doc = DocumentManager.Instance.CurrentDBDocument
items = UnwrapElement(IN[0])
names = IN[1]

TransactionManager.Instance.EnsureInTransaction(doc)
for i,n in zip(items,names):
		i.Name = n
TransactionManager.Instance.TransactionTaskDone();
if items:
	OUT = items;
else:
	OUT = IN[2];
# ----------------------------------------
code_block_6 = CodeBlock(i=python_script) { i[0]; }
code_block_7 = CodeBlock { "Type Name"; }
parameterByName = Parameter.ParameterByName(element=code_block_6, name=code_block_7)
byRuleType = Revit.Filter.FilterRule.ByRuleType(select_rule_type, code_block_3, parameterByName)
byRules = Revit.Filter.ParameterFilterElement.ByRules(code_block, code_block_2, byRuleType)
byProperties = Revit.Filter.OverrideGraphicSettings.ByProperties()
Run = Input(Run:bool=true)
code_block_8 = CodeBlock { false; true; }
if_ = If(test=Run, true=code_block_8.out0, false=code_block_8.out1)
setFilterOverrides = View.SetFilterOverrides(view=activeView, parameterFilter=byRules, overrides=byProperties, hide=if_)
view = Output(setFilterOverrides)
