# Dynamo custom node CloudRender.dyf (Dynamo 1.3.2.2480)
# category: Quasar.Revit.Render
# Do cloud rendering jobs with custom settings.

views = Input()
export_cloud_render_data = ExportDocumentRenderData(views)
upload_cloud_render_data = UploadRenderData(export_cloud_render_data)
name = Element.Name(views)
width = Input()
height = Input()
Rendertype = Input()
Renderquality = Input()
byViewNameWidthHeight = Analyze.Render.CloudRenderingJob.ByViewNameWidthHeight(name, width, height, Rendertype, Renderquality)
EmailMe = Input()
FolderPath = Input()
do_cloud_render = CloudRender(upload_cloud_render_data, byViewNameWidthHeight, EmailMe, FolderPath)
result = Output(do_cloud_render)
