# Dynamo custom node RemoveUnplacedRoom.dyf (Dynamo 1.3.2.2480)
# category: Quasar.Revit.Room
# This node remove all unplaced room in the document.

Rooms = Input()
code_block = CodeBlock { "Area"; }
getParameterValueByName = Element.GetParameterValueByName(element=Rooms, parameterName=code_block)
code_block_2 = CodeBlock { ""; }
ne = getParameterValueByName != code_block_2
filterByBoolMask = List.FilterByBoolMask(list=Rooms, mask=ne)
Rooms_2 = Output(filterByBoolMask.in)  # "Rooms"
