# Dynamo custom node BackgroundColor.dyf (Dynamo 1.3.2.2480)
# category: Quasar.Revit.Document
# Change background color of the document.
# Set = True, Reset = False.

Set_Reset = Input()  # "Set/Reset"
backgroundColor = Python(IN[0]=Set_Reset)
# ---------- backgroundColor.python (30 lines) ----------
# dynamo version - 1.3.0
# author - min.naung@mgjean https://twentytwopaths.wordpress.com/contact/

import clr
clr.AddReference('RevitAPI');
clr.AddReference("RevitAPIUI");
clr.AddReference("RevitServices");

from RevitServices.Persistence import DocumentManager
from Autodesk.Revit.DB import Color
from Autodesk.Revit.UI import ColorSelectionDialog

app = DocumentManager.Instance.CurrentUIApplication.Application

set = IN[0];
try:
	if not set:
		app.BackgroundColor = Color(255,255,255);
		OUT = "Background : Default \nUsername   : %s \nVersion    : %s" %(app.Username,app.VersionName);
	else:
		csd = ColorSelectionDialog();
		ColorSelectionDialog.Show(csd);
		app.BackgroundColor = csd.SelectedColor;
		OUT = "Background : Updated \nUsername   : %s \nVersion    : %s" %(app.Username,app.VersionName);
except:
	import sys;
	sys.path.append(r'C:\Program Files (x86)\IronPython 2.7\Lib');
	from traceback import format_exc;
	OUT = format_exc();
	
# ----------------------------------------
Output = Output(backgroundColor)
