# Dynamo custom node CloseHiddenViews.dyf (Dynamo 1.3.2.2480)
# category: Quasar.Revit.Document
# Close hidden views of current document.

Refresh = Input(Refresh:bool=false)
application = Python(IN[0]=Refresh)
# ---------- application.python (29 lines) ----------
# dynamo-version - 1.3.0
# author - min.naung@mgjean https://twentytwopaths.wordpress.com/contact/


import clr
clr.AddReference('RevitAPI');
clr.AddReference("RevitServices");

from RevitServices.Persistence import DocumentManager
from Autodesk.Revit.DB import *

refresh = IN[0];
if not refresh:
	doc = DocumentManager.Instance.CurrentDBDocument;
	uiapp = DocumentManager.Instance.CurrentUIApplication;
	opens = 0;
	
	for j in uiapp.ActiveUIDocument.GetOpenUIViews():
		if not j.ViewId == doc.ActiveView.Id:
			opens += 1;
			j.Close();
	
	if opens>1:
		OUT = "%s hidden views was closed!" % opens;
	else:
		OUT = "No hidden view.";
		
else:
	OUT = "Refreshed!";
# ----------------------------------------
Message = Output(application)
