# Dynamo custom node ElevationsInRooms.dyf (Dynamo 1.3.2.2480)
# category: Quasar.Revit.Elevations
# Create elevations views in rooms by given floor plan.

Run = Input(Run:bool=false)
Rooms = Input()
join = List.Join()  # unwired: arg0, arg1
code_block = CodeBlock(x=Rooms) { Flatten(x); }
python_script = Python(IN[0]=code_block)
# ---------- python_script.python (34 lines) ----------
import clr
clr.AddReference('RevitAPI')
clr.AddReference("RevitServices")
clr.AddReference("RevitNodes")


import Autodesk,RevitServices,Revit
clr.ImportExtensions(Revit.Elements)
clr.ImportExtensions(Revit.GeometryConversion)

from Autodesk.Revit.DB import *
from RevitServices.Persistence import DocumentManager
from RevitServices.Transactions import TransactionManager

doc = DocumentManager.Instance.CurrentDBDocument

rooms = IN[0];

if not isinstance(rooms,list):
	rooms = UnwrapElement([rooms]);
else:
	rooms = UnwrapElement(rooms);
	
minpoints = [];
maxpoints = [];
bboxes = [];

for room in rooms:
	bbox = room.BoundingBox[doc.ActiveView]
	bboxes.append(bbox.ToProtoType(True));
OUT =bboxes


	
# ----------------------------------------
minPoint = BoundingBox.MinPoint(python_script)
Offset = Input()
code_block_2 = CodeBlock(x=Offset) { x/2; -x; -x/2; }
translate = Geometry.Translate(geometry=minPoint, xTranslation=code_block_2.out1, yTranslation=code_block_2.out1, zTranslation=code_block_2.out2)
maxPoint = BoundingBox.MaxPoint(python_script)
translate_2 = Geometry.Translate(geometry=maxPoint, xTranslation=Offset, yTranslation=Offset, zTranslation=code_block_2.out0)
byCorners = BoundingBox.ByCorners(min=translate, max=translate_2)
minPoint_2 = BoundingBox.MinPoint(byCorners)
XAxis = Vector.XAxis()
X = Point.X(minPoint_2)
maxPoint_2 = BoundingBox.MaxPoint(byCorners)
X_2 = Point.X(maxPoint_2)
sub = X - X_2
abs = Math.Abs(sub)
translate_3 = Geometry.Translate(geometry=minPoint_2, direction=XAxis, distance=abs)
create = List.Create(minPoint_2, translate_3)
translate_4 = Geometry.Translate(geometry=maxPoint_2, direction=XAxis, distance=sub)
create_2 = List.Create(maxPoint_2, translate_4)
YAxis = Vector.YAxis()
Y = Point.Y(minPoint_2)
Y_2 = Point.Y(maxPoint_2)
sub_2 = Y - Y_2
code_block_3 = CodeBlock(i=sub_2) { {i}; }
translate_5 = Geometry.Translate(geometry=create_2, direction=YAxis, distance=code_block_3, lacing=Longest)
create_3 = List.Create(create, translate_5)
code_block_4 = CodeBlock { 1; }
flatten = List.Flatten(list=create_3, amt=code_block_4)
# note: South
transpose = List.Transpose(flatten)
code_block_5 = CodeBlock { {0,3}; {1,2}; }
getItemAtIndex = List.GetItemAtIndex(index=code_block_5.out0)  # unwired: list
map = List.Map(list=transpose, f_x=getItemAtIndex)
abs_2 = Math.Abs(sub_2, lacing=Longest)
code_block_6 = CodeBlock(i=abs_2) { {i}; }
translate_6 = Geometry.Translate(geometry=create, direction=YAxis, distance=code_block_6, lacing=Longest)
create_4 = List.Create(create_2, translate_6)
flatten_2 = List.Flatten(list=create_4, amt=code_block_4)
# note: North Side
transpose_2 = List.Transpose(flatten_2)
getItemAtIndex_2 = List.GetItemAtIndex(index=code_block_5.out1)  # unwired: list
map_2 = List.Map(list=transpose_2, f_x=getItemAtIndex_2)
# note: West
combine = List.Combine(join, map, map_2)
boolean = BoolSelector(true)
byPoints = PolyCurve.ByPoints(points=combine, connectLastToFirst=boolean)
curves = PolyCurve.Curves(byPoints)
byPoints_2 = PolyCurve.ByPoints(points=transpose_2, connectLastToFirst=boolean)
curves_2 = PolyCurve.Curves(byPoints_2)
join_2 = List.Join()  # unwired: arg0, arg1
getItemAtIndex_3 = List.GetItemAtIndex(index=code_block_5.out1)  # unwired: list
map_3 = List.Map(list=transpose, f_x=getItemAtIndex_3)
getItemAtIndex_4 = List.GetItemAtIndex(index=code_block_5.out0)  # unwired: list
map_4 = List.Map(list=transpose_2, f_x=getItemAtIndex_4)
# note: East
combine_2 = List.Combine(join_2, map_3, map_4)
byPoints_3 = PolyCurve.ByPoints(points=combine_2, connectLastToFirst=boolean)
curves_3 = PolyCurve.Curves(byPoints_3)
# note: North
byPoints_4 = PolyCurve.ByPoints(points=transpose, connectLastToFirst=boolean)
curves_4 = PolyCurve.Curves(byPoints_4)
floorPlanView = Input()
# note: IN[0] = Run [Boolean];
# IN[1] = Rooms
# IN[2] = West Curves
# IN[3] = North Curves
# IN[4] = East Curves
# IN[5] = South Curves
# IN[6] = FloorPlanView
python_script_2 = Python(IN[0]=Run, IN[1]=Rooms, IN[2]=curves, IN[3]=curves_2, IN[4]=curves_3, IN[5]=curves_4, IN[6]=floorPlanView)
# ---------- python_script_2.python (99 lines) ----------
#dynamo version - 1.3.0
#author - min.naung@mgjean https://twentytwopaths.wordpress.com/contact/


import clr
clr.AddReference('RevitAPI')
clr.AddReference("RevitServices")
clr.AddReference("RevitNodes")
import RevitServices
import Revit
import Autodesk
from Autodesk.Revit.DB import *
from math import *

clr.ImportExtensions(Revit.GeometryConversion)

from RevitServices.Persistence import DocumentManager
from RevitServices.Transactions import TransactionManager

doc = DocumentManager.Instance.CurrentDBDocument

toggle = IN[0];
Rooms = IN[1];
if not isinstance(Rooms,list):
	Rooms = UnwrapElement([Rooms]);
else:
	Rooms = UnwrapElement(Rooms);
west = UnwrapElement(IN[2]);
north= UnwrapElement(IN[3]);
east = UnwrapElement(IN[4]);
south = UnwrapElement(IN[5]);
viewplan = UnwrapElement(IN[6]);

collector = FilteredElementCollector(doc).OfClass(ViewFamilyType).ToElements()
viewType = [i for i in collector if i.ViewFamily == ViewFamily.Elevation][0];
lst = []

def curve_loop(curves):
	cropLines = curves;
	newCurveLoop = [];
	newCurveLoop.Add(cropLines[0].ToRevitType())
	newCurveLoop.Add(cropLines[1].ToRevitType())
	newCurveLoop.Add(cropLines[2].ToRevitType())
	newCurveLoop.Add(cropLines[3].ToRevitType())
	loops = CurveLoop.Create(newCurveLoop);
	return loops;
	
if toggle == True:
	
	TransactionManager.Instance.EnsureInTransaction(doc)
	
	for ind, room in enumerate(Rooms):				
		elevationPT = room.Location.Point;
		nameNumber = room.get_Parameter(BuiltInParameter.ROOM_NAME).AsString() + "_" + room.get_Parameter(BuiltInParameter.ROOM_NUMBER).AsString();

		#Create elevation marker and elevation in position.
		eleMarker = ElevationMarker.CreateElevationMarker(doc, viewType.Id, elevationPT, 50);
		
		#Create elevation for each sides.
		eleZero = eleMarker.CreateElevation(doc, viewplan.Id , 0);
		eleZero.Name = nameNumber +" - "+"a";
		eleOne = eleMarker.CreateElevation(doc,viewplan.Id, 1);
		eleOne.Name = nameNumber +" - "+"b";
		eleTwo = eleMarker.CreateElevation(doc,viewplan.Id, 2);
		eleTwo.Name = nameNumber+" - " +"c";
		eleThree = eleMarker.CreateElevation(doc,viewplan.Id, 3);
		eleThree.Name = nameNumber+" - " +"d";
		
		#Get crop region shape manager
		crManZero = eleZero.GetCropRegionShapeManager();
		crManOne = eleOne.GetCropRegionShapeManager();
		crManTwo = eleTwo.GetCropRegionShapeManager();
		crManThree = eleThree.GetCropRegionShapeManager();
		
		#Create curve loop		
		zero = curve_loop(west[ind]);
		one = curve_loop(north[ind]);
		two = curve_loop(east[ind]);
		three = curve_loop(south[ind]);
		
		try:
			#Apply curve loop to crop shape		
			crManZero.SetCropShape(zero);
			crManOne.SetCropShape(one);
			crManTwo.SetCropShape(two);
			crManThree.SetCropShape(three);
			
			lst.append([eleZero,eleOne,eleTwo,eleThree]);
		
		except:
			pass

	TransactionManager.Instance.TransactionTaskDone();
	
	OUT = lst;
	
else:

	OUT = "Run Forest Run";
# ----------------------------------------
Elevation = Output(python_script_2)
