# Dynamo custom node FamilyInstanceByFamilyTypeName.dyf (Dynamo 1.3.2.2480)
# category: Quasar.Revit.FamilyInstance
# This node take single family type name or comma separated family type names as a string. Name must be exactly the same with family type name. And it return list of family instances.

FamilyTypeName = Input(FamilyTypeName:string)
python_script = Python(IN[0]=FamilyTypeName)
# ---------- python_script.python (20 lines) ----------
# dynamo version 1.3.0 
# author - min.naung@mgjean https://twentytwopaths.wordpress.com/contact/

import clr
clr.AddReference("RevitAPI")
clr.AddReference("RevitServices")
from Autodesk.Revit.DB import *
from RevitServices.Persistence import DocumentManager
doc = DocumentManager.Instance.CurrentDBDocument

result = [];
names = IN[0].strip().split(',');
instances = FilteredElementCollector(doc).OfClass(FamilyInstance).ToElements();
for n in names:
	sub = [];
	for i in instances:
		if i.Name == n:
			 sub.append(i);
	result.append(sub);
OUT = result;
# ----------------------------------------
FamilyInstance = Output(python_script)
