# Dynamo custom node FilterElementByFillPatternCategory.dyf (Dynamo 1.3.2.2480)
# category: Quasar.Revit.FilterElement
# Create filter element with override graphics by color, fill pattern, category and name.

FillPattern = Input(FillPattern:FillPatternElement)
Category = Input()
FilterName = Input()
# note: IN[0] = Fill Pattern
# IN[1] = Category
# IN[2] = Name
python_script = Python(IN[0]=FillPattern, IN[1]=Category, IN[2]=FilterName)
# ---------- python_script.python (45 lines) ----------
# dynamo version - 1.3.0
# author - min.naung@mgjean https://twentytwopaths.wordpress.com/contact/

import clr
clr.AddReference('RevitAPI')
clr.AddReference("RevitServices")
clr.AddReference("RevitAPIUI")

import System

from System.Collections.Generic import List
from Autodesk.Revit.DB import *
from Autodesk.Revit.UI import *
from RevitServices.Persistence import DocumentManager
from RevitServices.Transactions import TransactionManager

doc = DocumentManager.Instance.CurrentDBDocument

fp = UnwrapElement(IN[0]);
category = UnwrapElement(IN[1]);
fname = IN[2];
try:
	view = doc.ActiveView;
	TransactionManager.Instance.EnsureInTransaction(doc);
	params_filter = ParameterFilterElement.Create(doc,fname,List[ElementId]([category.Id]));

	win = ColorSelectionDialog();
	ColorSelectionDialog.Show(win);
	color = win.SelectedColor;

	ogset = OverrideGraphicSettings();
	ogset.SetProjectionFillColor(color);
	ogset.SetProjectionFillPatternId(fp.Id);
	ogset.SetCutFillColor(color);
	ogset.SetCutFillPatternId(fp.Id);

	view.SetFilterOverrides(params_filter.Id,ogset);

	TransactionManager.Instance.TransactionTaskDone();
	OUT = [view,params_filter];
except:
	from sys import path as p
	p.append(r"C:\Program Files (x86)\IronPython 2.7\Lib");
	from traceback import format_exc
	OUT = format_exc();
# ----------------------------------------
Element = Output(python_script)
