# Dynamo custom node Floor.ByRoomNameTypeLevel.dyf (Dynamo 1.3.2.2480)
# category: Quasar.Revit.Floor
# Create floor(s) by single name or comma separated room names in a given level.

RoomNames = Input(RoomNames:string)
level = Input(level:Level)
python_script = Python(IN[0]=RoomNames, IN[1]=level)
# ---------- python_script.python (39 lines) ----------
# dynamo version - 1.3.0
# author - min.naung@mgjean https://twentytwopaths.wordpress.com/contact/


import clr
clr.AddReference("RevitAPI");
clr.AddReference("RevitServices");
clr.AddReference("RevitNodes");
import Autodesk, RevitServices, Revit
clr.ImportExtensions(Revit.Elements);
clr.ImportExtensions(Revit.GeometryConversion);

import clr
clr.AddReference('ProtoGeometry')
from Autodesk.DesignScript.Geometry import *

from Autodesk.Revit.DB import *
from RevitServices.Persistence import DocumentManager
from RevitServices.Transactions import TransactionManager

doc = DocumentManager.Instance.CurrentDBDocument;


names = IN[0].split(',');
level = UnwrapElement(IN[1]);
collector = FilteredElementCollector(doc).OfCategory(BuiltInCategory.OST_Rooms);
rooms = [i for i in collector if i.LevelId == level.Id and i.LookupParameter("Name").AsString() in names];
result = [];

for room in rooms:
	opts = SpatialElementBoundaryOptions();
	opts.SpatialElementBoundaryLocation = SpatialElementBoundaryLocation.Finish;
	crvs = [];
	for seg in room.GetBoundarySegments(opts)[0]:
		crv = seg.GetCurve();
		crvs.append(Revit.GeometryConversion.RevitToProtoCurve.ToProtoType( crv, True ));

	result.append([room.LookupParameter("Name").AsString(),crvs])
OUT = result;
# ----------------------------------------
code_block = CodeBlock { 1; }
getItemAtIndex = List.GetItemAtIndex(index=code_block)  # unwired: list
map = List.Map(list=python_script, f_x=getItemAtIndex)
floorType = Input(floorType : FloorType)
byOutlineTypeAndLevel = Floor.ByOutlineTypeAndLevel(outlineCurves=map, floorType=floorType, level=level)
Floor = Output(byOutlineTypeAndLevel)
