# Dynamo custom node GetBuiltInParameterName.dyf (Dynamo 1.3.2.2480)
# category: Quasar.Revit.BuiltInParameter
# Get BuiltIn Parameter names by parameter names and element.

Element = Input()
ParameterNames = Input(ParameterNames:string)
# note: IN[0] = element
# IN[1] = parameter names
python_script = Python(IN[0]=Element, IN[1]=ParameterNames)
# ---------- python_script.python (23 lines) ----------
# dynamo version - 1.3.0
# author - min.naung@mgjean https://twentytwopaths.wordpress.com/contact/

import clr
clr.AddReference("RevitAPI")

import System
from Autodesk.Revit.DB import *

elements = UnwrapElement(IN[0]);
params = IN[1];
if not isinstance(params,list):
	params = [params];
	
bIns = [i for i in System.Enum.GetValues(BuiltInParameter)];

associate = [];
for i in set(bIns):
	for p in params:
		if elements.get_Parameter(i) and elements.get_Parameter(i).Definition.Name == p:
			associate.extend([p,i])

OUT = associate;
# ----------------------------------------
NameList = Output(python_script)
