# Dynamo custom node GetElementsFromLinkDocs.dyf (Dynamo 1.3.2.2480)
# category: Quasar.Revit.RevitLinkDocument
# Collect elements by category from a link document.

Category = Input()
LinkDocs = Input()
python_script = Python(IN[0]=Category, IN[1]=LinkDocs)
# ---------- python_script.python (15 lines) ----------
# dynamo version - 1.3.0
# author - min.naung@mgjean https://twentytwopaths.wordpress.com/contact/

import clr
clr.AddReference("RevitAPI")

import System
from Autodesk.Revit.DB import *
cat = IN[0];

obj = System.Enum.ToObject(BuiltInCategory, cat.Id);
filter = ElementCategoryFilter(obj);
collector = FilteredElementCollector(IN[1]).WherePasses(filter).WhereElementIsNotElementType().ToElements();

OUT = collector;
# ----------------------------------------
Elements = Output(python_script)
