# Dynamo custom node HideUnhideElementsInViews.dyf (Dynamo 1.3.2.2480)
# category: Quasar.Revit.Visibility
# Element(s) hide / unhide in given views.
# True hide elements, False unhide elements.
# Default is True.

Elements = Input()
Views = Input()
HideUnhide = Input(HideUnhide:bool=true)
# note: IN[0] = Elements;
# IN[1] = Views;
# IN[2] = Hide/UnHide
python_script = Python(IN[0]=Elements, IN[1]=Views, IN[2]=HideUnhide)
# ---------- python_script.python (50 lines) ----------
# dynamo version - 1.3.0
# author - min.naung@mgjean https://twentytwopaths.wordpress.com/contact/

import clr
clr.AddReference("RevitAPI")
clr.AddReference("RevitNodes")
clr.AddReference("RevitServices")
clr.AddReference("System")

import Autodesk, Revit, RevitServices

from System.Collections.Generic import List
from Autodesk.Revit.DB import *
from RevitServices.Persistence import DocumentManager
from RevitServices.Transactions import TransactionManager

doc = DocumentManager.Instance.CurrentDBDocument;
message = ''; melem = ''; mview = '';
def lst_unwrap(elems):
	if not isinstance(elems,list):
		elems = UnwrapElement([elems]);
	else:
		elems = UnwrapElement(elems);
	return elems

lstElemToHide = lst_unwrap(IN[0]);
lstView = lst_unwrap(IN[1]);
toggle = IN[2];
lst = [i.Id for i in lstElemToHide];
lstElemId = List[ElementId](lst); 

TransactionManager.Instance.EnsureInTransaction(doc);

for v in lstView:
	if toggle:
		h = "hide"
		v.HideElements(lstElemId);
	else:
		h = "unhide";
		v.UnhideElements(lstElemId);
	
	if (len(lstElemToHide)>1): melem = "elements"
	else: melem = "element"
	
	if (len(lstView)>1): mview = "views"
	else: mview = "view"
	
TransactionManager.Instance.TransactionTaskDone();
message = "%s %s %s in %s %s." %(len(lstElemToHide),melem,h,len(lstView),mview);
OUT = message;
# ----------------------------------------
Message = Output(python_script)
