# Dynamo custom node LinkLevelGrid.dyf (Dynamo 1.3.2.2480)
# category: Quasar.Revit.RevitLinkDocument
# Hide levels and grids from link documents.

Hide = Input(Hide: bool=true)  # True = Hide, False = Unhide
python_script = Python(IN[0]=Hide)
# ---------- python_script.python (70 lines) ----------
# dynamo version - 1.3.2
# author - min.naung https://twentytwopaths.wordpress.com/contact/

import clr
clr.AddReference("RevitAPI")
clr.AddReference("RevitServices")
import System

from System.Collections.Generic import List
from Autodesk.Revit.DB import *
from RevitServices.Persistence import DocumentManager
from RevitServices.Transactions import TransactionManager

doc = DocumentManager.Instance.CurrentDBDocument

trans = TransactionManager.Instance.EnsureInTransaction(doc);

active_view = doc.ActiveView
ifilter = "LinkLevelGrid_QuasarPackage"
found = False

hide = False if IN[0] else True

allFilters = FilteredElementCollector(doc).OfClass(FilterElement).ToElements()


viewFilters = active_view.GetFilters();
viewFiltersName = [doc.GetElement(i).Name.ToString() for i in viewFilters]

for fter in allFilters:
	if ifilter == fter.Name.ToString() and ifilter not in viewFiltersName:
		active_view.AddFilter(fter.Id)
		active_view.SetFilterVisibility(fter.Id, hide);
		found = True
	
	if ifilter == fter.Name.ToString() and ifilter in viewFiltersName:
		active_view.SetFilterVisibility(fter.Id, hide);
		found = True
		

if not found:
	grids = FilteredElementCollector(doc).OfClass(Grid).ToElements()
	levels = FilteredElementCollector(doc).OfClass(Level).ToElements()

	CateIds = List[ElementId]([grids[0].Category.Id,levels[0].Category.Id])

	gridTypeIds = set([i.GetTypeId() for i in grids])
	levelTypeIds = set([i.GetTypeId() for i in levels])

	type_elems = [doc.GetElement(i) for i in gridTypeIds]
	type_elems.extend([doc.GetElement(l) for l in levelTypeIds])

	for elem in type_elems:
		if not "_quasar" in elem.LookupParameter("Type Name").AsString():
			elem.Name = elem.LookupParameter("Type Name").AsString() + "_quasar";

	type_names = [i.LookupParameter("Type Name").AsString() for i in type_elems]

	paramId = type_elems[0].LookupParameter("Type Name").Id

	notendswith = ParameterFilterRuleFactory.CreateNotEndsWithRule(paramId,"_quasar",False)

	paramFilterElem = ParameterFilterElement.Create(doc, ifilter,CateIds,[notendswith])
	active_view.SetFilterOverrides(paramFilterElem.Id, OverrideGraphicSettings())
	active_view.SetFilterVisibility(paramFilterElem.Id, hide)
	
	
TransactionManager.Instance.TransactionTaskDone()
	
OUT = "DONE!"
# ----------------------------------------
OUT = Output(python_script)
