# Dynamo custom node OverrideProjectionCutPattern.dyf (Dynamo 1.3.2.2480)
# category: Quasar.Revit.Graphics
# Select element and override fill pattern and color in current view.

FillPattern = Input(FillPattern:FillPatternElement)
Refresh = Input(Refresh:bool=false)
python_script = Python(IN[0]=FillPattern, IN[1]=Refresh)
# ---------- python_script.python (47 lines) ----------
# dynamo version - 1.3.0
# author - min.naung@mgjean https://twentytwopaths.wordpress.com/contact/

import clr
clr.AddReference('RevitAPI')
clr.AddReference("RevitAPIUI");
clr.AddReference("RevitServices");
from Autodesk.Revit.DB import *
from Autodesk.Revit.UI import *
from RevitServices.Persistence import DocumentManager
from RevitServices.Transactions import TransactionManager

fp = UnwrapElement(IN[0]);
refresh = IN[1];

if not refresh:
	doc = DocumentManager.Instance.CurrentDBDocument;
	uidoc = DocumentManager.Instance.CurrentUIApplication.ActiveUIDocument

	ids= uidoc.Selection.GetElementIds();

	if ids:
		win = ColorSelectionDialog();
		ColorSelectionDialog.Show(win);
		color = win.SelectedColor;

		ogset = OverrideGraphicSettings();
		ogset.SetProjectionFillColor(color);
		ogset.SetProjectionFillPatternId(fp.Id);
		#ogset.SetProjectionLineColor(color);
		ogset.SetCutFillColor(color);
		ogset.SetCutFillPatternId(fp.Id);
		#ogset.SetCutLineColor(color);

		TransactionManager.Instance.EnsureInTransaction(doc);
		
		for i in ids:
			doc.ActiveView.SetElementOverrides(i,ogset);
		
		TransactionManager.Instance.TransactionTaskDone();

		OUT = [doc.GetElement(id) for id in ids]

	else:
		OUT = "Please Select Model Element(s).";
else:
	OUT = "Refreshed!"
# ----------------------------------------
Elements = Output(python_script)
