# Dynamo custom node PlanViewCropByRoom.dyf (Dynamo 1.3.2.2480)
# category: Quasar.Revit.Views
# Crop floor or ceiling plan views by given room. Offset is a distance of crop box from room boundary and unit is millimeter. View scale is 1:50 by default.

Views = Input()
Rooms = Input()
Offset = Input(Offset:double=500)
Run = Input(Run:bool=false)
python_script = Python(IN[0]=Views, IN[1]=Rooms, IN[2]=Offset, IN[3]=Run)
# ---------- python_script.python (60 lines) ----------
# dynamo version - 1.3.0
# author - min.naung@mgjean https://twentytwopaths.wordpress.com/contact/

import clr
clr.AddReference("RevitNodes")
import Revit
clr.ImportExtensions(Revit.Elements)
clr.AddReference("RevitServices")
import RevitServices
from RevitServices.Persistence import DocumentManager
from RevitServices.Transactions import TransactionManager
clr.AddReference("RevitAPI")
import Autodesk
from Autodesk.Revit.DB import *

doc = DocumentManager.Instance.CurrentDBDocument


Views = IN[0];
Offset = IN[2]/304.8;
Rooms = IN[1];
run = IN[3];
result = [];

if not isinstance(Views,list):
	Views = UnwrapElement([Views]);
else:
	Views = UnwrapElement(Views);

if not isinstance(Rooms,list):
	Rooms = UnwrapElement([Rooms]);
else:
	Rooms = UnwrapElement(Rooms);
	

def crop_box(bbox, offset):
	minX = bbox.Min.X - offset;
	minY = bbox.Min.Y - offset;
	minZ = bbox.Min.Z - offset;
	maxX = bbox.Max.X + offset;
	maxY = bbox.Max.Y + offset;
	maxZ = bbox.Max.Z + offset;
	
	newbox = BoundingBoxXYZ();
	newbox.Min = XYZ(minX,minY, minZ);
	newbox.Max = XYZ(maxX, maxY, maxZ);
	return newbox;

if run:
	TransactionManager.Instance.EnsureInTransaction(doc);
	for r,v in zip(Rooms,Views):
		v.CropBox = crop_box(r.BoundingBox[doc.ActiveView],Offset);
		v.CropBoxActive = True;
		v.CropBoxVisible = False;
		v.Scale = 50;
		result.append(v);
	TransactionManager.Instance.TransactionTaskDone();
	OUT = result;
else:
	OUT = "Run Forest Run";
# ----------------------------------------
Views_2 = Output(python_script)  # "Views"
