# Dynamo custom node SpaceLimitBaseOffsetByRoom.dyf (Dynamo 1.3.0.875)
# category: Quasar.Revit.Space
# Adjust space limit-offset and base-offset value  base on associate room values. Plus or minus offset are allowed. Default value is 0. Unit is millimeter.

LimitOffset = Input(LimitOffset:double=0)
BaseOffset = Input(BaseOffset:double=0)
Run = Input(Run:bool=false)
python_script = Python(IN[0]=LimitOffset, IN[1]=BaseOffset, IN[2]=Run)
# ---------- python_script.python (34 lines) ----------
# dynamo version 1.3.0 
# author - min.naung@mgjean 

import clr
clr.AddReference("RevitAPI")
from Autodesk.Revit.DB import *
clr.AddReference("RevitServices")
import RevitServices
from RevitServices.Persistence import DocumentManager
from RevitServices.Transactions import TransactionManager
doc = DocumentManager.Instance.CurrentDBDocument

rooms = FilteredElementCollector(doc).OfCategory(BuiltInCategory.OST_Rooms);
spaces = FilteredElementCollector(doc).OfCategory(BuiltInCategory.OST_MEPSpaces);
result = [];
limit = IN[0]/304.8;
base = IN[1]/304.8;
run = IN[2];

if run:
	TransactionManager.Instance.EnsureInTransaction(doc);
	
	for i in rooms:
		for j in spaces:
			if (i.IsPointInRoom(j.Location.Point)):
				j.LimitOffset = i.LimitOffset + limit;
				j.BaseOffset = i.BaseOffset + base;
				result.append([i,j]);				
	
	TransactionManager.Instance.TransactionTaskDone();
	
	OUT=result;
else:
	OUT="Run Forest Run";
# ----------------------------------------
ListElement = Output(python_script)
