# Dynamo custom node SpaceNameNumberByRoom.dyf (Dynamo 1.3.2.2480)
# category: Quasar.Revit.Space
# Write spaces names and numbers value from their associate rooms.

Names = Input(Names:bool=false)
Numbers = Input(Numbers:bool=false)
python_script = Python(IN[0]=Names, IN[1]=Numbers)
# ---------- python_script.python (41 lines) ----------
# dynamo version 1.3.0 
# author - min.naung@mgjean https://twentytwopaths.wordpress.com/contact/

import clr
clr.AddReference("RevitAPI")
from Autodesk.Revit.DB import *
clr.AddReference("RevitServices")
import RevitServices
from RevitServices.Persistence import DocumentManager
from RevitServices.Transactions import TransactionManager
doc = DocumentManager.Instance.CurrentDBDocument

rooms = FilteredElementCollector(doc).OfCategory(BuiltInCategory.OST_Rooms);
spaces = FilteredElementCollector(doc).OfCategory(BuiltInCategory.OST_MEPSpaces);
result = [];
name = IN[0];
number = IN[1];


TransactionManager.Instance.EnsureInTransaction(doc);

if name:
	for i in rooms:
		for j in spaces:
			if (i.IsPointInRoom(j.Location.Point)):		
				j.Name = i.LookupParameter("Name").AsString();
				result.append([i,j]);
				
if number:
	for i in rooms:
		for j in spaces:
			if (i.IsPointInRoom(j.Location.Point)):		
				j.Number = i.Number;
				if not name:
					result.append([i,j]);
					
TransactionManager.Instance.TransactionTaskDone();
if result:
	OUT=result;
else:
	OUT="Run Forest Run";
# ----------------------------------------
ListElement = Output(python_script)
