# Dynamo custom node ViewDuplicate.dyf (Dynamo 1.3.2.2480)
# category: Quasar.Revit.Views
# Duplicate views with given names.

View = Input()
Names = Input()
Detailing = Input(Detailing:bool=false)
python_script = Python(IN[0]=View, IN[1]=Names, IN[2]=Detailing)
# ---------- python_script.python (39 lines) ----------
# dynamo version - 1.3.0
# author - min.naung@mgjean https://twentytwopaths.wordpress.com/contact/

import clr
clr.AddReference("RevitAPI")
from Autodesk.Revit.DB import *
clr.AddReference("RevitServices")
import RevitServices
from RevitServices.Persistence import DocumentManager
from RevitServices.Transactions import TransactionManager
doc = DocumentManager.Instance.CurrentDBDocument

views = IN[0];
names = IN[1];
detailing = IN[2];
res = [];

if not isinstance(views,list):
	views = UnwrapElement([views]);
else:
	views = UnwrapElement(views);

if not isinstance(names,list):
	names = [names];

TransactionManager.Instance.EnsureInTransaction(doc);
for i,n in zip(views,names):
	if detailing:
		v = i.Duplicate(ViewDuplicateOption.WithDetailing);
	else:
		v = i.Duplicate(ViewDuplicateOption.Duplicate);
	dupview = doc.GetElement(v);
	dupview.Name = n;
	dupview.Scale = 25;
	dupview.CropBoxActive = True;
	dupview.CropBoxVisible = False;
	res.append(dupview);
TransactionManager.Instance.TransactionTaskDone();
OUT = res;
# ----------------------------------------
Views = Output(python_script)
