# Dynamo custom node Wall.InteriorFaces.dyf (Dynamo 1.3.0.875)
# category: Quasar.Revit.Wall
# This node return interior wall faces of given rooms.

code_block = CodeBlock()
# ---------- code_block.designscript (16 lines) ----------
def wallInFaces(rm,wll){

 sld = Autodesk.Solid.ByUnion(Flatten(rm.Geometry()));
 bbox = Autodesk.BoundingBox.ByGeometry(sld);
 minpt = bbox.MinPoint;
 vec = Vector.ZAxis();
 pln = Plane.ByOriginNormal(minpt,vec);
 fcs = wll.Faces;
 slds = Autodesk.Solid.ByJoinedSurfaces(fcs);
 bboxx = Autodesk.BoundingBox.ByGeometry(slds);
 maxpt = bboxx.MaxPoint.Z;
 srf = pln.Intersect(sld).Translate(vec,0.001);
 pls = PolyCurve.ByJoinedCurves(srf.PerimeterCurves());
 sldss = Autodesk.Solid.ByUnion(pls.ExtrudeAsSolid(vec,maxpt));
 return = sldss;
};
# ----------------------------------------
Rooms = Input()
categories = Categories("Walls")
all_elements_of_category = ElementsOfCategory(categories)
Level = Input()
elementFilterByLevel = Custom[ElementFilterByLevel](Elements=all_elements_of_category, Level=Level)  # Elements filter by given level.
code_block_2 = CodeBlock(r=Rooms, w=elementFilterByLevel.In) { wallInFaces(r,w); }
faces = Element.Faces(elementFilterByLevel.In)
code_block_3 = CodeBlock(sldss=code_block_2, fcs=faces) { fcss = RemoveIfNot(Flatten(sldss.Intersect(fcs)),"Surface"); }
create = List.Create(Rooms, code_block_3)
Faces = Output(create)
code_block_4 = CodeBlock { "Thanks to Dynamo User: ORGANON"; }
