# Dynamo custom node SelectElementByParameter.dyf (Dynamo 1.3.2.2480)
# category: Quasar.RevitNodes
# Elements selection by given parameter name and value.
# Numeric Operator - ">" , "<" , ">=" , "<=" , "="
# String Operator - "begins with" , "contains" , "ends with" , "equals"

Elements = Input()  # Elements input
ParameterName = Input()  # Parameter name string
Operator = Input()  # Numeric Operators - ">","<",">=","<=","=" String Operators - "begins with","contains","ends with", "equals"
ParameterValue = Input()  # Parameter value (string or double)
python_script = Python(IN[0]=Elements, IN[1]=ParameterName, IN[2]=Operator, IN[3]=ParameterValue)
# ---------- python_script.python (53 lines) ----------
# dynamo version - 1.3.0
# author - min.naung@mgjean https://twentytwopaths.wordpress.com/contact/


import clr
clr.AddReference("RevitServices");
clr.AddReference("RevitAPI");
import System
from System.Collections.Generic import List
from Autodesk.Revit.DB import *
from RevitServices.Persistence import DocumentManager
from RevitServices.Transactions import TransactionManager

doc = DocumentManager.Instance.CurrentDBDocument
uidoc = DocumentManager.Instance.CurrentUIApplication.ActiveUIDocument

DictNumericRules = {">":FilterNumericGreater(),"<":FilterNumericLess(),">=":FilterNumericGreaterOrEqual(),"<=":FilterNumericLessOrEqual(),"=":FilterNumericEquals()}
DictStringRules = {"begins with":FilterStringBeginsWith(),"contains":FilterStringContains(),"ends with":FilterStringEndsWith(),"equals":FilterStringEquals()}

selected = uidoc.Selection
prelist = [];
highlight = [];
elems = UnwrapElement(IN[0]);
name = IN[1];

builtInParams = [i for i in System.Enum.GetValues(BuiltInParameter)];
bparamName = [i for i in builtInParams if elems[0].get_Parameter(i) and elems[0].get_Parameter(i).Definition.Name == name][0];

bipname = eval("BuiltInParameter."+str(bparamName));

pvp = ParameterValueProvider(ElementId(bipname));

if isinstance(IN[3],int):
	val = IN[3]/304.8;
	eval_rule = DictNumericRules[IN[2]];
	rule = FilterDoubleRule(pvp,eval_rule,val,1E-6);
else:
	val = IN[3];
	eval_rule = DictStringRules[IN[2]];
	rule = FilterStringRule(pvp,eval_rule,val,False);

filter = ElementParameterFilter(rule);

for i in elems:
	prelist.append(i.Id);
	Icollection = List[ElementId](prelist);
	
elements = FilteredElementCollector(doc,Icollection).WherePasses(filter).ToElements();
for i in elements:
	highlight.append(i.Id);
	icoll = List[ElementId](highlight);
	selected.SetElementIds(icoll);
OUT = elements;
# ----------------------------------------
Elements_2 = Output(python_script)  # "Elements"
