# Dynamo custom node WallPaintRemove.dyf (Dynamo 1.3.2.2480)
# category: Quasar.RevitNodes
# Remove paint from input walls

Walls = Input()  # Wall elements
python_script = Python(IN[0]=Walls)
# ---------- python_script.python (32 lines) ----------
# dynamo version - 1.3.2
# author - min.naung/mgjean @https://twentytwo.space/contact

import clr
clr.AddReference("RevitAPI")
clr.AddReference("RevitServices")

from Autodesk.Revit.DB import *
from RevitServices.Transactions import TransactionManager
from RevitServices.Persistence import DocumentManager

doc = DocumentManager.Instance.CurrentDBDocument;
TransactionManager.Instance.EnsureInTransaction(doc);

walls = IN[0];

if not isinstance(walls, list):
	walls = UnwrapElement([walls]);
else:	
	walls = UnwrapElement(walls);

for i in walls:
	geoelem = i.GetGeometryObjectFromReference(Reference(i))
	geoobj = geoelem.GetEnumerator();
	for obj in geoobj:
		for f in obj.Faces:
			doc.RemovePaint(i.Id,f);

TransactionManager.Instance.TransactionTaskDone();	
			

OUT = walls;
# ----------------------------------------
Elements = Output(python_script)  # Return non paint wall elements
