# Dynamo custom node GetBuiltInCategory.dyf (Dynamo 1.3.2.2480)
# category: Quasar.BuiltIns
# Collect built-in category object and id by category

Category = Input()  # "Category_"; Category or Categories
builtInCategoryAndID = Python(IN[0]=Category)
# ---------- builtInCategoryAndID.python (31 lines) ----------
# dynamo version - 1.3.2'
# author - min.naung/mgjean @https://twentytwo.space/contact

import clr,System
clr.AddReference('RevitAPI')
from Autodesk.Revit.DB import *

builtInCategories = System.Enum.GetValues(BuiltInCategory)
categories_Ids_Dict = {}

categories = IN[0]

if isinstance(categories,list):
	categories = UnwrapElement(categories)
else:
	categories = UnwrapElement([categories])

catObj,ids = [],[]

# create dictionary {"id":"obj"}
for bic in builtInCategories:
	categories_Ids_Dict[ElementId(bic)] = bic
# loop category
for cate in categories:
	# get id
	id = cate.Id
	# return [[obj, id], []..[]]
	catObj.append(categories_Ids_Dict[id])
	ids.append(id)

OUT = catObj, ids
# ----------------------------------------
code_block = CodeBlock(i=builtInCategoryAndID) { i[0]; i[1]; }
BuiltInCategoryObject = Output(code_block.out0)
Ids = Output(code_block.out1)
