# Dynamo custom node DeleteElement.dyf (Dynamo 1.3.2.2480)
# category: Quasar.ElementUtility
# Input a list elements or single element, delete from document.

ElementOrAList = Input()  # Element(s)
deleteElements = Python(IN[0]=ElementOrAList)
# ---------- deleteElements.python (42 lines) ----------
import clr
clr.AddReference('RevitAPI')
clr.AddReference("RevitServices")
import System
from Autodesk.Revit.DB import *
from RevitServices.Persistence import DocumentManager
from RevitServices.Transactions import TransactionManager

# get current document 
doc = DocumentManager.Instance.CurrentDBDocument

# input category
if isinstance(IN[0],list):
	elements = UnwrapElement(IN[0])
else:
	elements = UnwrapElement([IN[0]])

# output list
res =[]


# transaction start
TransactionManager.Instance.EnsureInTransaction(doc)

# loop elements
for elem in elements:
	try:
		# delete from document
		r = doc.Delete(elem.Id)
		# deleted id append to output
		# after deleted its return as a elementId list 
		# what we want is elementId only, so use [0]
		res.append(r[0])
	except:
		# error message append to output
		res.append("ElementID %s can't delete." %elem.Id)
		continue
	
# transaction end
TransactionManager.Instance.TransactionTaskDone()
# output result
OUT = res
# ----------------------------------------
Result = Output(deleteElements)  # deleted elementId
