# Dynamo custom node GetAllWorksets.dyf (Dynamo 1.3.2.2480)
# category: Quasar.ElementUtility
# Collect all user created worksets from current document.

python_script = Python()
# ---------- python_script.python (19 lines) ----------
# dynamo version - 1.3.2
# author - min.naung/mgjean https://twentytwo.space/contact/

import clr
clr.AddReference('RevitAPI')
from Autodesk.Revit.DB import *
import Autodesk

clr.AddReference("RevitServices")
import RevitServices
from RevitServices.Persistence import DocumentManager

doc = DocumentManager.Instance.CurrentDBDocument

# collect user created worksets
worksets = FilteredWorksetCollector(doc).OfKind(WorksetKind.UserWorkset).ToWorksets()

# return list structure [[name,workset],[]...[]]
OUT = [[i.Name,i] for i in worksets]
# ----------------------------------------
NameAndWorkset = Output(python_script)  # return list structure [[name,workset],[]...[]]
