# Dynamo custom node ReloadAllLinkDocument.dyf (Dynamo 1.3.2.2480)
# category: Quasar.LinkDocumentUtility
# Reload all link document from their saved path (directory).

Run = Input(Run : bool=false)  # set true to run
python_script = Python(IN[0]=Run)
# ---------- python_script.python (29 lines) ----------
#dynamo version - 1.3.0
#author - min.naung https://twentytwopaths.wordpress.com/contact/

import clr
clr.AddReference("RevitServices")
clr.AddReference("RevitAPI")
import RevitServices,Autodesk
from RevitServices.Persistence import DocumentManager
from RevitServices.Transactions import TransactionManager
from Autodesk.Revit.DB import *

doc = DocumentManager.Instance.CurrentDBDocument

linkInstances = FilteredElementCollector(doc).OfClass(Autodesk.Revit.DB.RevitLinkInstance).ToElements()

load = []
if IN[0]:
	for link in linkInstances:
		linkType  = doc.GetElement(link.GetTypeId());
		filepath = linkType.GetExternalFileReference().GetAbsolutePath();
		try:
			linkType.LoadFrom(filepath,None);
			load.append(linkType);
		except:
			load.append(link.Name.split(" : ")[0]+" <File Not Found>")
			pass
	OUT= load
else:
	OUT="Run Forest Run"
# ----------------------------------------
Result = Output(python_script)  # Result Message
