# Dynamo custom node DeleteByCategory.dyf (Dynamo 1.3.2.2480)
# category: Quasar.ElementUtility
# All elements under provided category will be removed.

Category = Input()  # "Category_"; Category
python_script = Python(IN[0]=Category)
# ---------- python_script.python (51 lines) ----------
# dynamo version - 1.3.2
# author - min.naung/mgjean https://twentytwo.space/contact/


import clr
clr.AddReference('RevitAPI')
clr.AddReference("RevitServices")
import System
from Autodesk.Revit.DB import *
from RevitServices.Persistence import DocumentManager
from RevitServices.Transactions import TransactionManager

# get current document 
doc = DocumentManager.Instance.CurrentDBDocument

# input category
cat = IN[0]

# output list
res =[]

# get category object
obj = System.Enum.ToObject(BuiltInCategory, cat.Id)

# create category filter by category object
filter = ElementCategoryFilter(obj)

# collect filtered elements by category
elements = FilteredElementCollector(doc).WherePasses(filter).WhereElementIsNotElementType().ToElements()

# transaction start
TransactionManager.Instance.EnsureInTransaction(doc)

# loop elements
for elem in elements:
	try:
		# delete from document
		r = doc.Delete(elem.Id)
		# deleted id append to output
		# after deleted its return as a elementId list 
		# what we want is elementId only, so use [0]
		res.append(r[0])
	except:
		# error message append to output
		res.append("ElementID %s can't delete." %elem.Id)
		continue
	
# transaction end
TransactionManager.Instance.TransactionTaskDone()
# output result
OUT = res
# ----------------------------------------
Result = Output(python_script)  # Deleted elementId
