# Dynamo custom node RemoveProjectParameters.dyf (Dynamo 1.3.2.2480)
# category: Quasar.ElementUtility
# Remove a single or a list of  project parameter by a parameter name or a list of parameters names.

ParameterName = Input()  # a single or a list of project parameters names
removeParams = Python(IN[0]=ParameterName)
# ---------- removeParams.python (45 lines) ----------
# dynamo version - 1.3.2
#(should be fine with 1.3.x or 2.x.x versions too)

import clr

clr.AddReference('RevitAPI')
clr.AddReference("RevitServices")

from Autodesk.Revit.DB import *
from Autodesk.Revit.DB.Structure import *

from RevitServices.Persistence import DocumentManager
from RevitServices.Transactions import TransactionManager

doc = DocumentManager.Instance.CurrentDBDocument

# input[0]
elements = IN[0]
# params id
todelete = []

# check/make list
if not isinstance(elements, list):
	elements = [elements]
	
# collect parameters
parameters = FilteredElementCollector(doc).OfClass(ParameterElement).ToElements()

# loop input params
for elem in elements:
	# loop existing params
	for param in parameters:
		# if name found
		if param.Name == elem:
			# append id to delete list
			todelete.append(param.Id)

# start transaction
TransactionManager.Instance.EnsureInTransaction(doc)
# delete from document
res = [doc.Delete(i) for i in todelete]
# end transaction				
TransactionManager.Instance.TransactionTaskDone()

OUT = res
# ----------------------------------------
Ids = Output(removeParams)
