# Dynamo custom node ViewPortAlignment.dyf (Dynamo 1.3.2.2480)
# category: Quasar.ViewUtility
# Views arrange and align on sheets based on template sheet view ports position and location.

TemplateSheet = Input()  # Template sheet shouldn't be blank
Sheets = Input()  # Sheets with view ports
python_script = Python(IN[0]=TemplateSheet, IN[1]=Sheets)
# ---------- python_script.python (55 lines) ----------
# dynamo version - 1.3.0
# author - min.naung@mgjean https://twentytwopaths.wordpress.com/contact/

import clr
clr.AddReference("RevitAPI")
clr.AddReference("RevitNodes")
clr.AddReference("RevitServices")
import Autodesk, Revit, RevitServices
from Autodesk.Revit.DB import *
from RevitServices.Persistence import DocumentManager
from RevitServices.Transactions import TransactionManager

doc = DocumentManager.Instance.CurrentDBDocument

template = UnwrapElement(IN[0]);
sheets = IN[1];
result = [];
if not isinstance(sheets,list):
	sheets = UnwrapElement([sheets]);
else:
	sheets = UnwrapElement(sheets);

TransactionManager.Instance.EnsureInTransaction(doc);
sub =[]

for s in sheets:
		
	#collect all viewports from template sheet
	temp_ports = FilteredElementCollector(doc).OwnedByView(template.Id);
	#collect all viewports from current sheet
	view_ports = FilteredElementCollector(doc).OwnedByView(s.Id);
	
	#template sheet schedule views
	temp_schedules = [i for i in temp_ports if  i.Category != None and i.Category.Name == "Schedule Graphics" and i.IsTitleblockRevisionSchedule == False];
	#template sheet viewports
	temp_views = [i for i in temp_ports if i.Category != None and i.Category.Name == "Viewports"];
	
	#sheet schedule views
	s_schedules = [i for i in view_ports if  i.Category != None and i.Category.Name == "Schedule Graphics" and i.IsTitleblockRevisionSchedule == False];
	#sheet viewports
	s_views = [i for i in view_ports if i.Category != None and i.Category.Name == "Viewports"];
	
	#get/set location
	for ts,ss in zip(temp_schedules,s_schedules):
		ss.Point = ts.Point;
	
	for tv,vv in zip(temp_views,s_views):
		temploc = tv.GetBoxCenter();	
		vv.SetBoxCenter(temploc);
		
	sub.append([s_schedules,s_views]);

TransactionManager.Instance.TransactionTaskDone();

OUT = sub;
# ----------------------------------------
Viewports = Output(python_script)  # Return aligned views
