# Dynamo custom node WallAndGridDimension.dyf (Dynamo 1.3.2.2480)
# category: Quasar.GridElements
# Create horizontal and vertical dimensions between walls and grids .
# **Only work for walls and grids**

GridsAndWalls = Input()  # recommend to use OOTB Select Model Elements to make selection

# group: OUT[0] = Walls OUT[1] = Grids
filterGridAndWall = Python(IN[0]=GridsAndWalls)
# ---------- filterGridAndWall.python (16 lines) ----------
import clr

elements = UnwrapElement(IN[0])

walls = []
grids = []
for i in elements:
	try:
		if i.Category.Name.ToString() == "Walls":
			walls.append(i)
		if i.Category.Name.ToString() == "Grids":
			grids.append(i)
	except:
		pass

OUT = walls,grids
# ----------------------------------------
code_block = CodeBlock(i=filterGridAndWall) { i[0]; i[1]; }

# group: Grid Separation
getLocation = Element.GetLocation(code_block.out0)
direction = Line.Direction(getLocation)
python_script = Python(IN[0]=direction)
# ---------- python_script.python (15 lines) ----------
import clr,math
clr.AddReference('ProtoGeometry')
from Autodesk.DesignScript.Geometry import *

vectors = IN[0]
res = []

for vector in vectors:
	if math.fabs(vector.X) > 100:
		res.append(True)
	else:
		res.append(False)

#Assign your output to the OUT variable.
OUT = res
# ----------------------------------------
filterByBoolMask = List.FilterByBoolMask(list=code_block.out0, mask=python_script)

# group: Horizontal Wall Point
geometry = Element.Geometry(filterByBoolMask.in)
byGeometry = BoundingBox.ByGeometry(geometry)
minPoint = BoundingBox.MinPoint(byGeometry)

# group: Grid Separation
name = Element.Name()  # unwired: arg0
sortByFunction = SortByFunction(code_block.out1, name)
curve = Grid.Curve(code_block.out1)
direction_2 = Line.Direction(curve)
python_script_2 = Python(IN[0]=direction_2)  # same code as python_script
filterByBoolMask_2 = List.FilterByBoolMask(list=sortByFunction, mask=python_script_2)

# group: Horizontal Grid Points
horizontal_curve = Grid.Curve(filterByBoolMask_2.in)
startPoint = Curve.StartPoint(horizontal_curve)

# group: Horizontal Walls and Grids Points
horizontal_points = List.Create(minPoint, startPoint)
flatten = Flatten(horizontal_points)

# group: Sorted horizontal points
Y = Point.Y()  # unwired: arg0
# note: Horizontal sorts by y values
sortByFunction_2 = SortByFunction(flatten, Y)

# group: Reference line for horizontal
code_block_2 = CodeBlock(i=sortByFunction_2)
# ---------- code_block_2.designscript (4 lines) ----------
// start point
i[0];
// end point
i[-1];
# ----------------------------------------
code_block_3 = CodeBlock(start_Point=code_block_2.out0, end_Point=code_block_2.out1) { start_Point.X; end_Point.Y; }
# note: Reconstruct end point based on start point x value and end point y value.
byCoordinates = Point.ByCoordinates(x=code_block_3.out0, y=code_block_3.out1)
byStartPointEndPoint = Line.ByStartPointEndPoint(startPoint=code_block_2.out0, endPoint=byCoordinates)

# group: Wall, Grid Elements
create = List.Create(filterByBoolMask.in, filterByBoolMask_2.in)
horizontal = Flatten(create)
create_2 = List.Create(filterByBoolMask.out, filterByBoolMask_2.out)
vertical = Flatten(create_2)

# group: Horizontal Dimension
XAxis = Vector.XAxis()
number = DoubleInput(-500)
translate = Geometry.Translate(geometry=byStartPointEndPoint, direction=XAxis, distance=number)
python_script_3 = Python(IN[0]=translate, IN[1]=horizontal)
# ---------- python_script_3.python (39 lines) ----------
import clr
clr.AddReference("RevitAPI")
from Autodesk.Revit.DB import *

clr.AddReference("RevitNodes")
import Revit
clr.ImportExtensions(Revit.GeometryConversion)
clr.ImportExtensions(Revit.Elements)

clr.AddReference("RevitServices")
import RevitServices
from RevitServices.Persistence import DocumentManager
from RevitServices.Transactions import TransactionManager

doc = DocumentManager.Instance.CurrentDBDocument

line = UnwrapElement(IN[0]).ToRevitType()
elements = UnwrapElement(IN[1])

elementsRef = ReferenceArray()

for element in elements:
	if element.Category.Name.ToString() == "Walls":
		a = HostObjectUtils.GetSideFaces(element, ShellLayerType.Exterior)
		for i in a:
			elementsRef.Append(i)
		b = HostObjectUtils.GetSideFaces(element, ShellLayerType.Interior)
		for i in b:
			elementsRef.Append(i)
	elif element.Category.Name.ToString() == "Grids":
		elementsRef.Append(Reference(element))
		
TransactionManager.Instance.EnsureInTransaction(doc)

dim = doc.Create.NewDimension(doc.ActiveView, line, elementsRef).ToDSType(True)

TransactionManager.Instance.TransactionTaskDone()

OUT = dim
# ----------------------------------------

# group: Vertical Wall Point
geometry_2 = Element.Geometry(filterByBoolMask.out)
byGeometry_2 = BoundingBox.ByGeometry(geometry_2)
minPoint_2 = BoundingBox.MinPoint(byGeometry_2)

# group: Vertical Grid Points
vertical_curve = Grid.Curve(filterByBoolMask_2.out)
startPoint_2 = Curve.StartPoint(vertical_curve)

# group: Vertical Walls and Grids Points
vertical_points = List.Create(minPoint_2, startPoint_2)
flatten_2 = Flatten(vertical_points)

# group: Sorted vertical points
X = Point.X()  # unwired: arg0
# note: Vertical sorts by x values
sortByFunction_3 = SortByFunction(flatten_2, X)

# group: Reference line for vertical
code_block_4 = CodeBlock(i=sortByFunction_3)  # same code as code_block_2
# note: Reconstruct end point based on start point y value and end point x value.
code_block_5 = CodeBlock(end_Point=code_block_4.out1, start_point=code_block_4.out0) { end_Point.X; start_point.Y; }
byCoordinates_2 = Point.ByCoordinates(x=code_block_5.out0, y=code_block_5.out1)
byStartPointEndPoint_2 = Line.ByStartPointEndPoint(startPoint=code_block_4.out0, endPoint=byCoordinates_2)

# group: Vertical Dimension
YAxis = Vector.YAxis()
number_2 = DoubleInput(-500)
translate_2 = Geometry.Translate(geometry=byStartPointEndPoint_2, direction=YAxis, distance=number_2)
python_script_4 = Python(IN[0]=translate_2, IN[1]=vertical)  # same code as python_script_3

create_3 = List.Create(python_script_3, python_script_4)
code_block_6 = CodeBlock(x=create_3) { Flatten(x); }
Dimensions = Output(code_block_6)
