# Dynamo custom node DuplicateSheetsWithViews.dyf (Dynamo 2.0.1.5055)
# category: Quasar.SheetUtility
# Duplicate sheets with all the views that associate with the sheets.

Sheets = Input(Sheets: var[]..[])  # sheets to duplicate
Names = Input(Names: var[]..[])  # names for sheets
Numbers = Input(Numbers: var[]..[])  # number for sheets
Titleblock = Input(Titleblock: var[]..[])  # Titleblock Family
# note: IN[0] = existing sheets to duplicate;
# IN[1] = names for new sheets;
# IN[2] = numbers for new sheets;
# IN[3] = titleblock family for new sheets;
python_script = Python(IN[0]=Sheets, IN[1]=Names, IN[2]=Numbers, IN[3]=Titleblock)
# ---------- python_script.python (58 lines) ----------
# dynamo version - 2.0.1
# quasar version - 2.0.1

# author - min.naung/mgjean https://twentytwo.space/contact/
import clr
clr.AddReference('RevitAPI')
clr.AddReference("RevitServices")

from Autodesk.Revit.DB import *

from RevitServices.Persistence import DocumentManager
from RevitServices.Transactions import TransactionManager

doc = DocumentManager.Instance.CurrentDBDocument

sheets = UnwrapElement(IN[0])
names = IN[1]
numbers = IN[2]
titleblock = UnwrapElement(IN[3])

new_sheets = []
out = []



TransactionManager.Instance.EnsureInTransaction(doc)

for (name, number) in zip(names,numbers):
	newSheet = ViewSheet.Create(doc, titleblock.Id)	
	
	newSheet.SheetNumber = number
	newSheet.Name = name
	new_sheets.append(newSheet)


for sheet,nSheet in zip(sheets,new_sheets):	
	views = []
	vPorts = sheet.GetAllViewports()
	
	for ele in vPorts:
		ele = doc.GetElement(ele)				
		vOpt = ViewDuplicateOption.WithDetailing
				
		viewLoc = ele.GetBoxCenter()
		vptype = ele.GetTypeId()

		view = doc.GetElement(ele.ViewId)
		v = view.Duplicate(vOpt)

		newPort = Viewport.Create(doc,nSheet.Id, v, viewLoc)
		views.append(newPort)
		newPort.ChangeTypeId(vptype)
					
	out.append(views)
TransactionManager.Instance.TransactionTaskDone()	

	
OUT = out
# ----------------------------------------
Sheets_2 = Output(python_script)  # "Sheets"; output sheets
