# Dynamo custom node FamilyInstanceByTypeName.dyf (Dynamo 1.3.2.2480)
# category: Quasar.ElementUtility
# A list of  type names to collect family instances.

FamilyTypeName = Input(FamilyTypeName:string)  # Single Type Name or Comma Separated Type Name Eg - "type 1" or "type 1","type 2"
python_script = Python(IN[0]=FamilyTypeName)
# ---------- python_script.python (23 lines) ----------
# dynamo version 1.3.0 
# author - min.naung/mgjean https://twentytwo.space/contact/

import clr
clr.AddReference("RevitAPI")
clr.AddReference("RevitServices")
from Autodesk.Revit.DB import *
from RevitServices.Persistence import DocumentManager
doc = DocumentManager.Instance.CurrentDBDocument

result = [];
name = IN[0]
if not isinstance(name,list):
	names = IN[0].strip().split(',')

instances = FilteredElementCollector(doc).OfClass(FamilyInstance).ToElements();
for n in names:
	
	for i in instances:
		if i.Name == n:
			 
			result.append(i);
OUT = result;
# ----------------------------------------
FamilyInstance = Output(python_script)  # List of family instances
