# Dynamo custom node RoomTagToRoom.dyf (Dynamo 1.3.2.2480)
# category: Quasar.RoomUtility
# Relocate room tag to associate room location

RoomTags = Input()  # Room Tags Elements
centerRoomTag = Python(IN[0]=RoomTags)
# ---------- centerRoomTag.python (34 lines) ----------
# dynamo version - 1.3.2
# author - min.naung/mgjean https://twentytwo.space/contact/

import clr

#clr.AddReference('RevitAPI')
clr.AddReference('RevitServices')

#from Autodesk.Revit.DB import *
from RevitServices.Persistence import DocumentManager
from RevitServices.Transactions import TransactionManager

doc = DocumentManager.Instance.CurrentDBDocument

elems = IN[0];

if not isinstance(elems,list):
	elems = UnwrapElement([elem])
else:
	elems = UnwrapElement(elems)

#room_tags = FilteredElementCollector(doc).OfClass(SpatialElementTag).ToElements()


TransactionManager.Instance.EnsureInTransaction(doc)

for i in elems:
	room_loc = i.Room.Location.Point
	new_loc = room_loc - i.Location.Point
	i.Location.Move(new_loc)

TransactionManager.Instance.TransactionTaskDone()

OUT = elems
# ----------------------------------------
Elements = Output(centerRoomTag)  # return elements
