# Dynamo custom node CreatDuctsByModelCurves.dyf (Dynamo 1.3.2.2480)
# category: Quasar.ElementUtility
# Create ducts by model curves and family type.

ModelCurves = Input()  # Model curves
familyType = Input()  # Duct Family Type
python_script = Python(IN[0]=ModelCurves, IN[1]=familyType)
# ---------- python_script.python (44 lines) ----------
# dynamo version - 1.3.2'
# author - min.naung/mgjean @https://twentytwo.space/contact
import clr
clr.AddReference("RevitAPI")
clr.AddReference("RevitServices")

from Autodesk.Revit.DB import *
from Autodesk.Revit.DB.Mechanical import *
from RevitServices.Persistence import DocumentManager
from RevitServices.Transactions import TransactionManager

doc = DocumentManager.Instance.CurrentDBDocument;

lines = IN[0];
ductType = UnwrapElement(IN[1]);

ducts = [];

# list 
if isinstance(lines, list):
	lines = UnwrapElement(lines);
else:
	lines = UnwrapElement([lines]);

#current view level
level = doc.ActiveView.GenLevel;

#collect family symbol
fsymbol = FilteredElementCollector(doc).OfClass(MechanicalSystemType).ToElements()[0];


#transaction start
TransactionManager.Instance.EnsureInTransaction(doc);

for line in lines:
	
	#create duct
	duct = Duct.Create(doc, fsymbol.Id,ductType.Id, level.Id, line.GeometryCurve.GetEndPoint(0), line.GeometryCurve.GetEndPoint(1));	
	ducts.append(duct);

#transaction end
TransactionManager.Instance.TransactionTaskDone();

OUT = ducts
# ----------------------------------------
Ducts = Output(python_script)  # Return Elements
