# Dynamo custom node CreateBeamsByModelCurves.dyf (Dynamo 1.3.2.2480)
# category: Quasar.ElementUtility
# Create beams by model curves.

ModelCurves = Input()  # Model Curves
familyType = Input()  # Family Type
python_script = Python(IN[0]=ModelCurves, IN[1]=familyType)
# ---------- python_script.python (58 lines) ----------
# dynamo version - 1.3.2
# author - 'min.naung/mgjean @https://twentytwo.space/contact'



# import common language runtime 
import clr

# clr.AddReference loads and imports .net assembly(dll) as python module
# load RevitAPI.dll and RevitServices.dll
clr.AddReference("RevitAPI")
clr.AddReference("RevitServices")

# import all classes from Revit DB
from Autodesk.Revit.DB import *

# import document manager
from RevitServices.Persistence import DocumentManager
# import transaction manager
from RevitServices.Transactions import TransactionManager

# instantiate current document
doc = DocumentManager.Instance.CurrentDBDocument

# input model curves
lines = IN[0]
# empty list for return output
beams = []

# if input is a list 
if isinstance(lines, list):
	lines = UnwrapElement(lines)
# if not a list
else:
	lines = UnwrapElement([lines])

#current view level
level = doc.ActiveView.GenLevel

#structural framing symbol
sym=UnwrapElement(IN[1])

#transaction start
TransactionManager.Instance.EnsureInTransaction(doc)

for line in lines:
	
	#create beam
	beam = doc.Create.NewFamilyInstance(line.GeometryCurve, sym, 
		level, Structure.StructuralType.Beam)
	#append to output
	beams.append(beam)

#transaction end
TransactionManager.Instance.TransactionTaskDone()

#output
OUT = beams
# ----------------------------------------
Beams = Output(python_script)  # Output
