# Dynamo custom node GetLinkDocument.dyf (Dynamo 1.3.2.2480)
# category: Quasar.LinkDocumentUtility
# Get all link document. Each list contains ,
#       [0] Name of Link Document (String)
#       [1] Link Document (Document)

python_script = Python()
# ---------- python_script.python (15 lines) ----------
# dynamo version - 1.3.0 
# author - min.naung@mgjean https://twentytwopaths.wordpress.com/contact/


import clr
clr.AddReference("RevitAPI")
clr.AddReference("RevitServices")

from Autodesk.Revit.DB import *
from RevitServices.Persistence import DocumentManager

doc = DocumentManager.Instance.CurrentDBDocument;
link_docs = FilteredElementCollector(doc).OfClass(RevitLinkInstance);

OUT = [[i.Name.split(":")[0],i.GetLinkDocument()] for i in link_docs];
# ----------------------------------------
LinkDocuments = Output(python_script)  # Each list contains [0] Name of link doc [1] Document
