# Dynamo custom node PolygonsByCurves.dyf (Dynamo 1.3.2.2480)
# category: Quasar.DynamoNodes
# Create polygon by curve and number of side, returns value [ polygon, [line-segments] ]

Curve = Input()  # "Curve_"; Curve or Curves
NumberOfSide = Input()  # int or int list
python_script = Python(IN[0]=Curve, IN[1]=NumberOfSide)
# ---------- python_script.python (47 lines) ----------
# dynamo version - 1.3.2'
# author - min.naung/mgjean @https://twentytwo.space/contact

import clr
clr.AddReference('ProtoGeometry')
from Autodesk.DesignScript.Geometry import *

def make_list(l):
	if not isinstance(l,list):
		return [l]
	return l
		
curve_list = make_list(IN[0])
side_list =make_list(IN[1])

def getPoints(curve,side):
	base = float(1/float(side))
	increment = 0
	points = []
	for i in range(int(side)):
		increment += base
		point = Curve.PointAtParameter(curve,increment)
		points.append(point)
	return points

def lineSegments(points):
	line_segments = []
	for num,point in enumerate(points):
		if num == len(points):
			break;
		if num == len(points)-1:
			next = num + 1
			line = Line.ByStartPointEndPoint(point,points[0])
		
		else:
			next = num + 1
			line = Line.ByStartPointEndPoint(point, points[next])
		line_segments.append(line);
	return line_segments

polygons, segments = [],[]
for curve,side in zip(curve_list,side_list):
	points = getPoints(curve,side)
	polygons.append(Polygon.ByPoints(points))
	segments.append(lineSegments(points))

OUT = polygons, segments
# ----------------------------------------
code_block = CodeBlock(i=python_script) { i[0]; i[1]; }
Polygons = Output(code_block.out0)  # return polygon
LineSegments = Output(code_block.out1)  # line segments of polygon
