# Dynamo custom node IsometricViewsBySectionViews.DYF (Dynamo 1.3.2.2480)
# category: Quasar.ViewUtility
# This node performs like a Revit's feature " Orient To View ". It create isometric views based on provide sections or elevations views.

SectionViews = Input()  # section views
python_script = Python(IN[0]=SectionViews)
# ---------- python_script.python (83 lines) ----------
# dynamo version - 1.3.0
# author - min.naung/mgjean https://twentytwo.space/contact/

import clr
clr.AddReference('ProtoGeometry')
clr.AddReference('RevitAPI')
clr.AddReference('RevitServices')
clr.AddReference("RevitNodes")

import Revit
clr.ImportExtensions(Revit.Elements)
clr.ImportExtensions(Revit.GeometryConversion)
from Autodesk.DesignScript.Geometry import *
from Autodesk.Revit.DB import FilteredElementCollector,ViewFamilyType,ViewFamily,View3D,BoundingBoxXYZ
from RevitServices.Persistence import DocumentManager
from RevitServices.Transactions import TransactionManager

doc = DocumentManager.Instance.CurrentDBDocument

# collect view type
collector = FilteredElementCollector(doc).OfClass(ViewFamilyType);
# get 3DViewType
for i in collector:
	if i.ViewFamily == ViewFamily.ThreeDimensional:
		viewType = i;

# create a function
def SectionToIsometric(view):
	mgr = view.GetCropRegionShapeManager()
	# curves 
	curve = mgr.GetCropShape()
	# direction of section
	vector = view.ViewDirection.ToVector().Reverse()
	# view extend
	offset = view.LookupParameter("Far Clip Offset").AsDouble()*304.8
	points = []
	for i in curve[0]:
		# start point of each curve
		start = i.GetEndPoint(0).ToPoint();
		# make list
		points.append(start)
	# create polycurve
	curves = PolyCurve.ByPoints(points,True)
	# curve extrude by direction and distance , result as solid
	solid = Curve.ExtrudeAsSolid(curves,vector,offset);
	# create bbox
	bbox = BoundingBox.ByGeometry(solid).ToRevitType();
	# create 3dview
	view3d = View3D.CreateIsometric(doc,viewType.Id);
	# view name includes (3D)
	view3d.ViewName = view.ViewName + " (3D)"
	# set cropbox size to bbox size
	view3d.CropBox = bbox
	# set cropbox active
	view3d.CropBoxActive = False
	# cropbox visibility
	view3d.CropBoxVisible = True
	# set sectionbox to bbox
	view3d.SetSectionBox(bbox)
	# set view scale
	view3d.Scale = 50
	# return view
	return view3d

# input views
views = IN[0]
# output result
result = []
# check list 
if not isinstance(views,list):
	views = UnwrapElement([views])
else:
	views = UnwrapElement(views)
# start transaction
TransactionManager.Instance.EnsureInTransaction(doc)
# loop views
for view in views:
	# call function with view is an argument
	result.append(SectionToIsometric(view))
# transaction end
TransactionManager.Instance.TransactionTaskDone()
# output result
OUT = result
# ----------------------------------------
IsometricViews = Output(python_script)  # Output isometric views
