# Dynamo graph ceilingplan-byrooms.dyn (Dynamo 2.0.1.5055)

levels = Levels(index=0)
categories = Categories(index=403)  # graph input
all_elements_of_category = ElementsOfCategory(Category=categories)
name = Level.Name(level=levels)
code_block = CodeBlock { "Level"; }
getParameterValueByName = Element.GetParameterValueByName(element=all_elements_of_category, parameterName=code_block)
# note: ** Quasar Package Sample **
eq = name == getParameterValueByName
filterByBoolMask = List.FilterByBoolMask(list=all_elements_of_category, mask=eq)
number = Room.Number(room=all_elements_of_category)
number_slider = DoubleSlider(600, range=-1000..2000 step 10)  # graph input
# note: - Create ceiling views by rooms, names and offset.
ceilingViewByRoom = Quasar.ViewUtility.CeilingViewByRoom(Level=levels, Rooms=filterByBoolMask.in, Names=number, Offset=number_slider)
