# Dynamo graph threeDview-byrooms.dyn (Dynamo 2.0.1.5055)

categories = Categories(index=403)  # graph input
all_elements_of_category = ElementsOfCategory(Category=categories)
levels = Levels(index=0)
name = Level.Name(level=levels)
# note: ** Quasar Package Sample **
eq = name == _  # unwired: y
filterByBoolMask = List.FilterByBoolMask(list=all_elements_of_category, mask=eq)
number = Room.Number(room=all_elements_of_category)
number_slider = DoubleSlider(600, range=-1000..2000 step 10)  # graph input
# note: - Create 3D Views for given room.
threeDViewByRoom = Quasar.ViewUtility.ThreeDViewByRoom(Rooms=filterByBoolMask.in, Names=number, Offset=number_slider)
code_block = CodeBlock { "Level"; }
getParameterValueByName = Element.GetParameterValueByName(element=all_elements_of_category, parameterName=code_block)
