# Dynamo graph ui-transfer-view-template-and-filters.dyn (Dynamo 2.0.1.5055)

# group: GetLinkDocument
# note: Each list includes [DocumentName, Document]
python_script = Python()
# ---------- python_script.python (15 lines) ----------
# dynamo version - 1.3.0 
# author - min.naung@mgjean https://twentytwopaths.wordpress.com/contact/


import clr
clr.AddReference("RevitAPI")
clr.AddReference("RevitServices")

from Autodesk.Revit.DB import *
from RevitServices.Persistence import DocumentManager

doc = DocumentManager.Instance.CurrentDBDocument;
link_docs = FilteredElementCollector(doc).OfClass(RevitLinkInstance);

OUT = [[i.Name.split(":")[0],i.GetLinkDocument()] for i in link_docs];
# ----------------------------------------

# note: ** Quasar Package Sample File **
code_block = CodeBlock(i=python_script) { i[13][1]; }
# note: - Select view templates to transfer from link document  to current document with or without applied filters.
transferViewTempateAndFilterUI = Custom[TransferViewTempateAndFilterUI](LinkDocument=code_block)  # Select view templates to transfer from link document to current document with or without applied filters.
