# Dynamo custom node AllElementsOfWorkset.dyf (Dynamo 1.3.2.2480)
# category: Quasar.ElementUtility
# Collect all elements from input workset.

workset = Input()  # Workset Element
allElementsOfWorkset = Python(IN[0]=workset)
# ---------- allElementsOfWorkset.python (21 lines) ----------
# dynamo version - 1.3.2
# author - min.naung/mgjean https://twentytwo.space/contact/

import clr
clr.AddReference('RevitAPI')
from Autodesk.Revit.DB import *
import Autodesk

clr.AddReference("RevitServices")
import RevitServices
from RevitServices.Persistence import DocumentManager
from RevitServices.Transactions import TransactionManager

doc = DocumentManager.Instance.CurrentDBDocument

workset = IN[0]
filter = ElementWorksetFilter(workset.Id,False)
# collect user created worksets
elements = FilteredElementCollector(doc).WherePasses(filter).ToElements()
# elements output
OUT = elements
# ----------------------------------------
Elements = Output(allElementsOfWorkset)  # All elements of workset
