# Dynamo custom node CopyLevelAndGridFromLinkDocument.dyf (Dynamo 1.3.2.2480)
# category: Quasar.LinkDocumentUtility
# Select link document to copy levels and grids.

Run = Input(Run : bool)  # run forest run
copyGridsLevelsFromLinkDocument = Python(IN[0]=Run)
# ---------- copyGridsLevelsFromLinkDocument.python (126 lines) ----------
# dynamo version - 1.3.2
# author - min.naung/mgjean https://twentytwo.space/contact

import clr, System

clr.AddReference("System.Windows.Forms")
clr.AddReference("System.Drawing")
clr.AddReference("RevitAPI")
clr.AddReference("RevitServices")

from System.Collections.Generic import List
from System.Windows.Forms import (Application, Button, ComboBox, CheckBox, Form as _Form,
CheckedListBox,Padding,FormBorderStyle, SelectionMode,Label, MessageBox,MessageBoxButtons, MessageBoxIcon)
from System.Drawing import (Font as _Font, Icon as _Icon, Point as _Point, Size as _Size,FontStyle)


from Autodesk.Revit.DB import *
from RevitServices.Persistence import DocumentManager
from RevitServices.Transactions import TransactionManager

doc = DocumentManager.Instance.CurrentDBDocument

linkInstances = FilteredElementCollector(doc).OfClass(RevitLinkInstance)

linkName = [i.Name.split(" : ")[0] for i in linkInstances]

linkDict = {i.Name.split(" : ")[0] : i.GetLinkDocument() for i in linkInstances};

res = []

class CheckedBoxListSelector(_Form):
	"""Checked Box List Selector"""

	def __init__(self):
		#self.Icon = _Icon(r"%s\extra\icon.ico" %ipath)
		self.Size = _Size(300,370)
		self.Text = "Quasar®"

		# fonts
		self.gsmt_11r = _Font("Georgia", 10)
		self.gsmt_10r = _Font("Georgia",9)

		# label
		self.label = Label()
		self.label.Text = "Select Link Document:"
		self.label.Font = self.gsmt_11r
		self.label.Location = _Point(30,10)
		self.label.Size = _Size(220,28)
		self.Controls.Add(self.label)

		# checklist box
		self.lstbox = CheckedListBox()
		self.lstbox.Items.AddRange(tuple(linkName))
		self.lstbox.Font = self.gsmt_10r
		# padding
		self.lstbox.Padding = Padding(30)
		# select one click
		self.lstbox.CheckOnClick = True

		self.FormBorderStyle = FormBorderStyle.FixedDialog
		self.MaximizeBox = False;
		self.ManimizeBox = False;
		self.lstbox.Location = _Point(30,40)
		self.lstbox.Size = _Size(220,250)

		# auto horizontal scrollbar
		self.lstbox.HorizontalScrollbar = True
		self.Controls.Add(self.lstbox)

		# ok btn
		self.btn = Button()
		self.btn.Text = "OK"
		self.btn.Font = self.gsmt_10r
		self.btn.Size = _Size(80,25)
		self.btn.Location = _Point(95,290)
		self.Controls.Add(self.btn)

		# events
		self.btn.Click += self.click_ok
		self.lstbox.ItemCheck += self.item_check

		# pop up from center
		self.CenterToScreen()
		
	def item_check(self, sender, event):
		for i in range(len(self.lstbox.Items)):
			if not i == event.Index:
				self.lstbox.SetItemChecked(i, False)

	def click_ok(self, sender, event):
		global res
		if len(self.lstbox.Items) < 1:
			self.Close()
		if len(self.lstbox.CheckedItems) < 1:
			return MessageBox.Show("No element selected!", "Quasar® Info Box", MessageBoxButtons.OK, MessageBoxIcon.Asterisk)
					
		res = self.lstbox.CheckedItems;
		return self.Close()

if IN[0]:

	Application.Run(CheckedBoxListSelector())
	doc = DocumentManager.Instance.CurrentDBDocument

	linkdoc = [linkDict[i] for i in res][0]

	# collect grid from link document
	collector = FilteredElementCollector(linkdoc).OfClass(Grid).ToElements()
	levels = FilteredElementCollector(linkdoc).OfClass(Level).ToElements()
	collector = list(collector)
	collector.extend(levels)

	# dot-net elementId list
	ids = List[ElementId]([i.Id for i in collector])
	# transaction start
	TransactionManager.Instance.EnsureInTransaction(doc)
	#copy template from link-doc to current-doc
	transfer_views = ElementTransformUtils.CopyElements(linkdoc,ids,doc,Transform.Identity,CopyPasteOptions())


	# transaction done			
	TransactionManager.Instance.TransactionTaskDone()
	# output
	OUT = collector
else:
	OUT = "Run"
# ----------------------------------------
Elements = Output(copyGridsLevelsFromLinkDocument)  # levels and grids
