# Dynamo custom node DuplicateSheetsWithViews.dyf (Dynamo 1.3.2.2480)
# category: Quasar.SheetUtility
# Duplicate given sheets list, containing all views by new  sheets names, numbers and a titleblock

SheetList = Input()  # list of sheets to duplicate
NameList = Input()  # names list for new sheets
NumberList = Input()  # numbers list for new sheets
titleblock = Input()  # a titleblock
# note: IN[0] = existing sheets to duplicate;
# IN[1] = names for new sheets;
# IN[2] = numbers for new sheets;
# IN[3] = titleblock family for new sheets;
python_script = Python(IN[0]=SheetList, IN[1]=NameList, IN[2]=NumberList, IN[3]=titleblock)
# ---------- python_script.python (71 lines) ----------
import clr
clr.AddReference('RevitAPI')
clr.AddReference("RevitServices")
clr.AddReference("RevitNodes")
import RevitServices
import Revit
import Autodesk
from Autodesk.Revit.DB import *

from RevitServices.Persistence import DocumentManager
from RevitServices.Transactions import TransactionManager

doc = DocumentManager.Instance.CurrentDBDocument

def lst(l):
	if isinstance(l, list):
		return l
	else:
		return [l]

sheets = UnwrapElement(lst(IN[0]))
names = lst(IN[1])
numbers = lst(IN[2])
titleblock = UnwrapElement(IN[3])



new_sheets = []
out = []
count = 1


TransactionManager.Instance.EnsureInTransaction(doc)

for (name, number) in zip(names,numbers):
	newSheet = ViewSheet.Create(doc, titleblock.Id)	
	
	newSheet.SheetNumber = number
	newSheet.Name = name
	new_sheets.append(newSheet)


for sheet,nSheet in zip(sheets,new_sheets):	
	views = []
	vPorts = sheet.GetAllViewports()
	
	for ele in vPorts:
		ele = doc.GetElement(ele)				
		vOpt = ViewDuplicateOption.WithDetailing
				
		viewLoc = ele.GetBoxCenter()
		vptype = ele.GetTypeId()

		view = doc.GetElement(ele.ViewId)
		v = view.Duplicate(vOpt)
		dup_view = doc.GetElement(v)
		try:
			dup_view.Name = ele.LookupParameter("View Name").AsString() + " (" + count +")"
		except:
			dup_view.Name = ele.LookupParameter("View Name").AsString() + +"New "+"(" + str(count)+ ")"
			count += 1

		newPort = Viewport.Create(doc,nSheet.Id, v, viewLoc)
		views.append(newPort)
		newPort.ChangeTypeId(vptype)
					
	out.append(views)
TransactionManager.Instance.TransactionTaskDone()	

	
OUT = out
# ----------------------------------------
SheetsWithViews = Output(python_script)
