# Dynamo custom node RemoveLineStyles.dyf (Dynamo 1.3.2.2480)
# category: Quasar.LineUtility
# Remove line styles from the current documet by keywords (string list).

KeywordList = Input()  # keywords (string list)
# note: IN[0] = Keywords (string list)
python_script = Python(IN[0]=KeywordList)
# ---------- python_script.python (31 lines) ----------
import clr
clr.AddReference("RevitAPI")
clr.AddReference("RevitServices")

from Autodesk.Revit.DB import *
from RevitServices.Persistence import DocumentManager
from RevitServices.Transactions import TransactionManager


doc = DocumentManager.Instance.CurrentDBDocument

cate = Category.GetCategory(doc, BuiltInCategory.OST_Lines)

res = {}
keywords = IN[0]
removed = []
# line category store
for i in cate.SubCategories:
	for k in keywords:
		if k in i.Name:
			res[i.Name] = i.Id
			
TransactionManager.Instance.EnsureInTransaction(doc)

for name, id in res.items():
	removed.append(name)
	doc.Delete(id)

TransactionManager.Instance.TransactionTaskDone()

OUT = removed
# ----------------------------------------
Removed = Output(python_script)  # deleted line styles
