# Dynamo custom node RoomSolidGeometry.dyf (Dynamo 1.3.2.2480)
# category: Quasar.RoomUtility
# Collect dynamo geometry and revit geometry from room.

Rooms = Input()  # Room Elements
python_script = Python(IN[0]=Rooms)
# ---------- python_script.python (33 lines) ----------
# dynamo version - 1.3.2'
# author - min.naung/mgjean @https://twentytwo.space/contact

import clr

clr.AddReference('RevitAPI')
clr.AddReference("RevitNodes")

import Revit
clr.ImportExtensions(Revit.Elements)
clr.ImportExtensions(Revit.GeometryConversion)

from Autodesk.Revit.DB import Reference


elems = IN[0];

if not isinstance(elems,list):
	elems = UnwrapElement([elem])
else:
	elems = UnwrapElement(elems)

rvt = []
dyn = []

for e in elems:
	geoelem = e.GetGeometryObjectFromReference(Reference(e))
	geoobj = geoelem.GetEnumerator();
	for obj in geoobj:			
		rvt.append(obj)
		dyn.append(obj.ToProtoType())		

OUT = rvt,dyn
# ----------------------------------------
code_block = CodeBlock(i=python_script) { i[0]; i[1]; }
RevitGeometry = Output(code_block.out0)  # Revit type geometry
DynamoGeometry = Output(code_block.out1)  # Dynamo type geometry
