# Dynamo custom node SetFillRegionLine.dyf (Dynamo 1.3.2.2480)
# category: Quasar.LineUtility
# Modify fill region type line styles by given line style type in active view (default), set false to modify all view in the document.

FillRegionType = Input()  # fill region type
LineStyleType = Input()  # line styles type
ActiveViewOnly = Input(ActiveViewOnly = true)  # boolean value for active view
# note: ** Change Fill Region Line Style (Active View Only)
# IN[0] = Fill Region Type
# IN[1] = Line Style
# IN[2] = Active view (boolean)
fillRegions = Python(IN[0]=FillRegionType, IN[1]=LineStyleType, IN[2]=ActiveViewOnly)
# ---------- fillRegions.python (35 lines) ----------
import clr


clr.AddReference("RevitAPI")
from Autodesk.Revit.DB import *
clr.AddReference("RevitServices")
import RevitServices
from RevitServices.Persistence import DocumentManager
from RevitServices.Transactions import TransactionManager

doc = DocumentManager.Instance.CurrentDBDocument

frtId = UnwrapElement(IN[0]).Id
lineId = UnwrapElement(IN[1]).Id
active_view = IN[2]

if active_view:
	elems = FilteredElementCollector(doc, doc.ActiveView.Id).OfClass(FilledRegion)
else:
	elems = FilteredElementCollector(doc).OfClass(FilledRegion)


res = []

TransactionManager.Instance.EnsureInTransaction(doc)

for i in elems:
		if frtId == i.GetTypeId():
			i.SetLineStyleId(lineId)
			res.append(i)
	
TransactionManager.Instance.TransactionTaskDone()


OUT = res
# ----------------------------------------
FillRegionElements = Output(fillRegions)  # fill region elements
