# Dynamo graph elevations-byrooms.dyn (Dynamo 2.0.1.5055)

categories = Categories(index=403)  # graph input
all_elements_of_category = ElementsOfCategory(Category=categories)
levels = Levels(index=0)
name = Level.Name(level=levels)
code_block = CodeBlock { "Level"; }
getParameterValueByName = Element.GetParameterValueByName(element=all_elements_of_category, parameterName=code_block)
# note: **Quasar Package Sample**
eq = name == getParameterValueByName
filterByBoolMask = List.FilterByBoolMask(list=all_elements_of_category, mask=eq)
byLevel = FloorPlanView.ByLevel(level=levels)
number_slider = DoubleSlider(600, range=-1000..2000 step 10)  # graph input
# note: - Create elevation views in room with crop offset by rooms , floorplan and offset. Default naming is - "RoomName_RoomNumber - A", "RoomName_RoomNumber - B", "RoomName_RoomNumber - C", "RoomName_RoomNumber - D".
elevationInRoom = Quasar.ViewUtility.ElevationInRoom(Rooms=filterByBoolMask.in, FloorPlan=byLevel, Offset=number_slider)
