# Dynamo graph hide-unhide-elements.dyn (Dynamo 2.0.1.5055)

# note: ** Quasar Package Sample File **
select_model_elements = DSModelElementsSelection()  # nothing selected; graph input
views = Views(index=16)  # graph input
views_2 = Views(index=17)  # graph input
views_3 = Views(index=28)  # graph input
create = List.Create(item0=views, item1=views_2, item2=views_3)
boolean = BoolSelector(false)  # graph input
# note: - Elements hide/unhide in given view. Default value is true(hide).
hideUnHideElement = Quasar.ElementGraphics.HideUnHideElement(Elements=select_model_elements, Views=create, HideUnhide=boolean)
