# Dynamo custom node CustomCheckboxSelection.dyf (Dynamo 2.0.2.6826)
# category: Quasar.CustomTools
# Create checkboxes  with input list and select items.

AList = Input(AList: var[]..[])  # a list input
python_script = Python(IN[0]=AList)
# ---------- python_script.python (23 lines) ----------
import clr,sys
sys.path.append(r"C:\Program Files (x86)\IronPython 2.7\Lib")

import os, System
clr.AddReference("System.Windows.Forms")
from System.Windows.Forms import Application


version = ["2.0","1.3","1.2","1.1","1.0","0.9","0.8","0.7"]

appdata = os.getenv("AppData");
qpath = r"\Dynamo\Dynamo Revit\%s\packages\Quasar\extra"

for i in version:
	if os.path.exists(os.path.join(appdata+qpath %i)):
		extra = os.path.join(appdata+qpath %i)
		sys.path.append(extra);

from quasar.winformsui import CheckedBoxListSelector

a = CheckedBoxListSelector(IN[0]);
Application.Run(a);
OUT = a.class1Result
# ----------------------------------------
Selection = Output(python_script)  # selected items
