# Dynamo custom node CustomDropdownSelection.dyf (Dynamo 2.0.2.6826)
# category: Quasar.CustomTools
# Create a dropdown with checkboxes. First input is a list and Second input is a nested list.
# Eg. {"a","b","c"} and {{1,2,3},{4,5,6},{7,8,9}}.
# It match their index. So, {1,2,3} is under dropdown "a".

Title = Input(Title: var[]..[])  # A list input
Items = Input(Items: var[]..[])  # A nested list input
python_script = Python(IN[0]=Title, IN[1]=Items)
# ---------- python_script.python (23 lines) ----------
import clr,sys
sys.path.append(r"C:\Program Files (x86)\IronPython 2.7\Lib")

import os, System
clr.AddReference("System.Windows.Forms")
from System.Windows.Forms import Application


version = ["2.0","1.3","1.2","1.1","1.0","0.9","0.8","0.7"]

appdata = os.getenv("AppData");
qpath = r"\Dynamo\Dynamo Revit\%s\packages\Quasar\extra"

for i in version:
	if os.path.exists(os.path.join(appdata+qpath %i)):
		extra = os.path.join(appdata+qpath %i)
		sys.path.append(extra);

from quasar.winformsui import ComboCheckboxListSelector

a = ComboCheckboxListSelector(IN[0],IN[1]);
Application.Run(a);
OUT = a.class2Result
# ----------------------------------------
Selection = Output(python_script)  # Selected items
