# Dynamo custom node ElementActiveViewByCategory.dyf (Dynamo 1.3.4.6666)
# category: Quasar.ElementUtility
# Collect all elements in active view by it's category.

Category = Input()  # "_Category"; Category
python_script = Python(IN[0]=Category)
# ---------- python_script.python (26 lines) ----------
# dynamo version - 1.3.3
# author - min.naung https://twentytwo.space/
import clr,System
clr.AddReference("RevitAPI")
clr.AddReference("RevitServices")
from Autodesk.Revit.DB import *
from RevitServices.Persistence import DocumentManager
# document
doc = DocumentManager.Instance.CurrentDBDocument
# category input
category = UnwrapElement(IN[0])
# all BuiltInCategory object
builtInCategories = System.Enum.GetValues(BuiltInCategory)

# check matching id to collect BIC object
for bic in builtInCategories:
	# if match
	if ElementId(bic) == category.Id:
		catObj = bic
		break
	
# collect elements
elements = FilteredElementCollector(doc, doc.ActiveView.Id).OfCategory(catObj).ToElements()

# output
OUT = elements
# ----------------------------------------
ActiveViewElements = Output(python_script)  # return elements
