# Dynamo custom node ExportImage.dyf (Dynamo 1.3.4.6666)
# category: Quasar.ViewUtility
# Views export as images with the default settings.

ViewToExport = Input()  # single view or a list of views to export
imageExportor = Python(IN[0]=ViewToExport)
# ---------- imageExportor.python (80 lines) ----------
# dynamo version - 1.3.4
# author - min.naung https://twentytwo.space

# import modules
import clr,sys,System
clr.AddReference("RevitAPI")
clr.AddReference("RevitServices")
# import classes
from System.Collections.Generic import List
from Autodesk.Revit.DB import *
from RevitServices.Persistence import DocumentManager
from RevitServices.Transactions import TransactionManager

# add ipy library path
sys.path.append("C:\Program Files (x86)\IronPython 2.7\Lib")
# os module import
import os
# current document
doc = DocumentManager.Instance.CurrentDBDocument
# current working dir
output_path = os.path.dirname(doc.PathName)
# if cwd is none (file have not save yet)
# get desktop path instead
if not os.path.exists(output_path):
	output_path = os.path.join(os.path.join(os.environ['USERPROFILE']), 'Desktop') 

# doc name
doc_name = os.path.basename(doc.PathName)
# filenames with project name prefix
filePath = os.path.join(output_path,doc_name)

# input views
views = IN[0]

# create unwrap list
if not isinstance(views,list):	
	views = UnwrapElement([views])
else:
	views = UnwrapElement(views)

# element's id list
ids = [v.Id for v in views]

# ids list to .net List
viewIds = List[ElementId](ids)

# transaction start
TransactionManager.Instance.EnsureInTransaction(doc)

# image export options constructor
ieo = ImageExportOptions()
# export range (exporting amount of view(s))  
ieo.ExportRange = ExportRange.SetOfViews
ieo.SetViewsAndSheets(viewIds)
# filepath
ieo.FilePath = filePath
# File type for exported HLR and wireframe views
ieo.HLRandWFViewsFileType = ImageFileType.PNG
# image resolution
ieo.ImageResolution = ImageResolution.DPI_300
# fit direction
ieo.FitDirection = FitDirectionType.Horizontal
# pixelsize
ieo.PixelSize = 1200
# file type for exported shadow views
ieo.ShadowViewsFileType = ImageFileType.PNG
# zoom type
ieo.ZoomType = ZoomFitType.FitToPage

# export image
doc.ExportImage(ieo)

# transaction done
TransactionManager.Instance.TransactionTaskDone()

# get exported images paths
images_fullpath = [filePath + ieo.GetFileName(doc,id) + "."+ieo.HLRandWFViewsFileType.ToString() for id in ids]

# output images fullpath
OUT = images_fullpath
# ----------------------------------------
ImageFiles = Output(imageExportor)  # image file path(s)
