# Dynamo custom node MaterialCleanup.dyf (Dynamo 2.0.2.6826)
# category: Quasar.ElementUtility
# Select materials from check list box and remove from the document.

materials_names_ids = Python()
# ---------- materials_names_ids.python (32 lines) ----------
# dynamo version - 1.3.2
#(should be fine with 1.3.x or 2.x.x versions too)

import clr

clr.AddReference('RevitAPI')
clr.AddReference("RevitServices")

from Autodesk.Revit.DB import *
from Autodesk.Revit.DB.Structure import *

from RevitServices.Persistence import DocumentManager
from RevitServices.Transactions import TransactionManager

doc = DocumentManager.Instance.CurrentDBDocument

names, ids = [], []


# collect parameters
materials = FilteredElementCollector(doc).OfCategory(BuiltInCategory.OST_Materials).ToElements()

for i in materials:
	names.append(i.Name)
	ids.append(i.Id)
# start transaction
#TransactionManager.Instance.EnsureInTransaction(doc)

# end transaction				
#TransactionManager.Instance.TransactionTaskDone()

OUT = names, ids
# ----------------------------------------
code_block = CodeBlock(i=materials_names_ids) { i[0]; i[1]; }
python_script = Python(IN[0]=code_block.out0, IN[1]=code_block.out1)
# ---------- python_script.python (65 lines) ----------
# dynamo version - 1.3.2
# author - min.naung https://twentytwo.space/contact

import clr,sys
sys.path.append(r"C:\Program Files (x86)\IronPython 2.7\Lib")
import os, System

clr.AddReference("RevitAPI")
clr.AddReference("RevitServices")
from System.Collections.Generic import List
from Autodesk.Revit.DB import *
from RevitServices.Persistence import DocumentManager
from RevitServices.Transactions import TransactionManager


clr.AddReference("System.Windows.Forms")
from System.Windows.Forms import Application

version = ["2.0","1.3","1.2","1.1","1.0","0.9","0.8","0.7"]

appdata = os.getenv("AppData");
qpath = r"\Dynamo\Dynamo Revit\%s\packages\Quasar\extra"

for i in version:
	if os.path.exists(os.path.join(appdata+qpath %i)):
		extra = os.path.join(appdata+qpath %i)
		sys.path.append(extra);

doc = DocumentManager.Instance.CurrentDBDocument
# elements display names in listbox
names = IN[0]
# ids to removed from doc
ids = IN[1]


# names and ids dictionary 
names_ids_dict = {k:v for k,v in zip(names,ids)}

from quasar.winformsui import CheckedBoxListSelector




# instantiate class
ui = CheckedBoxListSelector(sorted(names))
# run class
Application.Run(ui)
# extract selected value
selected = ui.class1Result


# dot-net elementId list
remove_ids = List[ElementId]([names_ids_dict[i] for i in selected]);
remove_names = sorted(selected)

# transaction start
TransactionManager.Instance.EnsureInTransaction(doc)

for i in remove_ids:
	doc.Delete(i)

# transaction done			
TransactionManager.Instance.TransactionTaskDone()

OUT = remove_names
# ----------------------------------------
RemovedMaterialNames = Output(python_script)
