# Dynamo graph transfer-view-template-and-filters.dyn (Dynamo 2.0.1.5055)

# group: GetLinkDocument
# note: Each list includes [DocumentName, Document]
python_script = Python()
# ---------- python_script.python (15 lines) ----------
# dynamo version - 1.3.0 
# author - min.naung@mgjean https://twentytwopaths.wordpress.com/contact/


import clr
clr.AddReference("RevitAPI")
clr.AddReference("RevitServices")

from Autodesk.Revit.DB import *
from RevitServices.Persistence import DocumentManager

doc = DocumentManager.Instance.CurrentDBDocument;
link_docs = FilteredElementCollector(doc).OfClass(RevitLinkInstance);

OUT = [[i.Name.split(":")[0],i.GetLinkDocument()] for i in link_docs];
# ----------------------------------------

code_block = CodeBlock(i=python_script) { i[0][1]; }
boolean = BoolSelector(true)  # graph input
# note: ** Quasar Package Sample File **
# note: - Transfer View Templates from a link document to current document with or without associate filters(including override settings). Default include filters.
transferViewTemplateAndFilter = Quasar.ViewUtility.TransferViewTemplateAndFilter(LinkDocument=code_block, IsIncludeFilters=boolean)
