# Dynamo graph get-builtin-category-object.dyn (Dynamo 1.3.2.2480)

categories = Categories("Levels")
categories_2 = Categories("Grids")
create = List.Create(categories, categories_2)
getBuiltInCategory = Custom[GetBuiltInCategory](Category=create)  # Collect built-in category object and id by category
