# Dynamo graph elements-3dviews-from-isolated-category.dyn (Dynamo 1.3.2.2480)

number_slider = DoubleSlider(100, range=100..300 step 10)
# note: IN[0] = SectionBox offset from element ( Unit : millimeters)
python_scripts = Python(IN[0]=number_slider)
# ---------- python_scripts.python (86 lines) ----------
# dynamo version - 1.3.0
# author - mgjean
import clr
import System
clr.AddReference("RevitAPI")
clr.AddReference("RevitServices")

import RevitServices
from RevitServices.Persistence import DocumentManager
from RevitServices.Transactions import TransactionManager
from Autodesk.Revit.DB import *

doc = DocumentManager.Instance.CurrentDBDocument

# offset from section box (mm)
offset = IN[0]/304.8

# output list
result =[]

# collect filtered elements by category
elements = FilteredElementCollector(doc,doc.ActiveView.Id).WhereElementIsNotElementType().ToElements()


def crop_box(bbox, offset):
	# modify x,y,z point of bbox
	minX = bbox.Min.X - offset
	minY = bbox.Min.Y - offset
	minZ = bbox.Min.Z - offset
	maxX = bbox.Max.X + offset
	maxY = bbox.Max.Y + offset
	maxZ = bbox.Max.Z + offset
	# create new bbox
	newbox = BoundingBoxXYZ()
	newbox.Min = XYZ(minX,minY, minZ)
	newbox.Max = XYZ(maxX, maxY, maxZ)
	return newbox

# collect view type in document
viewTypes = FilteredElementCollector(doc).OfClass(ViewFamilyType)
#loop view types
for i in viewTypes:
	# floor plane view type
	if i.ViewFamily == ViewFamily.ThreeDimensional:
		# get type id
		viewTypeId = i.Id
		break

# start Transaction
TransactionManager.Instance.EnsureInTransaction(doc)
increment = 1
for elem in elements:
	viewName = elem.Symbol.FamilyName

	# create new bbox by current bbox and offset
	bbox = crop_box(elem.BoundingBox[doc.ActiveView],offset)
	
	# create 3D View
	view = View3D.CreateIsometric(doc, viewTypeId)
	try:
		# set view name
		view.Name = viewName
	except:
		view.Name = viewName +" ("+ str(increment)+")"
		increment+=1
	# set sectionbox to bbox
	view.SetSectionBox(bbox)
	# set cropbox active
	view.CropBoxActive = True
	# set cropbox visibility
	view.CropBoxVisible = True
	# set view scale
	view.Scale = 25
	# set detail level to fine
	view.DetailLevel = ViewDetailLevel.Fine
	# set detail style to realistic
	view.DisplayStyle = DisplayStyle.Realistic

	# append it to results
	result.append(view)
	
# end Transaction
TransactionManager.Instance.TransactionTaskDone()

# output results
OUT = elements
# ----------------------------------------
