# Dynamo graph legend-v2.dyn (Dynamo 1.3.2.2480)

# note: Each list includes [DocumentName, Document]
python_script = Python()
# ---------- python_script.python (15 lines) ----------
# dynamo version - 1.3.0 
# author - min.naung@mgjean https://twentytwopaths.wordpress.com/contact/


import clr
clr.AddReference("RevitAPI")
clr.AddReference("RevitServices")

from Autodesk.Revit.DB import *
from RevitServices.Persistence import DocumentManager

doc = DocumentManager.Instance.CurrentDBDocument;
link_docs = FilteredElementCollector(doc).OfClass(RevitLinkInstance);

OUT = [[i.Name.split(":")[0],i.GetLinkDocument()] for i in link_docs];
# ----------------------------------------
code_block = CodeBlock(i=python_script) { i[0][1]; }
linkLegendViews = Python(IN[0]=code_block)
# ---------- linkLegendViews.python (25 lines) ----------
# dynamo version - 1.3.2
# author - min.naung/mgjean https://twentytwo.space/contact

# dynamo version 1.3.2
import clr
clr.AddReference('RevitAPI')
clr.AddReference("RevitServices")
import System
from Autodesk.Revit.DB import *
from RevitServices.Persistence import DocumentManager
from RevitServices.Transactions import TransactionManager
from System.Collections.Generic import List
# get current document 
doc = DocumentManager.Instance.CurrentDBDocument

# a link document
linkdoc = IN[0]

# collect view from link document
collector = FilteredElementCollector(linkdoc).OfClass(View).ToElements()
# collect legend view
views = [v for v in collector if v.ViewType== ViewType.Legend]

# copied views
OUT = views
# ----------------------------------------
copyView = Python(IN[0]=code_block, IN[1]=linkLegendViews)
# ---------- copyView.python (41 lines) ----------
# dynamo version - 1.3.2
# author - min.naung/mgjean https://twentytwo.space/contact

import clr
clr.AddReference('RevitAPI')
clr.AddReference("RevitServices")
import System
from Autodesk.Revit.DB import *
from RevitServices.Persistence import DocumentManager
from RevitServices.Transactions import TransactionManager
from System.Collections.Generic import List
# get current document 
doc = DocumentManager.Instance.CurrentDBDocument

# a link document
linkdoc = IN[0]

# legend views from link document
if isinstance(IN[1],list):
	link_legend_views = UnwrapElement(IN[1])
else:
	link_legend_views = UnwrapElement([IN[1]])

# create id list
views_ids = [v.Id for v in link_legend_views]

# make dotNet ElementId list
dotList = List[ElementId](views_ids)

# transaction start
TransactionManager.Instance.EnsureInTransaction(doc)

# copy legend view to current document
# this will copy only view without elements
copy_views = ElementTransformUtils.CopyElements(linkdoc,dotList,doc,Transform.Identity,CopyPasteOptions())

# transaction end
TransactionManager.Instance.TransactionTaskDone()

# copied views
OUT = [doc.GetElement(i) for i in copy_views]
# ----------------------------------------
transferLegend = Python(IN[0]=code_block, IN[1]=linkLegendViews, IN[2]=copyView)
# ---------- transferLegend.python (57 lines) ----------
# dynamo version - 1.3.2
# author - min.naung/mgjean https://twentytwo.space/contact


import clr
clr.AddReference('RevitAPI')
clr.AddReference("RevitServices")
import System
from Autodesk.Revit.DB import *
from RevitServices.Persistence import DocumentManager
from RevitServices.Transactions import TransactionManager
from System.Collections.Generic import List
# get current document 
doc = DocumentManager.Instance.CurrentDBDocument


linkdoc = IN[0]
link_legend = UnwrapElement(IN[1])
doc_legend = UnwrapElement(IN[2])
view_names = []

result = []

TransactionManager.Instance.EnsureInTransaction(doc)

for view , view_copy in zip(link_legend,doc_legend):
	
	view_names.append(str(view_copy.ViewName))
	
	elements = FilteredElementCollector(linkdoc,view.Id).ToElements()
	element_ids = []
	for e in elements:
		try:
			element_ids.append(e.Id)
		except:
			continue
	elemIdList = List[ElementId](element_ids)
	copy_element = ElementTransformUtils.CopyElements(view,elemIdList,view_copy,Transform.Identity,CopyPasteOptions())
	doc.Delete(view_copy.Id)

views = FilteredElementCollector(doc).OfClass(View).ToElements()
legends = [v for v in views if v.ViewType == ViewType.Legend]
res = []
for i in legends:
	for j in view_names:
		if j[-1].isdigit():
			if j[:-1] == str(i.ViewName)[:-1]:
				i.ViewName = j
				res.append(i)				
		else:			
			if j[:-1] == str(i.ViewName)[:-2]:
				i.ViewName = j
				res.append(i)
			
TransactionManager.Instance.TransactionTaskDone()

OUT = res
# ----------------------------------------
