# Dynamo graph transfer-legend.dyn (Dynamo 1.3.2.2480)

linkDocument = Python()
# ---------- linkDocument.python (15 lines) ----------
# dynamo version - 1.3.0 
# author - min.naung@mgjean https://twentytwopaths.wordpress.com/contact/


import clr
clr.AddReference("RevitAPI")
clr.AddReference("RevitServices")

from Autodesk.Revit.DB import *
from RevitServices.Persistence import DocumentManager

doc = DocumentManager.Instance.CurrentDBDocument;
link_docs = FilteredElementCollector(doc).OfClass(RevitLinkInstance);

OUT = [[i.Name.split(":")[0],i.GetLinkDocument()] for i in link_docs];
# ----------------------------------------
code_block = CodeBlock(i=linkDocument) { i[1][1]; }
transferLegend = Custom[TransferLegend](LinkDocument=code_block)  # Select and copy legend views from a link document file.
