# Dynamo graph transfer-view-template-and-filters.dyn (Dynamo 1.3.2.2480)

# group: GetLinkDocument
# note: Each list includes [DocumentName, Document]
python_script = Python()
# ---------- python_script.python (15 lines) ----------
# dynamo version - 1.3.0 
# author - min.naung@mgjean https://twentytwopaths.wordpress.com/contact/


import clr
clr.AddReference("RevitAPI")
clr.AddReference("RevitServices")

from Autodesk.Revit.DB import *
from RevitServices.Persistence import DocumentManager

doc = DocumentManager.Instance.CurrentDBDocument;
link_docs = FilteredElementCollector(doc).OfClass(RevitLinkInstance);

OUT = [[i.Name.split(":")[0],i.GetLinkDocument()] for i in link_docs];
# ----------------------------------------

code_block = CodeBlock(i=python_script) { i[0][1]; }
boolean = BoolSelector(true)
transferViewTemplateAndFilter = Quasar.RevitNodes.TransferViewTemplateAndFilter(code_block, boolean)
