# Dynamo graph hide-unhide-elements.dyn (Dynamo 1.3.2.2480)

select_model_elements = DSModelElementsSelection()  # 2 picked in the model
views = Views("Level 2")
views_2 = Views("North")
views_3 = Views("South")
create = List.Create(views, views_2, views_3)
boolean = BoolSelector(false)
hideUnHideElement = Quasar.RevitNodes.HideUnHideElement(select_model_elements, create, boolean)
