# Dynamo graph center-room.dyn (Dynamo 1.3.2.2480)

categories = Categories("Rooms")
all_elements_of_category = ElementsOfCategory(categories)
centerRoom = Quasar.RoomUtility.CenterRoom(all_elements_of_category)
