# Dynamo graph create-wallsweep.dyn (Dynamo 1.3.2.2480)

select_model_elements = DSModelElementsSelection()
select_model_element = DSModelElementSelection()
getElementType = Quasar.RevitNodes.GetElementType(select_model_element)
code_block = CodeBlock(i=getElementType) { i[0]; }
code_block_2 = CodeBlock { "Reveal"; }
code_block_3 = CodeBlock { false; }
code_block_4 = CodeBlock { 1000; }
createWallSweep = Quasar.RevitNodes.CreateWallSweep(select_model_elements, code_block, code_block_2, code_block_3, code_block_4)  # frozen
customCheckboxSelection = Custom[CustomCheckboxSelection]()  # Create checkboxes with input list and select items.; unwired: AList
