# Dynamo graph custom-dropdown-selection.dyn (Dynamo 1.3.2.2480)

code_block = CodeBlock { {"Alphabet","Number"}; }
code_block_2 = CodeBlock { {"a".."e",1..5}; }
customDropdownSelection = Custom[CustomDropdownSelection](Title=code_block, Items=code_block_2)  # Create a dropdown with checkboxes. First input is a list and Second input is a nested list. Eg. {"a","b","c"} and {{1,2,3},{4,5,6},{7,8,9}}. It match their index. So, {1,2,3} is under dropdown "a".
