# Dynamo graph elevations-byrooms.dyn (Dynamo 1.3.2.2480)

categories = Categories("Rooms")
all_elements_of_category = ElementsOfCategory(categories)
views = Views("Level 1")
number_slider = DoubleSlider(600, range=-1000..2000 step 10)
elevationInRoom = Quasar.ViewUtility.ElevationInRoom(all_elements_of_category, views, number_slider)
