# Dynamo graph familyinstance-typename.dyn (Dynamo 1.3.2.2480)

code_block = CodeBlock { {"1525 x 762mm Student","1525 x 762mm"}; }
# note: Quasar Package
familyInstanceByTypeName = Custom[FamilyInstanceByTypeName](FamilyTypeName=code_block)  # A type name or comma separated type names to collect family instances.
code_block_2 = CodeBlock { "1525 x 762mm Student,1525 x 762mm"; }
familyInstanceByTypeName_2 = Custom[FamilyInstanceByTypeName](FamilyTypeName=code_block_2)
