# Dynamo graph floorplan-byrooms.dyn (Dynamo 1.3.2.2480)

levels = Levels("Level 1")
categories = Categories("Rooms")
all_elements_of_category = ElementsOfCategory(categories)
name = Room.Name(all_elements_of_category)
number_slider = DoubleSlider(600, range=-1000..2000 step 10)
floorPlanViewByRoom = Quasar.RevitNodes.FloorPlanViewByRoom(levels, all_elements_of_category, name, number_slider)
