# Dynamo graph get-builtin-params-names.dyn (Dynamo 1.3.2.2480)

select_model_element = DSModelElementSelection()  # 1 picked in the model
code_block = CodeBlock { {"Sill Height","Head Height"}; }
getBuiltInParameterName = Quasar.RevitNodes.GetBuiltInParameterName(select_model_element, code_block)
