# Dynamo graph get-set-parameters.dyn (Dynamo 1.3.2.2480)

select_model_element = DSModelElementSelection()  # 1 picked in the model
select_model_element_2 = DSModelElementSelection()  # 1 picked in the model
code_block = CodeBlock { {"Comments","Department","Occupancy"}; }
getAndSetParams = Quasar.RevitNodes.GetAndSetParams(select_model_element, select_model_element_2, code_block)
