# Dynamo graph massings-by-rooms.dyn (Dynamo 1.3.2.2480)

categories = Categories("Rooms")
all_elements_of_category = ElementsOfCategory(categories)
massingsByRooms = Quasar.RoomUtility.MassingsByRooms(all_elements_of_category)
