# Dynamo graph polygons-by-curves.dyn (Dynamo 1.3.2.2480)

origin = Point.Origin()
byCenterPointRadius = Circle.ByCenterPointRadius(centerPoint=origin)
code_block = CodeBlock { 2; }
byCoordinates = Point.ByCoordinates(x=code_block, y=code_block)
byCenterPointRadius_2 = Circle.ByCenterPointRadius(centerPoint=byCoordinates)
create = List.Create(byCenterPointRadius, byCenterPointRadius_2)
code_block_2 = CodeBlock { {8,6}; }
polygonsByCurves = Custom[PolygonsByCurves](Curve=create, NumberOfSide=code_block_2)  # Create polygon by curve and number of side, returns value [ polygon, [line-segments] ]
