# Dynamo graph room-solid-geometry.dyn (Dynamo 1.3.2.2480)

categories = Categories("Rooms")
all_elements_of_category = ElementsOfCategory(categories)
roomSolidGeometry = Custom[RoomSolidGeometry](Rooms=all_elements_of_category)  # Collect dynamo geometry and revit geometry from room.
