# Dynamo graph rooms-collector.dyn (Dynamo 1.3.2.2480)

# group: RoomsCollector
# note: **NOTE
# IN[0] accepted; if not IN[0]; collect all rooms;
# note: Returns;
# OUT[0] = Placed rooms;
# OUT[1] = Unplaced rooms;
# OUT[2] = Not Enclosed rooms;
# OUT[3] = Redundant rooms;

categories = Categories("Rooms")
all_elements_of_category = ElementsOfCategory(categories)
code_block = CodeBlock(i=all_elements_of_category) { i[2..4]; }
roomCollector = Custom[RoomCollector](Rooms=code_block)  # Collect rooms by their status.
