# Dynamo graph DeleteByCategory.dyn (Dynamo 1.3.2.2480)

categories = Categories("Windows")
python_script = Python(IN[0]=categories)
# ---------- python_script.python (47 lines) ----------
import clr
clr.AddReference('RevitAPI')
clr.AddReference("RevitServices")
import System
from Autodesk.Revit.DB import *
from RevitServices.Persistence import DocumentManager
from RevitServices.Transactions import TransactionManager

# get current document 
doc = DocumentManager.Instance.CurrentDBDocument

# input category
cat = IN[0]

# output list
res =[]

# get category object
obj = System.Enum.ToObject(BuiltInCategory, cat.Id)

# create category filter by category object
filter = ElementCategoryFilter(obj)

# collect filtered elements by category
elements = FilteredElementCollector(doc).WherePasses(filter).WhereElementIsNotElementType().ToElements()

# transaction start
TransactionManager.Instance.EnsureInTransaction(doc)

# loop elements
for elem in elements:
	try:
		# delete from document
		r = doc.Delete(elem.Id)
		# deleted id append to output
		# after deleted its return as a elementId list 
		# what we want is elementId only, so use [0]
		res.append(r[0])
	except:
		# error message append to output
		res.append("ElementID %s can't delete." %elem.Id)
		continue
	
# transaction end
TransactionManager.Instance.TransactionTaskDone()
# output result
OUT = res
# ----------------------------------------
python_script_2 = Python()  # unwired: IN[0]
# ---------- python_script_2.python (18 lines) ----------
import clr
clr.AddReference('RevitAPI')
clr.AddReference("RevitServices")
import System
from Autodesk.Revit.DB import *
from RevitServices.Persistence import DocumentManager
from RevitServices.Transactions import TransactionManager

# get current document 
doc = DocumentManager.Instance.CurrentDBDocument



# collect detail groups
elements = FilteredElementCollector(doc).OfCategory(BuiltInCategory.OST_IOSDetailGroups).ToElements()

# output result
OUT = elements
# ----------------------------------------
