# Dynamo graph DeleteElements.dyn (Dynamo 1.3.2.2480)

python_script = Python()
# ---------- python_script.python (18 lines) ----------
import clr
clr.AddReference('RevitAPI')
clr.AddReference("RevitServices")
import System
from Autodesk.Revit.DB import *
from RevitServices.Persistence import DocumentManager
from RevitServices.Transactions import TransactionManager

# get current document 
doc = DocumentManager.Instance.CurrentDBDocument



# collect detail groups
elements = FilteredElementCollector(doc).OfCategory(BuiltInCategory.OST_IOSDetailGroups).ToElements()

# output result
OUT = elements
# ----------------------------------------
deleteElements = Python(IN[0]=python_script)
# ---------- deleteElements.python (42 lines) ----------
import clr
clr.AddReference('RevitAPI')
clr.AddReference("RevitServices")
import System
from Autodesk.Revit.DB import *
from RevitServices.Persistence import DocumentManager
from RevitServices.Transactions import TransactionManager

# get current document 
doc = DocumentManager.Instance.CurrentDBDocument

# input category
if isinstance(IN[0],list):
	elements = UnwrapElement(IN[0])
else:
	elements = UnwrapElement([IN[0]])

# output list
res =[]


# transaction start
TransactionManager.Instance.EnsureInTransaction(doc)

# loop elements
for elem in elements:
	try:
		# delete from document
		r = doc.Delete(elem.Id)
		# deleted id append to output
		# after deleted its return as a elementId list 
		# what we want is elementId only, so use [0]
		res.append(r[0])
	except:
		# error message append to output
		res.append("ElementID %s can't delete." %elem.Id)
		continue
	
# transaction end
TransactionManager.Instance.TransactionTaskDone()
# output result
OUT = res
# ----------------------------------------
