# Dynamo graph DirectShape.dyn (Dynamo 1.3.2.2480)

categories = Categories("Rooms")
all_elements_of_category = ElementsOfCategory(categories)
name = Element.Name(all_elements_of_category)
categories_2 = Categories("GenericModel")
geometry = Element.Geometry(all_elements_of_category)
code_block = CodeBlock(x=geometry) { Flatten(x); }
python_script = Python(IN[0]=all_elements_of_category)
# ---------- python_script.python (40 lines) ----------
import clr
clr.AddReference('ProtoGeometry')
clr.AddReference('RevitAPI')
clr.AddReference('RevitServices')
clr.AddReference("RevitNodes")

import System,Revit
clr.ImportExtensions(Revit.Elements)
clr.ImportExtensions(Revit.GeometryConversion)
from Autodesk.DesignScript.Geometry import *
from Autodesk.Revit.DB import *
from RevitServices.Persistence import DocumentManager
from RevitServices.Transactions import TransactionManager

doc = DocumentManager.Instance.CurrentDBDocument

elems = IN[0];

MassBICObj = System.Enum.ToObject(BuiltInCategory,BuiltInCategory.OST_Mass)

objId = ElementId(MassBICObj)
directShapeType = DirectShapeType.Create(doc,"ForRoom",objId)

if not isinstance(elems,list):
	elems = UnwrapElement([elem])
else:
	elems = UnwrapElement(elems)

res = []
names = []

for e in elems:
	name = e.LookupParameter("Name").AsString()
	number = e.LookupParameter("Number").AsString()
	geoelem = e.GetGeometryObjectFromReference(Reference(e))
	geoobj = geoelem.GetEnumerator();
	for obj in geoobj:	
		res.append(obj.ToProtoType())
		names.append(number+"_"+name)
OUT = res,names,objId,directShapeType
# ----------------------------------------
builtInCategoryAndID = Python()
# ---------- builtInCategoryAndID.python (13 lines) ----------
import clr,System
clr.AddReference('RevitAPI')
from Autodesk.Revit.DB import *

builtInCategories = System.Enum.GetValues(BuiltInCategory)
res = []
for bic in builtInCategories:
	try:
		res.append([builtInCategories,ElementId(bic)])
	except:
		pass
		
OUT = res
# ----------------------------------------
