# Dynamo graph DuplicateSheetsWithViews.dyn (Dynamo 1.3.2.2480)

# note: SelectSheetByNumber
python_script = Python()
# ---------- python_script.python (146 lines) ----------
# dynamo version - 1.3.2
# author - min.naung/mgjean https://twentytwo.space/contact

import clr,sys
sys.path.append(r"C:\Program Files (x86)\IronPython 2.7\Lib")
import os, System

clr.AddReference("RevitAPI")
clr.AddReference("RevitServices")

from Autodesk.Revit.DB import *
from RevitServices.Persistence import DocumentManager
from RevitServices.Transactions import TransactionManager

version = ["2.0","1.3","1.2","1.1","1.0","0.9","0.8","0.7"]

appdata = os.getenv("AppData");
qpath = r"\Dynamo\Dynamo Revit\%s\packages\Quasar"

for i in version:
	if os.path.exists(os.path.join(appdata+qpath %i)):
		ipath = os.path.join(appdata+qpath %i)

clr.AddReference("System.Windows.Forms")
clr.AddReference("System.Drawing")


from System.Collections.Generic import List
from System.Windows.Forms import (Application, Button, ComboBox, CheckBox, Form as _Form,
CheckedListBox,Padding,FormBorderStyle, SelectionMode,Label, MessageBox,MessageBoxButtons, MessageBoxIcon)
from System.Drawing import (Font as _Font, Icon as _Icon, Point as _Point, Size as _Size,FontStyle)

doc = DocumentManager.Instance.CurrentDBDocument

# collect view from link document
collector = FilteredElementCollector(doc).OfClass(ViewSheet).ToElements()

# sheet number
sheet_nums = [v.LookupParameter("Sheet Number").AsString() for v in collector]

sheets_nums_dict = {k:v for k,v in zip(sheet_nums,collector)}


class CheckedBoxListSelector(_Form):
	"""Checked Box List Selector"""
	
	def __init__(self,inputList):
		#self.Icon = _Icon(r"%s\extra\icon.ico" %ipath)
		self.Size = _Size(370,435)
		self.Text = "Quasar"
		self.class1Result = [];
		self.filtersInclude = "";

		# fonts
		self.gsmt_11r = _Font("Georgia", 10)
		self.gsmt_10r = _Font("Georgia",9)

		# label
		self.label = Label()
		self.label.Text = "Select View Template: "
		self.label.Font = self.gsmt_11r
		self.label.Location = _Point(30,10)
		self.label.Size = _Size(220,28)
		self.Controls.Add(self.label)

		# checklist box
		self.lstbox = CheckedListBox()
		self.lstbox.Items.AddRange(tuple(inputList))
		self.lstbox.Font = self.gsmt_10r
		# padding
		self.lstbox.Padding = Padding(30)
		# select one click
		self.lstbox.CheckOnClick = True

		self.FormBorderStyle = FormBorderStyle.FixedDialog
		self.MaximizeBox = False;
		self.ManimizeBox = False;
		self.lstbox.Location = _Point(30,40)
		self.lstbox.Size = _Size(290,280)

		# auto horizontal scrollbar
		self.lstbox.HorizontalScrollbar = True
		self.Controls.Add(self.lstbox)
		

		# select all btn
		self.btn_all = Button()
		self.btn_all.Text = "Select All"
		self.btn_all.Font = self.gsmt_10r
		self.btn_all.Size = _Size(95,25)
		self.btn_all.Location = _Point(30,350)
		self.Controls.Add(self.btn_all)

		# select none btn
		self.btn_none = Button()
		self.btn_none.Text = "Select None"
		self.btn_none.Font = self.gsmt_10r
		self.btn_none.Size = _Size(95,25)
		self.btn_none.Location = _Point(225,350)
		self.Controls.Add(self.btn_none)

		# ok btn
		self.btn = Button()
		self.btn.Text = "OK"
		self.btn.Font = self.gsmt_10r
		self.btn.Size = _Size(80,25)
		self.btn.Location = _Point(135,350)
		self.Controls.Add(self.btn)

		# events

		self.btn_all.Click += self.click_all
		self.btn_none.Click += self.click_none
		self.btn.Click += self.click_ok 

		# pop up from center
		self.CenterToScreen()
	

	def click_ok(self, sender, event):
		#global res
		if len(self.lstbox.Items) < 1:
			self.Close()
		if len(self.lstbox.CheckedItems) < 1:
			return MessageBox.Show("No element selected!", "Quasar Info Box", MessageBoxButtons.OK, MessageBoxIcon.Asterisk)
		
		self.class1Result = self.lstbox.CheckedItems;
		
		return self.Close();			

	def click_all(self, sender, event):
		for i in range(len(self.lstbox.Items)):
			self.lstbox.SetItemChecked(i,True)

	def click_none(self, sender, event):
		for i in range(len(self.lstbox.Items)):
			self.lstbox.SetItemChecked(i,False);

# instantiate class
ui = CheckedBoxListSelector(sheet_nums)
# run class
Application.Run(ui)
# extract selected value
selected = ui.class1Result

OUT = [sheets_nums_dict[i] for i in selected]
# ----------------------------------------
code_block = CodeBlock { {"DB ROOM A", "DB ROOM B"}; }
code_block_2 = CodeBlock { {"A001","A002"}; }
family_types = FamilyTypes("A1 metric:A1 metric")
# note: IN[0] = existing sheets to duplicate;
# IN[1] = names for new sheets;
# IN[2] = numbers for new sheets;
# IN[3] = titleblock family for new sheets;
python_script_2 = Python(IN[0]=python_script, IN[1]=code_block, IN[2]=code_block_2, IN[3]=family_types)
# ---------- python_script_2.python (57 lines) ----------
import clr
clr.AddReference('RevitAPI')
clr.AddReference("RevitServices")
clr.AddReference("RevitNodes")
import RevitServices
import Revit
import Autodesk
from Autodesk.Revit.DB import *

from RevitServices.Persistence import DocumentManager
from RevitServices.Transactions import TransactionManager

doc = DocumentManager.Instance.CurrentDBDocument

sheets = UnwrapElement(IN[0])
names = IN[1]
numbers = IN[2]
titleblock = UnwrapElement(IN[3])

new_sheets = []
out = []



TransactionManager.Instance.EnsureInTransaction(doc)

for (name, number) in zip(names,numbers):
	newSheet = ViewSheet.Create(doc, titleblock.Id)	
	
	newSheet.SheetNumber = number
	newSheet.Name = name
	new_sheets.append(newSheet)


for sheet,nSheet in zip(sheets,new_sheets):	
	views = []
	vPorts = sheet.GetAllViewports()
	
	for ele in vPorts:
		ele = doc.GetElement(ele)				
		vOpt = ViewDuplicateOption.WithDetailing
				
		viewLoc = ele.GetBoxCenter()
		vptype = ele.GetTypeId()

		view = doc.GetElement(ele.ViewId)
		v = view.Duplicate(vOpt)

		newPort = Viewport.Create(doc,nSheet.Id, v, viewLoc)
		views.append(newPort)
		newPort.ChangeTypeId(vptype)
					
	out.append(views)
TransactionManager.Instance.TransactionTaskDone()	

	
OUT = out
# ----------------------------------------
