# Dynamo graph GetAllWorksets.dyn (Dynamo 1.3.2.2480)

# group: return [[name,workset],[]..[]]
python_script = Python()
# ---------- python_script.python (16 lines) ----------
import clr
clr.AddReference('RevitAPI')
from Autodesk.Revit.DB import *
import Autodesk

clr.AddReference("RevitServices")
import RevitServices
from RevitServices.Persistence import DocumentManager

doc = DocumentManager.Instance.CurrentDBDocument

# collect user created worksets
worksets = FilteredWorksetCollector(doc).OfKind(WorksetKind.UserWorkset).ToWorksets()

# return list structure [[name,workset],[]...[]]
OUT = [[i.Name,i] for i in worksets]
# ----------------------------------------
