# Dynamo graph GetBuiltInCategory.dyn (Dynamo 1.3.2.2480)

categories = Categories("Levels")
builtInCategoryAndID = Python(IN[0]=categories)
# ---------- builtInCategoryAndID.python (27 lines) ----------
import clr,System
clr.AddReference('RevitAPI')
from Autodesk.Revit.DB import *

builtInCategories = System.Enum.GetValues(BuiltInCategory)
categories_Ids_Dict = {}

categories = IN[0]

if isinstance(categories,list):
	categories = UnwrapElement(categories)
else:
	categories = UnwrapElement([categories])

result = []

# create dictionary {"id":"obj"}
for bic in builtInCategories:
	categories_Ids_Dict[ElementId(bic)] = bic
# loop category
for cate in categories:
	# get id
	id = cate.Id
	# return [[obj, id], []..[]]
	result.append([categories_Ids_Dict[id],id])

OUT = result
# ----------------------------------------
categories_2 = Categories("Grids")
create = List.Create(categories, categories_2)
