# Dynamo graph RoomToMass.dyn (Dynamo 1.3.2.2480)

categories = Categories("Rooms")
all_elements_of_category = ElementsOfCategory(categories)
python_script = Python(IN[0]=all_elements_of_category)
# ---------- python_script.python (62 lines) ----------
# dynamo version - 1.3.2'
# author - min.naung/mgjean @https://twentytwo.space/contact


import clr,System

clr.AddReference('RevitAPI')
clr.AddReference('RevitServices')

from System.Collections.Generic import List

from Autodesk.Revit.DB import *
from RevitServices.Persistence import DocumentManager
from RevitServices.Transactions import TransactionManager

doc = DocumentManager.Instance.CurrentDBDocument

elems = IN[0];

MassBICObj = System.Enum.ToObject(BuiltInCategory,BuiltInCategory.OST_Mass)

objId = ElementId(MassBICObj)

if not isinstance(elems,list):
	elems = UnwrapElement([elem])
else:
	elems = UnwrapElement(elems)

res = []

# transaction start
TransactionManager.Instance.EnsureInTransaction(doc)

for e in elems:
	name = e.LookupParameter("Name").AsString()
	number = e.LookupParameter("Number").AsString()
	# name
	elem_name = number+"_"+name
	# collect geometry element
	geoobj = e.Geometry[Options()]
	# make enum to get geometry object
	enum = geoobj.GetEnumerator();
	shape = [i for i in enum][0]
	
	# create direct shape type
	shapeType = DirectShapeType.Create(doc,elem_name,objId)
	# set shape to geometry list shape
	shapeType.SetShape([shape])
	# get dslibrary
	lib = DirectShapeLibrary.GetDirectShapeLibrary(doc)
	# add type to dslibrary
	lib.AddDefinitionType(elem_name,shapeType.Id)
	# create element by shapetype
	element = DirectShape.CreateElementInstance(doc,shapeType.Id,objId,elem_name,Transform.Identity)
	# set typeId
	element.SetTypeId(shapeType.Id)
	# append to output
	res.append(element)
# transaction end		
TransactionManager.Instance.TransactionTaskDone()

OUT = res
# ----------------------------------------
byGeometry = Custom[Springs.DirectShape.ByGeometry]()  # Convert the input geometry to DirectShape element inside the Revit document. It supports solids or surfaces. It is based on an alternative process that uses a SAT import and can produce smooth surfaces. Each created DS will have a unique type. Make sure that each input geometry has a unique name. You can either feed a single category for all geometries or a unique category for each geometry - the node's lacing is set to longest by default. The default category is Generic Models.; unwired: geometry, name
