# Dynamo graph RoomsCollector.dyn (Dynamo 1.3.2.2480)

python_script = Python()  # frozen; unwired: IN[0]
# ---------- python_script.python (144 lines) ----------
import clr,sys
sys.path.append(r"C:\Program Files (x86)\IronPython 2.7\Lib")
import os, System

clr.AddReference("RevitAPI")
clr.AddReference("RevitServices")
from Autodesk.Revit.DB import *
from RevitServices.Persistence import DocumentManager

clr.AddReference("System.Windows.Forms")
clr.AddReference("System.Drawing")


from System.Collections.Generic import List
from System.Windows.Forms import (Application, Button, ComboBox, CheckBox, Form as _Form,
CheckedListBox,Padding,FormBorderStyle, SelectionMode,Label, MessageBox,MessageBoxButtons, MessageBoxIcon)
from System.Drawing import (Font as _Font, Icon as _Icon, Point as _Point, Size as _Size,FontStyle)



class ComboCheckboxListSelector(_Form):
	"""Checked Box List Selector"""

	def __init__(self,title,items):
		
		# icon
		#self.Icon = _Icon(r"%s\extra\icon.ico" %ipath)
		self.Size = _Size(360,430)
		self.Text = "Quasar"
		self.class2Result = [];
		
		self.title = title
		self.items = items
		# fonts
		self.gsmt_11r = _Font("Georgia", 10)
		self.gsmt_10r = _Font("Georgia",9)

		# combo box
		self.cbox = ComboBox()
		self.cbox.Font = self.gsmt_11r
		self.cbox.Location = _Point(30,10)
		self.cbox.Size = _Size(280,28)
		self.cbox.Items.AddRange(tuple(title))
		self.cbox.SelectedIndex = 0;
		self.Controls.Add(self.cbox)
		
		
		
		# checklist box
		self.lstbox = CheckedListBox()
		self.lstbox.Items.AddRange(tuple(self.items[self.cbox.SelectedIndex]))
		self.lstbox.Font = self.gsmt_10r
		# padding
		self.lstbox.Padding = Padding(30)
		# select one click
		self.lstbox.CheckOnClick = True

		self.FormBorderStyle = FormBorderStyle.FixedDialog
		self.MaximizeBox = False;
		self.ManimizeBox = False;
		self.lstbox.Location = _Point(30,45)
		self.lstbox.Size = _Size(280,300)

		# auto horizontal scrollbar
		self.lstbox.HorizontalScrollbar = True
		self.Controls.Add(self.lstbox)

		# select all btn
		self.btn_all = Button()
		self.btn_all.Text = "Select All"
		self.btn_all.Font = self.gsmt_10r
		self.btn_all.Size = _Size(95,25)
		self.btn_all.Location = _Point(30,340)
		self.Controls.Add(self.btn_all)

		# select none btn
		self.btn_none = Button()
		self.btn_none.Text = "Select None"
		self.btn_none.Font = self.gsmt_10r
		self.btn_none.Size = _Size(95,25)
		self.btn_none.Location = _Point(215,340)
		self.Controls.Add(self.btn_none)

		# ok btn
		self.btn = Button()
		self.btn.Text = "OK"
		self.btn.Font = self.gsmt_10r
		self.btn.Size = _Size(80,25)
		self.btn.Location = _Point(130,340)
		self.Controls.Add(self.btn)

		# events
		self.btn_all.Click += self.click_all
		self.btn_none.Click += self.click_none
		self.btn.Click += self.click_ok 
		self.cbox.SelectedValueChanged += self.on_class_change

		# pop up from center
		self.CenterToScreen()

	def click_ok(self, sender, event):	
	
		if len(self.lstbox.CheckedItems) < 1:
			return MessageBox.Show("No element selected!", "Quasar Info Box", MessageBoxButtons.OK, MessageBoxIcon.Asterisk)
						
		self.class2Result = self.lstbox.CheckedItems
		
		return self.Close()		

	def click_all(self, sender, event):
		for i in range(len(self.lstbox.Items)):
			self.lstbox.SetItemChecked(i,True)

	def click_none(self, sender, event):
		for i in range(len(self.lstbox.Items)):
			self.lstbox.SetItemChecked(i,False)
	
	def on_class_change(self, sender, event):
		self.lstbox.Items.Clear();
		self.lstbox.Items.AddRange(tuple(self.items[self.cbox.SelectedIndex]))


doc = DocumentManager.Instance.CurrentDBDocument

rooms = FilteredElementCollector(doc).OfCategory(BuiltInCategory.OST_Rooms).ToElements()

normal,notplace,notenclosed,redundant = [],[],[],[]
seg,loc = [],[]
for r in rooms:
	s = r.GetBoundarySegments(SpatialElementBoundaryOptions())
	l = r.Location
	seg.append(s)
	loc.append(l)
	if l == None:
		notplace.append(r)
	elif len(s)<1:
		notenclosed.append(r)
	elif r.Area == 0:
		redundant.append(r)
	else:
		normal.append(r)


OUT = normal,notplace,notenclosed,redundant
# ----------------------------------------
name = Element.Name(python_script)
python_script_2 = Python()  # unwired: IN[0]
# ---------- python_script_2.python (147 lines) ----------
import clr,sys
sys.path.append(r"C:\Program Files (x86)\IronPython 2.7\Lib")
import os, System

clr.AddReference("RevitAPI")
clr.AddReference("RevitServices")
from Autodesk.Revit.DB import *
from RevitServices.Persistence import DocumentManager

clr.AddReference("System.Windows.Forms")
clr.AddReference("System.Drawing")


from System.Collections.Generic import List
from System.Windows.Forms import (Application, Button, ComboBox, CheckBox, Form as _Form,
CheckedListBox,Padding,FormBorderStyle, SelectionMode,Label, MessageBox,MessageBoxButtons, MessageBoxIcon)
from System.Drawing import (Font as _Font, Icon as _Icon, Point as _Point, Size as _Size,FontStyle)



class ComboCheckboxListSelector(_Form):
	"""Checked Box List Selector"""

	def __init__(self,title,items):
		
		# icon
		#self.Icon = _Icon(r"%s\extra\icon.ico" %ipath)
		self.Size = _Size(360,330)
		self.Text = "Quasar"
		self.class2Result = [];
		
		self.title = title
		self.items = items
		# fonts
		self.gsmt_11r = _Font("Georgia", 10)
		self.gsmt_10r = _Font("Georgia",9)
		
		# title label
		self.lab = Label()
		self.lab.Text = "Select Room By Status"
		self.lab.Location = _Point(30,15)
		self.lab.Size = _Size(250,25)
		self.lab.Font = _Font("Georgia",12)
		self.Controls.Add(self.lab)
		
		# checklist box
		self.lstbox = CheckedListBox()
		self.lstbox.Items.AddRange(tuple(title))
		self.lstbox.Font = self.gsmt_10r
		# padding
		self.lstbox.Padding = Padding(30)
		# select one click
		self.lstbox.CheckOnClick = True

		self.FormBorderStyle = FormBorderStyle.FixedDialog
		self.MaximizeBox = False;
		self.ManimizeBox = False;
		self.lstbox.Location = _Point(30,45)
		self.lstbox.Size = _Size(280,200)

		# auto horizontal scrollbar
		self.lstbox.HorizontalScrollbar = True
		self.Controls.Add(self.lstbox)

		# select all btn
		self.btn_all = Button()
		self.btn_all.Text = "Select All"
		self.btn_all.Font = self.gsmt_10r
		self.btn_all.Size = _Size(95,25)
		self.btn_all.Location = _Point(30,240)
		self.Controls.Add(self.btn_all)

		# select none btn
		self.btn_none = Button()
		self.btn_none.Text = "Select None"
		self.btn_none.Font = self.gsmt_10r
		self.btn_none.Size = _Size(95,25)
		self.btn_none.Location = _Point(215,240)
		self.Controls.Add(self.btn_none)

		# ok btn
		self.btn = Button()
		self.btn.Text = "OK"
		self.btn.Font = self.gsmt_10r
		self.btn.Size = _Size(80,25)
		self.btn.Location = _Point(130,240)
		self.Controls.Add(self.btn)
		
		

		# events
		self.btn_all.Click += self.click_all
		self.btn_none.Click += self.click_none
		self.btn.Click += self.click_ok 

		# pop up from center
		self.CenterToScreen()

	def click_ok(self, sender, event):	
	
		if len(self.lstbox.CheckedItems) < 1:
			return MessageBox.Show("No element selected!", "Quasar Info Box", MessageBoxButtons.OK, MessageBoxIcon.Asterisk)
						
		self.class2Result = self.lstbox.CheckedItems
		
		return self.Close()		

	def click_all(self, sender, event):
		for i in range(len(self.lstbox.Items)):
			self.lstbox.SetItemChecked(i,True)

	def click_none(self, sender, event):
		for i in range(len(self.lstbox.Items)):
			self.lstbox.SetItemChecked(i,False)


doc = DocumentManager.Instance.CurrentDBDocument

rooms = FilteredElementCollector(doc).OfCategory(BuiltInCategory.OST_Rooms).ToElements()

normal,notplace,notenclosed,redundant = [],[],[],[]
seg,loc = [],[]
for r in rooms:
	s = r.GetBoundarySegments(SpatialElementBoundaryOptions())
	l = r.Location
	seg.append(s)
	loc.append(l)
	if l == None:
		notplace.append(r)
	elif len(s)<1:
		notenclosed.append(r)
	elif r.Area == 0:
		redundant.append(r)
	else:
		normal.append(r)

titles = ["Rooms","Not Placed","Not Enclosed","Redundant"]
items = [normal,notplace,notenclosed,redundant]
ui = ComboCheckboxListSelector(titles,items)
Application.Run(ui)
res =[]
selected = ui.class2Result
for i in selected:
	idx = titles.index(i)
	res.append(items[idx])

OUT = res
# ----------------------------------------
