# Dynamo graph WallOnly.dyn (Dynamo 1.3.2.2480)

# group: Select Option
select_model_elements = DSModelElementsSelection()  # 20 picked in the model
filterWall = Python(IN[0]=select_model_elements)
# ---------- filterWall.python (13 lines) ----------
import clr

elements = UnwrapElement(IN[0])

walls = []
for i in elements:
	try:
		if i.Category.Name.ToString() == "Walls":
			walls.append(i)
	except:
		pass

OUT = walls
# ----------------------------------------

getLocation = Element.GetLocation(filterWall)
direction = Line.Direction(getLocation)
python_script = Python(IN[0]=direction)
# ---------- python_script.python (15 lines) ----------
import clr,math
clr.AddReference('ProtoGeometry')
from Autodesk.DesignScript.Geometry import *

vectors = IN[0]
res = []

for vector in vectors:
	if math.fabs(vector.X) > 100:
		res.append(True)
	else:
		res.append(False)

#Assign your output to the OUT variable.
OUT = res
# ----------------------------------------
filterByBoolMask = List.FilterByBoolMask(list=filterWall, mask=python_script)
geometry = Element.Geometry(filterByBoolMask.in)
flatten = Flatten(geometry)
byGeometry = BoundingBox.ByGeometry(flatten, lacing=CrossProduct)
minPoint = BoundingBox.MinPoint(byGeometry)
Y = Point.Y()  # unwired: arg0
sortByFunction = SortByFunction(minPoint, Y)
code_block = CodeBlock(i=sortByFunction) { i[0]; i[-1]; }
code_block_2 = CodeBlock(x=code_block.out0, y=code_block.out1) { x.X; y.Y; }
byCoordinates = Point.ByCoordinates(x=code_block_2.out0, y=code_block_2.out1)
byStartPointEndPoint = Line.ByStartPointEndPoint(startPoint=code_block.out0, endPoint=byCoordinates)
code_block_3 = CodeBlock { -500; }
translate = Geometry.Translate(geometry=byStartPointEndPoint, xTranslation=code_block_3)
python_script_2 = Python(IN[0]=translate, IN[1]=filterByBoolMask.in)
# ---------- python_script_2.python (35 lines) ----------
import clr
clr.AddReference("RevitAPI")
from Autodesk.Revit.DB import *

clr.AddReference("RevitNodes")
import Revit
clr.ImportExtensions(Revit.GeometryConversion)
clr.ImportExtensions(Revit.Elements)

clr.AddReference("RevitServices")
import RevitServices
from RevitServices.Persistence import DocumentManager
from RevitServices.Transactions import TransactionManager

doc = DocumentManager.Instance.CurrentDBDocument

line = UnwrapElement(IN[0]).ToRevitType()
elements = UnwrapElement(IN[1])

elementsRef = ReferenceArray()

for element in elements:
	a = HostObjectUtils.GetSideFaces(element, ShellLayerType.Exterior)
	for i in a:
		elementsRef.Append(i)
	b = HostObjectUtils.GetSideFaces(element, ShellLayerType.Interior)
	for i in b:
		elementsRef.Append(i)
TransactionManager.Instance.EnsureInTransaction(doc)

dim = doc.Create.NewDimension(doc.ActiveView, line, elementsRef).ToDSType(True)

TransactionManager.Instance.TransactionTaskDone()

OUT = dim
# ----------------------------------------
geometry_2 = Element.Geometry(filterByBoolMask.out)
flatten_2 = Flatten(geometry_2)
byGeometry_2 = BoundingBox.ByGeometry(flatten_2, lacing=CrossProduct)
minPoint_2 = BoundingBox.MinPoint(byGeometry_2)
X = Point.X()  # unwired: arg0
sortByFunction_2 = SortByFunction(minPoint_2, X)
code_block_4 = CodeBlock(i=sortByFunction_2) { i[0]; i[-1]; }
code_block_5 = CodeBlock(x=code_block_4.out1, y=code_block_4.out0) { x.X; y.Y; }
byCoordinates_2 = Point.ByCoordinates(x=code_block_5.out0, y=code_block_5.out1)
byStartPointEndPoint_2 = Line.ByStartPointEndPoint(startPoint=code_block_4.out0, endPoint=byCoordinates_2)
code_block_6 = CodeBlock { -500; }
translate_2 = Geometry.Translate(geometry=byStartPointEndPoint_2, yTranslation=code_block_6)
python_script_3 = Python(IN[0]=translate_2, IN[1]=filterByBoolMask.out)  # same code as python_script_2
all_elements_in_active_view = ElementsInView()
filterWall_2 = Python(IN[0]=all_elements_in_active_view)  # frozen; same code as filterWall
