# Dynamo graph WallsAndGrids.dyn (Dynamo 1.3.2.2480)

select_model_elements = DSModelElementsSelection()  # 19 picked in the model

# group: OUT[0] = Walls OUT[1] = Grids
filterGridAndWall = Python(IN[0]=select_model_elements)
# ---------- filterGridAndWall.python (16 lines) ----------
import clr

elements = UnwrapElement(IN[0])

walls = []
grids = []
for i in elements:
	try:
		if i.Category.Name.ToString() == "Walls":
			walls.append(i)
		if i.Category.Name.ToString() == "Grids":
			grids.append(i)
	except:
		pass

OUT = walls,grids
# ----------------------------------------
code_block = CodeBlock(i=filterGridAndWall) { i[0]; i[1]; }

name = Element.Name()  # unwired: arg0
sortByFunction = SortByFunction(code_block.out1, name)
code_block_2 = CodeBlock { 1..20; }
string_from_object = FromObject(code_block_2)
name_2 = Element.Name(sortByFunction)
containsItem = List.ContainsItem(list=string_from_object, item=name_2)
filterByBoolMask = List.FilterByBoolMask(list=sortByFunction, mask=containsItem)
grid_number = Grid.Curve(filterByBoolMask.in)
firstItem = List.FirstItem(grid_number)
startPoint = Curve.StartPoint(firstItem)
lastItem = List.LastItem(grid_number)
startPoint_2 = Curve.StartPoint(lastItem)
byStartPointEndPoint = Line.ByStartPointEndPoint(startPoint=startPoint, endPoint=startPoint_2)
XAxis = Vector.XAxis()
number = DoubleInput(-200)
translate = Geometry.Translate(geometry=byStartPointEndPoint, direction=XAxis, distance=number)
getLocation = Element.GetLocation(code_block.out0)
direction = Line.Direction(getLocation)
python_script = Python(IN[0]=direction)
# ---------- python_script.python (15 lines) ----------
import clr,math
clr.AddReference('ProtoGeometry')
from Autodesk.DesignScript.Geometry import *

vectors = IN[0]
res = []

for vector in vectors:
	if math.fabs(vector.X) > 100:
		res.append(True)
	else:
		res.append(False)

#Assign your output to the OUT variable.
OUT = res
# ----------------------------------------
filterByBoolMask_2 = List.FilterByBoolMask(list=code_block.out0, mask=python_script)
create = List.Create(filterByBoolMask_2.in, filterByBoolMask.in)
create_2 = List.Create(filterByBoolMask_2.out, filterByBoolMask.out)
code_block_3 = CodeBlock(x=create, y=create_2) { Flatten(x); Flatten(y); }
python_script_2 = Python(IN[0]=translate, IN[1]=code_block_3.out0)
# ---------- python_script_2.python (39 lines) ----------
import clr
clr.AddReference("RevitAPI")
from Autodesk.Revit.DB import *

clr.AddReference("RevitNodes")
import Revit
clr.ImportExtensions(Revit.GeometryConversion)
clr.ImportExtensions(Revit.Elements)

clr.AddReference("RevitServices")
import RevitServices
from RevitServices.Persistence import DocumentManager
from RevitServices.Transactions import TransactionManager

doc = DocumentManager.Instance.CurrentDBDocument

line = UnwrapElement(IN[0]).ToRevitType()
elements = UnwrapElement(IN[1])

elementsRef = ReferenceArray()

for element in elements:
	if element.Category.Name.ToString() == "Walls":
		a = HostObjectUtils.GetSideFaces(element, ShellLayerType.Exterior)
		for i in a:
			elementsRef.Append(i)
		b = HostObjectUtils.GetSideFaces(element, ShellLayerType.Interior)
		for i in b:
			elementsRef.Append(i)
	elif element.Category.Name.ToString() == "Grids":
		elementsRef.Append(Reference(element))
		
TransactionManager.Instance.EnsureInTransaction(doc)

dim = doc.Create.NewDimension(doc.ActiveView, line, elementsRef).ToDSType(True)

TransactionManager.Instance.TransactionTaskDone()

OUT = dim
# ----------------------------------------
grid_alphabet = Grid.Curve(filterByBoolMask.out)
firstItem_2 = List.FirstItem(grid_alphabet)
startPoint_3 = Curve.StartPoint(firstItem_2)
lastItem_2 = List.LastItem(grid_alphabet)
startPoint_4 = Curve.StartPoint(lastItem_2)
byStartPointEndPoint_2 = Line.ByStartPointEndPoint(startPoint=startPoint_3, endPoint=startPoint_4)
YAxis = Vector.YAxis()
number_2 = DoubleInput(200)
translate_2 = Geometry.Translate(geometry=byStartPointEndPoint_2, direction=YAxis, distance=number_2)
python_script_3 = Python(IN[0]=translate_2, IN[1]=code_block_3.out1)  # same code as python_script_2
