# Dynamo graph center-room.dyn (Dynamo 1.3.2.2480)

categories = Categories("Rooms")
all_elements_of_category = ElementsOfCategory(categories)
geometry = Element.Geometry(all_elements_of_category)
centroid = Solid.Centroid(geometry)
ZAxis = Vector.ZAxis()
Z = Point.Z(centroid)
code_block = CodeBlock(x=Z) { x>1 ? -x: Math.Abs(x); }
translate = Geometry.Translate(geometry=centroid, direction=ZAxis, distance=code_block)
python_script = Python(IN[0]=all_elements_of_category)
# ---------- python_script.python (42 lines) ----------
import clr
clr.AddReference('ProtoGeometry')
clr.AddReference('RevitAPI')
clr.AddReference('RevitServices')
clr.AddReference("RevitNodes")

import System,Revit
clr.ImportExtensions(Revit.Elements)
clr.ImportExtensions(Revit.GeometryConversion)
from Autodesk.DesignScript.Geometry import *
from Autodesk.Revit.DB import *
from RevitServices.Persistence import DocumentManager
from RevitServices.Transactions import TransactionManager

doc = DocumentManager.Instance.CurrentDBDocument

elems = IN[0];

MassBICObj = System.Enum.ToObject(BuiltInCategory,BuiltInCategory.OST_Mass)

objId = ElementId(MassBICObj)

if not isinstance(elems,list):
	elems = UnwrapElement([elem])
else:
	elems = UnwrapElement(elems)

res = []

for e in elems:
	name = e.LookupParameter("Name").AsString()
	number = e.LookupParameter("Number").AsString()
	elem_name = number+"_"+name
	geoelem = e.GetGeometryObjectFromReference(Reference(e))
	geoobj = geoelem.GetEnumerator();
	for obj in geoobj:
		room_geometry = obj.ToProtoType()
		centroid = room_geometry.Centroid()
		zval = centroid.Z		
		res.append([centroid,zval])	

OUT = res
# ----------------------------------------
