# Dynamo graph create-mech-system-type.dyn (Dynamo 1.3.2.2480)

python_script = Python()
# ---------- python_script.python (18 lines) ----------
import clr
clr.AddReference('RevitAPI')
clr.AddReference('RevitServices')

from Autodesk.Revit.DB import *
from Autodesk.Revit.DB.Mechanical import *
from RevitServices.Persistence import DocumentManager
from RevitServices.Transactions import TransactionManager

doc = DocumentManager.Instance.CurrentDBDocument

TransactionManager.Instance.EnsureInTransaction(doc)

mech_sys_type = MechanicalSystemType.Create(doc, MEPSystemClassification.SupplyAir , "ddd")

TransactionManager.Instance.TransactionTaskDone()

OUT = mech_sys_type
# ----------------------------------------
