# Dynamo graph delete-parameters.dyn (Dynamo 1.3.2.2480)

python_script = Python()  # unwired: IN[0]; starter script, not edited (OUT = 0)
python_script_2 = Python()  # frozen; unwired: IN[0]
# ---------- python_script_2.python (40 lines) ----------
import clr

clr.AddReference('RevitAPI')
clr.AddReference("RevitServices")

from Autodesk.Revit.DB import *
from Autodesk.Revit.DB.Structure import *

from RevitServices.Persistence import DocumentManager
from RevitServices.Transactions import TransactionManager

doc = DocumentManager.Instance.CurrentDBDocument

elements = IN[0]
todelete = []

if not isinstance(elements, list):
	elements = [elements]
"""
class_filter = ElementClassFilter(SharedParameterElement,True)

parameters = FilteredElementCollector(doc).OfClass(ParameterElement).WherePasses(class_filter).ToElements()
"""

parameters = FilteredElementCollector(doc).OfClass(ParameterElement).ToElements()

for elem in elements:
	for param in parameters:
		if param.Name == elem:
			todelete.append(param.Id)

TransactionManager.Instance.EnsureInTransaction(doc)

res = [doc.Delete(i) for i in todelete]
				

TransactionManager.Instance.TransactionTaskDone()


OUT = res
# ----------------------------------------
code_block = CodeBlock { {"ParamOne","ParamTwo","ParamThree"}; }
removeParams = Python(IN[0]=code_block)
# ---------- removeParams.python (45 lines) ----------
# dynamo version - 1.3.2
#(should be fine with 1.3.x or 2.x.x versions too)

import clr

clr.AddReference('RevitAPI')
clr.AddReference("RevitServices")

from Autodesk.Revit.DB import *
from Autodesk.Revit.DB.Structure import *

from RevitServices.Persistence import DocumentManager
from RevitServices.Transactions import TransactionManager

doc = DocumentManager.Instance.CurrentDBDocument

# input[0]
elements = IN[0]
# params id
todelete = []

# check/make list
if not isinstance(elements, list):
	elements = [elements]
	
# collect parameters
parameters = FilteredElementCollector(doc).OfClass(ParameterElement).ToElements()

# loop input params
for elem in elements:
	# loop existing params
	for param in parameters:
		# if name found
		if param.Name == elem:
			# append id to delete list
			todelete.append(param.Id)

# start transaction
TransactionManager.Instance.EnsureInTransaction(doc)
# delete from document
res = [doc.Delete(i) for i in todelete]
# end transaction				
TransactionManager.Instance.TransactionTaskDone()

OUT = res
# ----------------------------------------
