# Dynamo graph event.dyn (Dynamo 1.3.2.2480)

boolean = BoolSelector(true)
python_script = Python(IN[0]=boolean)
# ---------- python_script.python (37 lines) ----------
import clr
import System
from System import EventHandler
clr.AddReference('RevitAPI')
clr.AddReference('RevitAPIUI')
from Autodesk.Revit.UI import RevitCommandId
import Autodesk
clr.AddReference('RevitServices')
import RevitServices
from RevitServices.Persistence import DocumentManager
clr.AddReference("RevitAPIUI")
from Autodesk.Revit.UI import *
from Autodesk.Revit.UI.Events import DialogBoxShowingEventArgs
doc = DocumentManager.Instance.CurrentDBDocument
uiapp = DocumentManager.Instance.CurrentUIApplication

def confirm(sender, eventArgs):
	return eventArgs.OverrideResult(TaskDialogResult.Ok)
	
bool = IN[0] 

if bool ==  True:

	CmndID = RevitCommandId.LookupCommandId('ID_PURGE_UNUSED')
	#cmdMonitor = RevitCommandEndedMonitor(uiapp)
	uiapp.PostCommand(CmndID)
	#dialogEventHandler = EventHandler[DialogBoxShowingEventArgs](confirm)
	uiapp.DialogBoxShowing += confirm
	#RevitCommandId.LookupPostableCommandId
	#uiapp.DialogBoxShowing -= dialogEventHandler
	
	error = 'Success'
else:
	error = 'Set IN[0] to true'

#Assign your output to the OUT variable
OUT = uiapp.DialogBoxShowing
# ----------------------------------------
python_script_2 = Python(IN[0]=boolean)  # frozen
# ---------- python_script_2.python (35 lines) ----------
import clr
import System
from System import EventHandler
clr.AddReference('RevitAPI')
clr.AddReference('RevitAPIUI')
from Autodesk.Revit.UI import RevitCommandId
import Autodesk
clr.AddReference('RevitServices')
import RevitServices
from RevitServices.Persistence import DocumentManager
clr.AddReference("RevitAPIUI")
from Autodesk.Revit.UI.Events import DialogBoxShowingEventArgs
doc = DocumentManager.Instance.CurrentDBDocument
uiapp = DocumentManager.Instance.CurrentUIApplication

	
bool = IN[0] 

if bool ==  True:

	CmndID = RevitCommandId.LookupCommandId('ID_PURGE_UNUSED')
	#cmdMonitor = RevitCommandEndedMonitor(uiapp)
	dialog = uiapp.PostCommand(CmndID)
	dialogEventHandler = EventHandler[DialogBoxShowingEventArgs](confirm)
	#uiapp.DialogBoxShowing += dialogEventHandler
	#RevitCommandId.LookupPostableCommandId
	#uiapp.DialogBoxShowing -= dialogEventHandler
	
	
	error = 'Success'
else:
	error = 'Set IN[0] to true'

#Assign your output to the OUT variable
OUT = CmndID.Name
# ----------------------------------------
