# Dynamo graph grid_rename.dyn (Dynamo 1.3.2.2480)

string = StringInput("X")
string_2 = StringInput("111")
boolean = BoolSelector(false)
# note: IN[0] =  X (Horizontal) or Y (Vertical)[string]
# IN[1] = startfrom (number or alphabet) [string]
# IN[2] = reverse [boolean]
python_script = Python(IN[0]=string, IN[1]=string_2, IN[2]=boolean)
# ---------- python_script.python (79 lines) ----------
import clr,math

clr.AddReference('ProtoGeometry')
from Autodesk.DesignScript.Geometry import *


clr.AddReference("RevitAPI")
clr.AddReference("RevitServices")
from Autodesk.Revit.DB import FilteredElementCollector, Grid
from RevitServices.Persistence import DocumentManager
from RevitServices.Transactions import TransactionManager

clr.AddReference("RevitNodes")
import Revit
clr.ImportExtensions(Revit.Elements)
clr.ImportExtensions(Revit.GeometryConversion)

doc = DocumentManager.Instance.CurrentDBDocument
grids = FilteredElementCollector(doc).OfClass(Grid).ToElements()


direction = IN[0]
startfrom = IN[1]
reverse = IN[2] if IN[2] else False

tosort = []

for grid in grids:
	line = grid.ToDSType(False).Curve
	if direction == 'X' and math.fabs(line.Direction.X) > 50:
		tosort.append((grid, line.StartPoint.Y))
	
	if direction == 'Y' and math.fabs(line.Direction.Y) > 50:
		tosort.append((grid, line.StartPoint.X))
		
res = sorted(tosort, key = lambda x: x[1])


pre_naming = startfrom
naming = startfrom

sorted_grids = [i[0] for i in res]

if reverse:
	sorted_grids.reverse()

def grid_num(n):
	n = int(n)
	for grid in sorted_grids:
		try:
			grid.Name = str(n)
		except:
			grid.Name = str(n) + "'"
		n += 1
		
		
def grid_str(n):
	n = ord(n)
	for grid in sorted_grids:
		try:
			grid.Name = chr(n)
		except:
			grid.Name = chr(n) + "'"
		n += 1
		

TransactionManager.Instance.EnsureInTransaction(doc)

if startfrom.isdigit():
	grid_num(pre_naming)
	grid_num(naming)
else:
	grid_str(pre_naming)
	grid_str(naming)

TransactionManager.Instance.TransactionTaskDone()


OUT = sorted_grids
# ----------------------------------------
