# Dynamo graph interop-excel.dyn (Dynamo 1.3.2.2480)

excel = Python()  # unwired: IN[0]
# ---------- excel.python (67 lines) ----------
import clr,System
clr.AddReference('Microsoft.Office.Interop.Excel')

import Microsoft.Office.Interop.Excel as Excel
from System.Runtime.InteropServices import Marshal
System.Threading.Thread.CurrentThread.CurrentCulture = System.Globalization.CultureInfo("en-US")

"""
# active excel doc
try:
	excel = Marshal.GetActiveObject("Excel.Application")
except:
	excel = "no active excel docs"
OUT = excel
"""


# excel app
excel = Excel.ApplicationClass()

excel.Visible = False
excel.DisplayAlerts = False
excel.ScreenUpdating = False

# open workbook
wb = excel.Workbooks.Open(r"C:\Users\min.naung\Desktop\2.xlsx")

# collect sheets from workbook
ws = wb.Worksheets

# get sheet from sheets
sheet = ws.Item("Sheet2")

# data 
data = []
range = sheet.UsedRange
columns = int(range.Columns.Count)
rows = int(range.Rows.Count)

"""
for r in range(1,rows):
	for c in range(1,columns):
		value = sheet.Cells[r,c].Value2
		data.append(value)
"""

value = sheet.Range["A1","B5"].Value2

def ExitExcel(xlApp, wb, ws):
	# clean up before exiting excel, if any COM object remains
	# unreleased then excel crashes on open following time
	def CleanUp(_list):
		if isinstance(_list, list):
			for i in _list:
				Marshal.ReleaseComObject(i)
		else:
			Marshal.ReleaseComObject(_list)
		return None
		
	xlApp.ActiveWorkbook.Close(False)
	xlApp.ScreenUpdating = True
	CleanUp([ws,wb,xlApp])
	return None
	
ExitExcel(excel,wb,ws)

OUT = value
# ----------------------------------------
