# Dynamo graph intersect.dyn (Dynamo 1.3.2.2480)

getIntersectionGeometry = Python()  # frozen; unwired: IN[0], IN[1]
# ---------- getIntersectionGeometry.python (54 lines) ----------
import clr
clr.AddReference('ProtoGeometry')
clr.AddReference('RevitNodes')
clr.AddReference('RevitAPI')

import Revit
clr.ImportExtensions(Revit.Elements)
clr.ImportExtensions(Revit.GeometryConversion)

from Autodesk.DesignScript.Geometry import *
from Autodesk.Revit.DB import *

elems = UnwrapElement(IN[0])
others = UnwrapElement(IN[1])

others_geometries = []
elems_geometries = []
intersects_geometries = []


def dyn_geo(e):
	# get geo-objects of the element
	geoelem = e.GetGeometryObjectFromReference(Reference(e))
	# get enumerator to loop geo-objects
	geoobj = geoelem.GetEnumerator()
	# loop geo-objector
	for obj in geoobj:
		# convert to dynamo type
		geo = obj.ToProtoType()
	# return geometry
	return geo
# elems loop
for elem in elems:
	# convert dyn-geo, append to geo list
	elems_geometries.append(dyn_geo(elem))
	
# other elems loop
for other in others:
	# convert dyn-geo, append to geo list
	others_geometries.append(dyn_geo(other))

# to collect intersets
# loop elems geo
for elem_geo in elems_geometries:
	# loop others geo
	for other_geo in others_geometries:
		# find intersect geo
		intersect = Geometry.Intersect(elem_geo, other_geo)
		# if intersection occur
		if intersect:
			# append intersection geometry 
			intersects_geometries.append(intersect)

OUT = intersects_geometries
# ----------------------------------------
categories = Categories("Walls")
all_elements_of_category = ElementsOfCategory(categories)
categories_2 = Categories("PipeCurves")
all_elements_of_category_2 = ElementsOfCategory(categories_2)

# group: Intersection Points, Elements
python_script = Python(IN[0]=all_elements_of_category, IN[1]=all_elements_of_category_2)
# ---------- python_script.python (49 lines) ----------
import clr

clr.AddReference('ProtoGeometry')
clr.AddReference('RevitNodes')
clr.AddReference('RevitAPI')

import Revit
clr.ImportExtensions(Revit.Elements)
clr.ImportExtensions(Revit.GeometryConversion)


from Autodesk.DesignScript.Geometry import *
from Autodesk.Revit.DB import *

elems = UnwrapElement(IN[0])
others = UnwrapElement(IN[1])

intersects_geometries = []
sizes = []

def dyn_geo(e):
	# get geo-objects of the element
	geoelem = e.GetGeometryObjectFromReference(Reference(e))
	# get enumerator to loop geo-objects
	geoobj = geoelem.GetEnumerator()
	# loop geo-objector
	for obj in geoobj:
		# convert to dynamo type
		geo = obj.ToProtoType()
	# return geometry
	return geo

# to collect intersets
# loop elems
for elem in elems:
	# loop others
	for other in others:
		# find intersect geo
		elem_geo = dyn_geo(elem)
		other_geo = dyn_geo(other)
		intersect = Geometry.Intersect(elem_geo, other_geo)
		# if intersect
		if intersect:
			# append intersection geometry 
			intersects_geometries.append(intersect)
			# pipe diameter 
			sizes.append(other)

OUT = intersects_geometries,sizes
# ----------------------------------------
code_block = CodeBlock(I=python_script) { I[0]; I[1]; }

# group: Place Opening Family
family_types = FamilyTypes("Family1:Family1")
flatten = Flatten(code_block.out0)
centroid = Solid.Centroid(flatten)
byPoint = FamilyInstance.ByPoint(familyType=family_types, point=centroid)

# group: Opening Size
code_block_2 = CodeBlock { "Opening_Diameter"; }
code_block_3 = CodeBlock { "Diameter"; }
getParameterValueByName = Element.GetParameterValueByName(element=code_block.out1, parameterName=code_block_3)
convert_between_units = DynamoConvert(getParameterValueByName, conversionMetric=Length, conversionFrom=Feet, conversionTo=Millimeters)
code_block_4 = CodeBlock { 25; }
code_block_5 = CodeBlock(size=convert_between_units, tolerance=code_block_4) { size + tolerance; }
setParameterByName = Element.SetParameterByName(element=byPoint, parameterName=code_block_2, value=code_block_5)

# group: BOP from FFL
code_block_6 = CodeBlock { "BOP"; }
code_block_7 = CodeBlock { "Offset"; }
getParameterValueByName_2 = Element.GetParameterValueByName(element=code_block.out1, parameterName=code_block_7)
code_block_8 = CodeBlock(offset=getParameterValueByName_2, minus_from_center=code_block_5) { offset - minus_from_center/2; }
setParameterByName_2 = Element.SetParameterByName(element=byPoint, parameterName=code_block_6, value=code_block_8)

python_script_2 = Python(IN[0]=byPoint)
# ---------- python_script_2.python (21 lines) ----------
# dynamo version - 1.3.2
# author - min.naung/mgjean https://twentytwo.space/contact/

import clr
clr.AddReference('RevitAPI')
from Autodesk.Revit.DB import *


clr.AddReference("RevitServices")
import RevitServices
from RevitServices.Persistence import DocumentManager

doc = DocumentManager.Instance.CurrentDBDocument
res = []
elements = UnwrapElement(IN[0])

for element in elements:
	tag = doc.Create.NewTag(doc.ActiveView, element, True, TagMode.TM_ADDBY_CATEGORY, TagOrientation.Horizontal, element.Location.Point)
	res.append(tag)

OUT = res
# ----------------------------------------
