# Dynamo graph legend.dyn (Dynamo 1.3.2.2480)

# note: Each list includes [DocumentName, Document]
python_script = Python()
# ---------- python_script.python (15 lines) ----------
# dynamo version - 1.3.0 
# author - min.naung@mgjean https://twentytwopaths.wordpress.com/contact/


import clr
clr.AddReference("RevitAPI")
clr.AddReference("RevitServices")

from Autodesk.Revit.DB import *
from RevitServices.Persistence import DocumentManager

doc = DocumentManager.Instance.CurrentDBDocument;
link_docs = FilteredElementCollector(doc).OfClass(RevitLinkInstance);

OUT = [[i.Name.split(":")[0],i.GetLinkDocument()] for i in link_docs];
# ----------------------------------------
code_block = CodeBlock(i=python_script) { i[1][1]; }
transferLegend = Python(IN[0]=code_block)  # frozen
# ---------- transferLegend.python (156 lines) ----------
# dynamo version - 1.3.2
# author - min.naung/mgjean https://twentytwo.space/contact

import clr,sys
sys.path.append(r"C:\Program Files (x86)\IronPython 2.7\Lib")
import os, System

clr.AddReference("RevitAPI")
clr.AddReference("RevitServices")

from Autodesk.Revit.DB import *
from RevitServices.Persistence import DocumentManager
from RevitServices.Transactions import TransactionManager

version = ["2.0","1.3","1.2","1.1","1.0","0.9","0.8","0.7"]

appdata = os.getenv("AppData");
qpath = r"\Dynamo\Dynamo Revit\%s\packages\Quasar"

for i in version:
	if os.path.exists(os.path.join(appdata+qpath %i)):
		ipath = os.path.join(appdata+qpath %i)

clr.AddReference("System.Windows.Forms")
clr.AddReference("System.Drawing")


from System.Collections.Generic import List
from System.Windows.Forms import (Application, Button, ComboBox, CheckBox, Form as _Form,
CheckedListBox,Padding,FormBorderStyle, SelectionMode,Label, MessageBox,MessageBoxButtons, MessageBoxIcon)
from System.Drawing import (Font as _Font, Icon as _Icon, Point as _Point, Size as _Size,FontStyle)

doc = DocumentManager.Instance.CurrentDBDocument

linkdoc = IN[0]


# collect view from link document
collector = FilteredElementCollector(linkdoc).OfClass(View).ToElements()
# collect view template
views = [v for v in collector if v.ViewType== ViewType.Legend]
views_name = [v.Name for v in views]
ids = [v.Id for v in views]
views_ids_dict = {k:v for k,v in zip(views_name,ids)}


class CheckedBoxListSelector(_Form):
	"""Checked Box List Selector"""
	
	def __init__(self,inputList):
		self.Icon = _Icon(r"%s\extra\icon.ico" %ipath)
		self.Size = _Size(370,435)
		self.Text = "Quasar"
		self.class1Result = [];

		# fonts
		self.gsmt_11r = _Font("Georgia", 10)
		self.gsmt_10r = _Font("Georgia",9)

		# label
		self.label = Label()
		self.label.Text = "Select Legend View: "
		self.label.Font = self.gsmt_11r
		self.label.Location = _Point(30,10)
		self.label.Size = _Size(220,28)
		self.Controls.Add(self.label)

		# checklist box
		self.lstbox = CheckedListBox()
		self.lstbox.Items.AddRange(tuple(inputList))
		self.lstbox.Font = self.gsmt_10r
		# padding
		self.lstbox.Padding = Padding(30)
		# select one click
		self.lstbox.CheckOnClick = True

		self.FormBorderStyle = FormBorderStyle.FixedDialog
		self.MaximizeBox = False;
		self.ManimizeBox = False;
		self.lstbox.Location = _Point(30,40)
		self.lstbox.Size = _Size(290,280)

		# auto horizontal scrollbar
		self.lstbox.HorizontalScrollbar = True
		self.Controls.Add(self.lstbox)

		# select all btn
		self.btn_all = Button()
		self.btn_all.Text = "Select All"
		self.btn_all.Font = self.gsmt_10r
		self.btn_all.Size = _Size(95,25)
		self.btn_all.Location = _Point(30,350)
		self.Controls.Add(self.btn_all)

		# select none btn
		self.btn_none = Button()
		self.btn_none.Text = "Select None"
		self.btn_none.Font = self.gsmt_10r
		self.btn_none.Size = _Size(95,25)
		self.btn_none.Location = _Point(225,350)
		self.Controls.Add(self.btn_none)

		# ok btn
		self.btn = Button()
		self.btn.Text = "OK"
		self.btn.Font = self.gsmt_10r
		self.btn.Size = _Size(80,25)
		self.btn.Location = _Point(135,350)
		self.Controls.Add(self.btn)

		# events
		self.btn_all.Click += self.click_all
		self.btn_none.Click += self.click_none
		self.btn.Click += self.click_ok 

		# pop up from center
		self.CenterToScreen()

	def click_ok(self, sender, event):
		#global res
		if len(self.lstbox.Items) < 1:
			self.Close()
		if len(self.lstbox.CheckedItems) < 1:
			return MessageBox.Show("No element selected!", "Quasar Info Box", MessageBoxButtons.OK, MessageBoxIcon.Asterisk)
		
		self.class1Result = self.lstbox.CheckedItems;
		
		return self.Close();			

	def click_all(self, sender, event):
		for i in range(len(self.lstbox.Items)):
			self.lstbox.SetItemChecked(i,True)

	def click_none(self, sender, event):
		for i in range(len(self.lstbox.Items)):
			self.lstbox.SetItemChecked(i,False);

# instantiate class
ui = CheckedBoxListSelector(views_name)
# run class
Application.Run(ui)
# extract selected value
selected = ui.class1Result


# dot-net elementId list
ids = List[ElementId]([views_ids_dict[i] for i in selected]);
# transaction start
TransactionManager.Instance.EnsureInTransaction(doc)
#copy template from link-doc to current-doc
transfer_views = ElementTransformUtils.CopyElements(linkdoc,ids,doc,Transform.Identity,CopyPasteOptions())

# transaction done			
TransactionManager.Instance.TransactionTaskDone()
# names
OUT = [doc.GetElement(v) for v in transfer_views]
# ----------------------------------------
python_script_2 = Python(IN[0]=code_block)
# ---------- python_script_2.python (32 lines) ----------
import clr
clr.AddReference('RevitAPI')
clr.AddReference("RevitServices")
import System
from Autodesk.Revit.DB import *
from RevitServices.Persistence import DocumentManager
from RevitServices.Transactions import TransactionManager
from System.Collections.Generic import List
# get current document 
doc = DocumentManager.Instance.CurrentDBDocument


linkdoc = IN[0]


# collect view from link document
collector = FilteredElementCollector(linkdoc).OfClass(View).ToElements()
# collect view template
views = [v for v in collector if v.ViewType== ViewType.Legend]
views_name = [v.Name for v in views]
views_ids = [v.Id for v in views]
dotList = List[ElementId](views_ids)
#views_ids_dict = {k:v for k,v in zip(views_name,ids)}

TransactionManager.Instance.EnsureInTransaction(doc)

copy_views = ElementTransformUtils.CopyElements(linkdoc,dotList,doc,Transform.Identity,CopyPasteOptions())

	
TransactionManager.Instance.TransactionTaskDone()

OUT = views_ids,copy_views
# ----------------------------------------
code_block_2 = CodeBlock(i=python_script_2) { i[0]; i[1]; }
python_script_3 = Python(IN[0]=code_block, IN[1]=code_block_2.out0, IN[2]=code_block_2.out1)
# ---------- python_script_3.python (49 lines) ----------
import clr
clr.AddReference('RevitAPI')
clr.AddReference("RevitServices")
import System
from Autodesk.Revit.DB import *
from RevitServices.Persistence import DocumentManager
from RevitServices.Transactions import TransactionManager
from System.Collections.Generic import List
# get current document 
doc = DocumentManager.Instance.CurrentDBDocument


linkdoc = IN[0]
link_legend = IN[1]
doc_legend = IN[2]
view_names = []

result = []

TransactionManager.Instance.EnsureInTransaction(doc)

for l, d in zip(link_legend,doc_legend):
	view = linkdoc.GetElement(l)
	view_copy = doc.GetElement(d)
	view_names.append(str(view_copy.ViewName))
	
	elements = FilteredElementCollector(linkdoc,l).ToElements()
	element_ids = []
	for e in elements:
		try:
			element_ids.append(e.Id)
		except:
			continue
	elemIdList = List[ElementId](element_ids)
	copy_element = ElementTransformUtils.CopyElements(view,elemIdList,view_copy,Transform.Identity,CopyPasteOptions())
	doc.Delete(d)

views = FilteredElementCollector(doc).OfClass(View).ToElements()
legends = [v for v in views if v.ViewType == ViewType.Legend]
res = []
for i in legends:
	for j in view_names:
		if j[:-1] == str(i.ViewName)[:-2]:
			i.ViewName = j
			res.append(i)
			
TransactionManager.Instance.TransactionTaskDone()

OUT = res
# ----------------------------------------
python_script_4 = Python()  # frozen; unwired: IN[0], IN[1], IN[2]
# ---------- python_script_4.python (15 lines) ----------
import clr
clr.AddReference('RevitAPI')
clr.AddReference("RevitServices")
import System
from Autodesk.Revit.DB import *
from RevitServices.Persistence import DocumentManager
from RevitServices.Transactions import TransactionManager
from System.Collections.Generic import List
# get current document 
doc = DocumentManager.Instance.CurrentDBDocument

views = FilteredElementCollector(doc).OfClass(View).ToElements()
legends = [v for v in views if v.ViewType == ViewType.Legend]

OUT = [v.ViewName[:-1] for v in legends]
# ----------------------------------------
