# Dynamo graph polygon.dyn (Dynamo 1.3.2.2480)

origin = Point.Origin()
byCenterPointRadius = Circle.ByCenterPointRadius(centerPoint=origin)
code_block = CodeBlock { 8; }
regularPolygon = Polygon.RegularPolygon(circle=byCenterPointRadius, numberSides=code_block)

# group: CreatePolygon
# note: Polygon[Circle, Sides]
python_script = Python(IN[0]=byCenterPointRadius, IN[1]=code_block)  # frozen
# ---------- python_script.python (32 lines) ----------
import clr
clr.AddReference('ProtoGeometry')
from Autodesk.DesignScript.Geometry import *

curve = IN[0]
side = float(IN[1])

base = float(1/side)
increment = 0
points = []
res = []
increment_list = []

for i in range(int(side)):
	increment += base
	increment_list.append(increment)
	point = Curve.PointAtParameter(curve,increment)
	points.append(point)

for num,point in enumerate(points):
	if num == len(points):
		break;
	if num == len(points)-1:
		next = num + 1
		line = Line.ByStartPointEndPoint(point,points[0])
		
	else:
		next = num + 1
		line = Line.ByStartPointEndPoint(point, points[next])
	res.append(line);

OUT = res
# ----------------------------------------

python_script_2 = Python(IN[0]=byCenterPointRadius, IN[1]=code_block)
# ---------- python_script_2.python (32 lines) ----------
import clr
clr.AddReference('ProtoGeometry')
from Autodesk.DesignScript.Geometry import *

curve = IN[0]
side = float(IN[1])

base = float(1/side)
increment = 0
points = []
res = []
increment_list = []

for i in range(int(side)):
	increment += base
	increment_list.append(increment)
	point = Curve.PointAtParameter(curve,increment)
	points.append(point)

for num,point in enumerate(points):
	if num == len(points):
		break;
	if num == len(points)-1:
		next = num + 1
		line = Line.ByStartPointEndPoint(point,points[0])
		
	else:
		next = num + 1
		line = Line.ByStartPointEndPoint(point, points[next])
	res.append(line);

OUT = points
# ----------------------------------------
