# Dynamo graph project-parameters.dyn (Dynamo 1.3.2.2480)

python_script = Python()  # frozen; unwired: IN[0]
# ---------- python_script.python (40 lines) ----------
import clr

clr.AddReference('RevitAPI')
clr.AddReference("RevitServices")

from Autodesk.Revit.DB import *
from Autodesk.Revit.DB.Structure import *

from RevitServices.Persistence import DocumentManager
from RevitServices.Transactions import TransactionManager

doc = DocumentManager.Instance.CurrentDBDocument

elements = IN[0]
todelete = []

if not isinstance(elements, list):
	elements = [elements]
"""
class_filter = ElementClassFilter(SharedParameterElement,True)

parameters = FilteredElementCollector(doc).OfClass(ParameterElement).WherePasses(class_filter).ToElements()
"""

parameters = FilteredElementCollector(doc).OfClass(ParameterElement).ToElements()

for elem in elements:
	for param in parameters:
		if param.Name == elem:
			todelete.append(param.Id)

TransactionManager.Instance.EnsureInTransaction(doc)

res = [doc.Delete(i) for i in todelete]
				

TransactionManager.Instance.TransactionTaskDone()


OUT = res
# ----------------------------------------
removeParams = Python()  # unwired: IN[0]
# ---------- removeParams.python (32 lines) ----------
# dynamo version - 1.3.2
#(should be fine with 1.3.x or 2.x.x versions too)

import clr

clr.AddReference('RevitAPI')
clr.AddReference("RevitServices")

from Autodesk.Revit.DB import *
from Autodesk.Revit.DB.Structure import *

from RevitServices.Persistence import DocumentManager
from RevitServices.Transactions import TransactionManager

doc = DocumentManager.Instance.CurrentDBDocument

# params id
todelete = []

filter = ElementClassFilter(ParameterElement)
	
# collect parameters
parameters = FilteredElementCollector(doc).OfClass(ParameterElement).WherePasses(filter).ToElements()


# loop existing params
for param in parameters:
		
	todelete.append(param.Name)


OUT = todelete
# ----------------------------------------
customCheckboxSelection = Custom[CustomCheckboxSelection](AList=removeParams)  # Create checkboxes with input list and select items.
removeParams_2 = Python(IN[0]=customCheckboxSelection)
# ---------- removeParams_2.python (50 lines) ----------
# dynamo version - 1.3.2
#(should be fine with 1.3.x or 2.x.x versions too)

import clr

clr.AddReference('RevitAPI')
clr.AddReference("RevitServices")

from Autodesk.Revit.DB import *
from Autodesk.Revit.DB.Structure import *

from RevitServices.Persistence import DocumentManager
from RevitServices.Transactions import TransactionManager

doc = DocumentManager.Instance.CurrentDBDocument

# input[0]
elements = IN[0]
# params id
todelete = []
res = []

# check/make list
if not isinstance(elements, list):
	elements = [elements]
	
# collect parameters
parameters = FilteredElementCollector(doc).OfClass(ParameterElement).ToElements()

# loop input params
for elem in elements:
	# loop existing params
	for param in parameters:
		# if name found
		if param.Name == elem:
			# append id to delete list
			todelete.append(param.Id)

# start transaction
TransactionManager.Instance.EnsureInTransaction(doc)
# delete from document
for t in todelete:
	try:
		res.append(doc.Delete(t))
	except:
		res.append("Can't Remove")
# end transaction				
TransactionManager.Instance.TransactionTaskDone()

OUT = res
# ----------------------------------------
