# Dynamo graph rebar.dyn (Dynamo 1.3.2.2480)

select_model_elements = DSModelElementsSelection()  # 2 picked in the model
# note: IN[0] = Description
# IN[0] = Setting (mm)
createRebarCoverType = Python()  # unwired: IN[0], IN[1]
# ---------- createRebarCoverType.python (24 lines) ----------
import clr

clr.AddReference('RevitAPI')
clr.AddReference("RevitServices")

from Autodesk.Revit.DB import *
from Autodesk.Revit.DB.Structure import *

from RevitServices.Persistence import DocumentManager
from RevitServices.Transactions import TransactionManager

doc = DocumentManager.Instance.CurrentDBDocument

cover_desc = IN[0] if IN[0] else "NewType"
cover_setting = IN[1]/304.8 if IN[1] else 25/304.8

TransactionManager.Instance.EnsureInTransaction(doc)

newtype = RebarCoverType.Create(doc,cover_desc, cover_setting)

TransactionManager.Instance.TransactionTaskDone()


OUT = newtype
# ----------------------------------------
# note: IN[0] = Framings
# IN[1] = RebarCoverType
setFramingRebarCoverType = Python(IN[0]=select_model_elements, IN[1]=createRebarCoverType)  # frozen
# ---------- setFramingRebarCoverType.python (33 lines) ----------
import clr

clr.AddReference('RevitAPI')
clr.AddReference("RevitServices")

from Autodesk.Revit.DB import *
from Autodesk.Revit.DB.Structure import *

from RevitServices.Persistence import DocumentManager
from RevitServices.Transactions import TransactionManager

doc = DocumentManager.Instance.CurrentDBDocument

framings = IN[0]
covertype = UnwrapElement(IN[1])
params = ["Rebar Cover - Top Face","Rebar Cover - Bottom Face",
"Rebar Cover - Other Faces"]

if isinstance(framings, list):
	framings = UnwrapElement(framings)
else:
	framings = UnwrapElement([framings])

TransactionManager.Instance.EnsureInTransaction(doc)

for framing in framings:
	for param in params:
		framing.LookupParameter(param).Set(covertype.Id)

TransactionManager.Instance.TransactionTaskDone()


OUT = framings
# ----------------------------------------
# note: IN[0] = Framings
getFramingRebarCoverType = Python(IN[0]=select_model_elements)
# ---------- getFramingRebarCoverType.python (35 lines) ----------
import clr

clr.AddReference('RevitAPI')
clr.AddReference("RevitServices")

from Autodesk.Revit.DB import *
from Autodesk.Revit.DB.Structure import *

from RevitServices.Persistence import DocumentManager
from RevitServices.Transactions import TransactionManager

doc = DocumentManager.Instance.CurrentDBDocument

framings = IN[0]

if isinstance(framings, list):
	framings = UnwrapElement(framings)
else:
	framings = UnwrapElement([framings])

top,btm, others = [],[],[]
#TransactionManager.Instance.EnsureInTransaction(doc)

for framing in framings:
	toptype = framing.LookupParameter("Rebar Cover - Top Face").AsElementId()
	top.append(doc.GetElement(toptype))
	btmtype = framing.LookupParameter("Rebar Cover - Bottom Face").AsElementId()
	btm.append(doc.GetElement(btmtype))
	otherstype = framing.LookupParameter("Rebar Cover - Other Faces").AsElementId()
	others.append(doc.GetElement(otherstype))

#TransactionManager.Instance.TransactionTaskDone()


OUT = top, btm, others
# ----------------------------------------
code_block = CodeBlock { "51"; }
rebarShapeByTypeName = Python(IN[0]=code_block)
# ---------- rebarShapeByTypeName.python (23 lines) ----------
# dynamo version 1.3.0 
# author - min.naung/mgjean https://twentytwo.space/contact/

import clr
clr.AddReference("RevitAPI")
clr.AddReference("RevitServices")
from Autodesk.Revit.DB import *
from Autodesk.Revit.DB.Structure import RebarShape
from RevitServices.Persistence import DocumentManager
doc = DocumentManager.Instance.CurrentDBDocument

result = [];
names = IN[0]
if not isinstance(names,list):
	names = [IN[0]]

instances = FilteredElementCollector(doc).OfClass(RebarShape).ToElements();
for n in names:	
	for i in instances:
		typename = i.LookupParameter("Type Name").AsString()
		if typename == n:
			result.append(i);
OUT = result;
# ----------------------------------------
code_block_2 = CodeBlock { "H20"; }
rebarBarTypeByTypeName = Python(IN[0]=code_block_2)
# ---------- rebarBarTypeByTypeName.python (23 lines) ----------
# dynamo version 1.3.0 
# author - min.naung/mgjean https://twentytwo.space/contact/

import clr
clr.AddReference("RevitAPI")
clr.AddReference("RevitServices")
from Autodesk.Revit.DB import *
from Autodesk.Revit.DB.Structure import RebarBarType
from RevitServices.Persistence import DocumentManager
doc = DocumentManager.Instance.CurrentDBDocument

result = [];
names = IN[0]
if not isinstance(names,list):
	names = [IN[0]]

instances = FilteredElementCollector(doc).OfClass(RebarBarType).ToElements();
for n in names:	
	for i in instances:
		typename = i.LookupParameter("Type Name").AsString()
		if typename == n:
			result.append(i);
OUT = result;
# ----------------------------------------
code_block_3 = CodeBlock(i=rebarShapeByTypeName, a=rebarBarTypeByTypeName) { i[0]; a[0]; }
rebarFromShape = Python(IN[0]=select_model_elements, IN[1]=code_block_3.out0, IN[2]=code_block_3.out1)
# ---------- rebarFromShape.python (39 lines) ----------
import clr

clr.AddReference('RevitAPI')
clr.AddReference("RevitServices")

from Autodesk.Revit.DB import *
from Autodesk.Revit.DB.Structure import *

from RevitServices.Persistence import DocumentManager
from RevitServices.Transactions import TransactionManager

doc = DocumentManager.Instance.CurrentDBDocument

framings = IN[0]
shape = UnwrapElement(IN[1])
type = UnwrapElement(IN[2])
result=[]

if isinstance(framings, list):
	framings = UnwrapElement(framings)
else:
	framings = UnwrapElement([framings])


TransactionManager.Instance.EnsureInTransaction(doc)
for framing in framings:
	curve = framing.Location.Curve
	loc = curve.Origin
	vec = curve.Direction.Normalize()
	vecX = XYZ(vec.X,0,0)
	vecY = XYZ(0,vec.Y,0)

	rebar = Rebar.CreateFromRebarShape(doc, shape, type,framing,loc,vecX,vecY)
	result.append(rebar)

TransactionManager.Instance.TransactionTaskDone()


OUT = result
# ----------------------------------------
element_types = ElementTypes("RebarShape")
