# Dynamo graph sample2.dyn (Dynamo 1.3.2.2480)

select_model_elements = DSModelElementsSelection()  # 6 picked in the model
filterWall = Python(IN[0]=select_model_elements)
# ---------- filterWall.python (13 lines) ----------
import clr

elements = UnwrapElement(IN[0])

walls = []
for i in elements:
	try:
		if i.Category.Name.ToString() == "Walls":
			walls.append(i)
	except:
		pass

OUT = walls
# ----------------------------------------
geometry = Element.Geometry(filterWall)
flatten = Flatten(geometry)
byGeometry = BoundingBox.ByGeometry(flatten, lacing=CrossProduct)
minPoint = BoundingBox.MinPoint(byGeometry)
getLocation = Element.GetLocation(filterWall)
direction = Line.Direction(getLocation)
code_block = CodeBlock(v=direction) { x = v.X; y = v.Y; res = x > y; tr = CountTrue(res); fl = CountFalse(res); tr < fl; }
X = Point.X()  # unwired: arg0
Y = Point.Y()  # unwired: arg0
if_ = If(test=code_block.out5, true=X, false=Y)
sortByFunction = SortByFunction(minPoint, if_)
code_block_2 = CodeBlock(i=sortByFunction) { i[0]; i[-1]; }
byStartPointEndPoint = Line.ByStartPointEndPoint(startPoint=code_block_2.out0, endPoint=code_block_2.out1)
python_script = Python(IN[0]=byStartPointEndPoint, IN[1]=filterWall)
# ---------- python_script.python (35 lines) ----------
import clr
clr.AddReference("RevitAPI")
from Autodesk.Revit.DB import *

clr.AddReference("RevitNodes")
import Revit
clr.ImportExtensions(Revit.GeometryConversion)
clr.ImportExtensions(Revit.Elements)

clr.AddReference("RevitServices")
import RevitServices
from RevitServices.Persistence import DocumentManager
from RevitServices.Transactions import TransactionManager

doc = DocumentManager.Instance.CurrentDBDocument

line = UnwrapElement(IN[0]).ToRevitType()
elements = UnwrapElement(IN[1])

elementsRef = ReferenceArray()

for element in elements:
	a = HostObjectUtils.GetSideFaces(element, ShellLayerType.Exterior)
	for i in a:
		elementsRef.Append(i)
	b = HostObjectUtils.GetSideFaces(element, ShellLayerType.Interior)
	for i in b:
		elementsRef.Append(i)
TransactionManager.Instance.EnsureInTransaction(doc)

dim = doc.Create.NewDimension(doc.ActiveView, line, elementsRef).ToDSType(True)

TransactionManager.Instance.TransactionTaskDone()

OUT = dim
# ----------------------------------------
