# Dynamo graph services_stiffener.dyn (Dynamo 1.3.2.2480)

categories = Categories("StructuralColumns")
all_elements_of_category = ElementsOfCategory(categories)
categories_2 = Categories("PipeCurves")
all_elements_of_category_2 = ElementsOfCategory(categories_2)
python_script = Python(IN[0]=all_elements_of_category, IN[1]=all_elements_of_category_2)
# ---------- python_script.python (54 lines) ----------
import clr

clr.AddReference('ProtoGeometry')
clr.AddReference('RevitNodes')
clr.AddReference('RevitAPI')
clr.AddReference('DSCoreNodes')

import Revit
clr.ImportExtensions(Revit.Elements)
clr.ImportExtensions(Revit.GeometryConversion)


from Autodesk.DesignScript.Geometry import *
from Autodesk.Revit.DB import *


elems = UnwrapElement(IN[0])
others = UnwrapElement(IN[1])

stiffener = []

def dyn_geo(e):
	# get geo-objects of the element
	geoelem = e.GetGeometryObjectFromReference(Reference(e))
	# get enumerator to loop geo-objects
	geoobj = geoelem.GetEnumerator()
	# loop geo-objector
	for obj in geoobj:
		# convert to dynamo type
		try:
			geo = obj.ToProtoType()
		except:
			inobj = obj.GetInstanceGeometry()
			for obj in inobj:
				geo = obj.ToProtoType()
		
	# return geometry
	return geo

# to collect intersets
# loop elems
for elem in elems:
	# loop others
	for other in others:
		# find intersect geo
		elem_geo = dyn_geo(elem)
		other_geo = dyn_geo(other)
		intersect = Geometry.Intersect(elem_geo, other_geo)
		# if intersect
		if intersect:
			# pipe diameter 
			stiffener.append(elem)
			
OUT = stiffener
# ----------------------------------------
code_block = CodeBlock { 100; }
python_scripts = Python(IN[0]=python_script, IN[1]=code_block)
# ---------- python_scripts.python (86 lines) ----------
# dynamo version - 1.3.0
# author - mgjean
import clr
import System
clr.AddReference("RevitAPI")
clr.AddReference("RevitServices")

import RevitServices
from RevitServices.Persistence import DocumentManager
from RevitServices.Transactions import TransactionManager
from Autodesk.Revit.DB import *

doc = DocumentManager.Instance.CurrentDBDocument

# output list
result =[]

# elements input
elements = UnwrapElement(IN[0])

# offset from section box (mm)
offset = IN[1]/304.8


def crop_box(bbox, offset):
	# modify x,y,z point of bbox
	minX = bbox.Min.X - offset
	minY = bbox.Min.Y - offset
	minZ = bbox.Min.Z - offset
	maxX = bbox.Max.X + offset
	maxY = bbox.Max.Y + offset
	maxZ = bbox.Max.Z + offset
	# create new bbox
	newbox = BoundingBoxXYZ()
	newbox.Min = XYZ(minX,minY, minZ)
	newbox.Max = XYZ(maxX, maxY, maxZ)
	return newbox

# collect view type in document
viewTypes = FilteredElementCollector(doc).OfClass(ViewFamilyType)
#loop view types
for i in viewTypes:
	# floor plane view type
	if i.ViewFamily == ViewFamily.ThreeDimensional:
		# get type id
		viewTypeId = i.Id
		break

# start Transaction
TransactionManager.Instance.EnsureInTransaction(doc)
increment = 1
for elem in elements:
	viewName = elem.LookupParameter("Mark").AsString()

	# create new bbox by current bbox and offset
	bbox = crop_box(elem.BoundingBox[doc.ActiveView],offset)
	
	# create 3D View
	view = View3D.CreateIsometric(doc, viewTypeId)
	try:
		# set view name
		view.Name = viewName
	except:
		view.Name = str(viewName) +" ("+ str(increment)+")"
		increment+=1
	# set sectionbox to bbox
	view.SetSectionBox(bbox)
	# set cropbox active
	view.CropBoxActive = True
	# set cropbox visibility
	view.CropBoxVisible = True
	# set view scale
	view.Scale = 25
	# set detail level to fine
	view.DetailLevel = ViewDetailLevel.Fine
	# set detail style to realistic
	view.DisplayStyle = DisplayStyle.HDL

	# append it to results
	result.append(view)
	
# end Transaction
TransactionManager.Instance.TransactionTaskDone()

# output results
OUT = result
# ----------------------------------------
