# Dynamo graph star-shape-study.dyn (Dynamo 1.3.2.2480)

byCoordinates = Point.ByCoordinates()
code_block = CodeBlock { 6; 3; }
code_block_2 = CodeBlock(n=code_block.out0) { 360/n; 180/n; }
cos = Math.Cos(code_block_2.out0)
cos_2 = Math.Cos(code_block_2.out1)
formula = Formula("(r1*co1)/co2", r1=code_block.out1, co1=cos, co2=cos_2)
code_block_3 = CodeBlock(a=code_block.out1, b=formula) { {a,b}; }
byCenterPointRadius = Circle.ByCenterPointRadius(centerPoint=byCoordinates, radius=code_block_3)
firstItem = List.FirstItem(byCenterPointRadius)
code_block_4 = CodeBlock(n=code_block.out0) { pr1=0..1..#n+1; DSCore.List.RestOfItems(pr1); pr2=0.5/n..1..1/n; DSCore.List.ShiftIndices(pr2,-1); }
pointAtParameter = Curve.PointAtParameter(curve=firstItem, param=code_block_4.out1, lacing=CrossProduct)
lastItem = List.LastItem(byCenterPointRadius)
pointAtParameter_2 = Curve.PointAtParameter(curve=lastItem, param=code_block_4.out3, lacing=CrossProduct)
code_block_5 = CodeBlock(a=pointAtParameter, b=pointAtParameter_2) { DSCore.List.Transpose({a,b}); }  # frozen
flatten = Flatten(code_block_5)
boolean = BoolSelector(true)
byPoints = PolyCurve.ByPoints(points=flatten, connectLastToFirst=boolean)
watch = Watch(code_block_4.out3)
