# Dynamo graph star-shape.dyn (Dynamo 1.3.2.2480)

origin = Point.Origin()
code_block = CodeBlock { 2; }
byCenterPointRadius = Circle.ByCenterPointRadius(centerPoint=origin, radius=code_block)
code_block_2 = CodeBlock { 6; }
code_block_3 = CodeBlock { 2; }
python_script = Python(IN[0]=byCenterPointRadius, IN[1]=code_block_2, IN[2]=code_block_3)  # frozen
# ---------- python_script.python (35 lines) ----------
import clr
clr.AddReference('ProtoGeometry')
from Autodesk.DesignScript.Geometry import *

curve = IN[0]
side = float(IN[1])
times = IN[2]

base = float(1/side)
increment = 0
points = []
res = []
increment_list = []
x = times
toprint= []

for i in range(int(side)):
	increment += base
	increment_list.append(increment)
	point = Curve.PointAtParameter(curve,increment)
	points.append(point)

for num,point in enumerate(points):
	if num < len(points)-x:
		next = num + x
		line = Line.ByStartPointEndPoint(point, points[next])
	for amt in range(x):
		if num > len(points)-x and num % x == amt:
			line = Line.ByStartPointEndPoint(point, points[amt])	
		if num == len(points)-x and num % x == amt:
			line = Line.ByStartPointEndPoint(point,	points[amt])
	
	res.append(line);

OUT = res,points,toprint
# ----------------------------------------
number_slider = DoubleSlider(3, range=1..20 step 1)
followSide = Python(IN[0]=byCenterPointRadius, IN[1]=number_slider)
# ---------- followSide.python (34 lines) ----------
import clr,sys
sys.path.append(r"C:\Program Files (x86)\IronPython 2.7\Lib")
import math
clr.AddReference('ProtoGeometry')
from Autodesk.DesignScript.Geometry import *

curve = IN[0]
x = int(IN[1])
side = float(x * x)

base = float(1/side)
increment = 0
points = []
res = []
increment_list = []


for i in range(int(side)):
	increment += base
	increment_list.append(increment)
	point = Curve.PointAtParameter(curve,increment)
	points.append(point)

for num,point in enumerate(points):
	if num < len(points)-x:
		next = num + x
		line = Line.ByStartPointEndPoint(point, points[next])
	for amt in range(x):
		if num >= len(points)-x and num % x == amt:
			line = Line.ByStartPointEndPoint(point, points[amt])	

	res.append(line);

OUT = res
# ----------------------------------------
