# Dynamo graph wall-centerline.dyn (Dynamo 2.0.1.5055)

select_model_elements = DSModelElementsSelection()  # 2 picked in the model
python_script = Python(IN[0]=select_model_elements)
# ---------- python_script.python (27 lines) ----------
import clr
clr.AddReference('RevitAPI')
clr.AddReference('RevitNodes')

# for geometry conversion
import Revit
clr.ImportExtensions(Revit.GeometryConversion)
from Autodesk.Revit.DB import *

# wall input
walls = IN[0]

# make list
if isinstance(walls,list):
	walls = UnwrapElement(walls)
else:
	walls = UnwrapElement([walls])

#output
centerLines = []

# loop wall
for wall in walls:
	# collect center line
	centerLines.append(wall.Location.Curve.ToProtoType(True))
	
OUT = centerLines 
# ----------------------------------------
