# Dynamo graph worksets.dyn (Dynamo 1.3.2.2480)

getAllWorksets = Custom[GetAllWorksets]()  # Collect all user created worksets from current document.
code_block = CodeBlock(i=getAllWorksets) { i[0][1]; }
allElementsOfWorkset = Python(IN[0]=code_block)
# ---------- allElementsOfWorkset.python (23 lines) ----------
# dynamo version - 1.3.2
# author - min.naung/mgjean https://twentytwo.space/contact/

import clr
clr.AddReference('RevitAPI')
from Autodesk.Revit.DB import *
import Autodesk

clr.AddReference("RevitServices")
import RevitServices
from RevitServices.Persistence import DocumentManager
from RevitServices.Transactions import TransactionManager

doc = DocumentManager.Instance.CurrentDBDocument

workset = IN[0]
filter = ElementWorksetFilter(workset.Id,False)
# collect user created worksets
elements = FilteredElementCollector(doc).WherePasses(filter).ToElements()


# return list structure [[name,workset],[]...[]]
OUT = elements
# ----------------------------------------
UICollectElementsByWorksets = Python()  # unwired: IN[0]
# ---------- UICollectElementsByWorksets.python (143 lines) ----------
# dynamo version - 1.3.2
# author - min.naung/mgjean https://twentytwo.space/contact

import clr,sys
sys.path.append(r"C:\Program Files (x86)\IronPython 2.7\Lib")
import os, System

clr.AddReference("RevitAPI")
clr.AddReference("RevitServices")

from Autodesk.Revit.DB import *
from RevitServices.Persistence import DocumentManager
from RevitServices.Transactions import TransactionManager


clr.AddReference("System.Windows.Forms")
clr.AddReference("System.Drawing")


from System.Collections.Generic import List
from System.Windows.Forms import (Application, Button, ComboBox, CheckBox, Form as _Form,
CheckedListBox,Padding,FormBorderStyle, SelectionMode,Label, MessageBox,MessageBoxButtons, MessageBoxIcon)
from System.Drawing import (Font as _Font, Icon as _Icon, Point as _Point, Size as _Size,FontStyle)

doc = DocumentManager.Instance.CurrentDBDocument
# record all elements { name : id }
NameIdDict = {}

# collect user created worksets
worksets = FilteredWorksetCollector(doc).OfKind(WorksetKind.UserWorkset).ToWorksets()

for workset in worksets:
	# record template {name : id} 
	NameIdDict[str(workset.Name)] = workset.Id	

class CheckedBoxListSelector(_Form):
	"""Checked Box List Selector"""

	def __init__(self):
		self.selectedElements = []		
		
		
		self.Size = _Size(360,460)


		# fonts
		self.gsmt_11r = _Font("Georgia", 10)
		self.gsmt_10r = _Font("Georgia",9)
		
		# label
		self.label = Label()
		self.label.Text = "Select Worksets: "
		self.label.Font = self.gsmt_11r
		self.label.Location = _Point(30,10)
		self.label.Size = _Size(220,28)
		self.Controls.Add(self.label)
		
		# checklist box
		self.lstbox = CheckedListBox()
		self.lstbox.Items.AddRange(tuple(sorted(NameIdDict.keys())))
		self.lstbox.Font = self.gsmt_10r
		# padding
		self.lstbox.Padding = Padding(30)
		# select one click
		self.lstbox.CheckOnClick = True
		# style
		self.lstbox.ThreeDCheckBoxes = True

		self.FormBorderStyle = FormBorderStyle.FixedDialog
		self.MaximizeBox = False;
		self.ManimizeBox = False;
		self.lstbox.Location = _Point(30,45)
		self.lstbox.Size = _Size(280,300)

		# auto horizontal scrollbar
		self.lstbox.HorizontalScrollbar = True
		self.Controls.Add(self.lstbox)
		

		# select all btn
		self.btn_all = Button()
		self.btn_all.Text = "Select All"
		self.btn_all.Font = self.gsmt_10r
		self.btn_all.Size = _Size(95,25)
		self.btn_all.Location = _Point(30,375)
		self.Controls.Add(self.btn_all)

		# select none btn
		self.btn_none = Button()
		self.btn_none.Text = "Select None"
		self.btn_none.Font = self.gsmt_10r
		self.btn_none.Size = _Size(95,25)
		self.btn_none.Location = _Point(215,375)
		self.Controls.Add(self.btn_none)

		# ok btn
		self.btn = Button()
		self.btn.Text = "OK"
		self.btn.Font = self.gsmt_10r
		self.btn.Size = _Size(80,25)
		self.btn.Location = _Point(130,375)
		self.Controls.Add(self.btn)

		# events
		self.btn_all.Click += self.click_all
		self.btn_none.Click += self.click_none
		self.btn.Click += self.click_ok 

		# pop up from center
		self.CenterToScreen()

	def click_ok(self, sender, event):
		#global result
		if len(self.lstbox.CheckedItems) < 1:
			return MessageBox.Show("No element selected!", "Quasar® Info Box", MessageBoxButtons.OK, MessageBoxIcon.Asterisk)
		
		self.result = self.lstbox.CheckedItems
		
		return self.Close()		

	def click_all(self, sender, event):
		for i in range(len(self.lstbox.Items)):
			self.lstbox.SetItemChecked(i,True)

	def click_none(self, sender, event):
		for i in range(len(self.lstbox.Items)):
			self.lstbox.SetItemChecked(i,False)
	
		
# instantiate class		
ui = CheckedBoxListSelector()
# run class
Application.Run(ui)

selected_worksets = sorted(ui.result)

elements = []
for selected_workset in selected_worksets:
	filter = ElementWorksetFilter(NameIdDict[selected_workset])
	collect = FilteredElementCollector(doc).WherePasses(filter).ToElements()
	elements.append(collect)

OUT = elements
# ----------------------------------------
